# Dynamo graph 3D Print.dyn (Dynamo 2.0.3.8810)

# group: Save location
string = StringInput("C:\Users\")  # graph input
login = StringInput("MKA")  # graph input
string_2 = StringInput("\Desktop\")  # graph input
file_name = StringInput("Building")  # graph input
file_extension = StringInput(".stl")  # graph input
code_block = CodeBlock(a=string, b=login, c=string_2, d=file_name, e=file_extension) { a + b + c + d + e; }

all_elements_in_active_view = ElementsInView()
solids = Element.Solids(element=all_elements_in_active_view)
byGeometry = Autodesk.Dynamo.MeshToolkit.Mesh.ByGeometry(inputGeometry=solids)
merge = Custom[Springs.ToolkitMesh.Merge](tkMeshes=byGeometry@L2)  # Creates a single mesh entity from a list of toolkit meshes.
clean = List.Clean(list=merge)
flatten = List.Flatten(list=clean)
code_block_2 = CodeBlock { null; }
eq = flatten == code_block_2
filterByBoolMask = List.FilterByBoolMask(list=flatten, mask=eq)
scale = CodeBlock { 0.004; }
scale_2 = Autodesk.Dynamo.MeshToolkit.Mesh.Scale(mesh=filterByBoolMask.out, scaleFactor=scale)
exportMeshes = Autodesk.Dynamo.MeshToolkit.Mesh.ExportMeshes(filename=code_block, meshes=scale_2)
clean_2 = List.Clean(list=flatten)
