# Dynamo graph 3DPrintFromRevitFamiliesActiveView-V2.dyn (Dynamo 2.1.0.5784)

# group: HI
# note: Set up a dedicated view, bare in mind that you don't necessarily want ceilings, light fittings etc. etc.                   There is a minimum thickness for printing of 0.2 so you can't be making surfaces thinner than that. So you'll probably want to make railings, glass, curtain wall panels etc. thicker prior to running, doing this within Dynamo is a bit indescriminate and less easy to visualise, so recommend using global parameters within Revit alongside dedicated print Railing families

# group: Save location
string = StringInput("C:\Users\")  # graph input
hta_login = StringInput("MKA")  # graph input
string_2 = StringInput("\Desktop\")  # graph input
file_name = StringInput("RevitExportMeshScaleCorner")  # graph input
file_extension = StringInput(".stl")  # graph input
code_block = CodeBlock(a=string, b=hta_login, c=string_2, d=file_name, e=file_extension) { a + b + c + d + e; }

all_elements_in_active_view = ElementsInView()  # graph input
host = Custom[Element.Host+](element=all_elements_in_active_view)  # Gets an element's host. Unlike the OOTB node FamilyInstance.GetHost it not only works for family instances but also for elements like wall sweeps, foundations, railings, builing pads and topo subregions.
groupByKey = List.GroupByKey(list=all_elements_in_active_view, keys=host)
deconstruct = List.Deconstruct(list=groupByKey.groups)
code_block_2 = CodeBlock(x=deconstruct.first) { x; }
# note: Clockwork
code_block_3 = CodeBlock { 1; }
dropItems = List.DropItems(list=groupByKey.unique_keys, amount=code_block_3)

# group: Only curtain walls have the parameter angle
code_block_4 = CodeBlock { "Angle"; }
parameterExists = Custom[Element.ParameterExists](param=code_block_4, element=dropItems)  # Checks if an element contains a parameter of a given name

count = List.Count(list=deconstruct.rest@L2)
cycle = List.Cycle(list=parameterExists@@L1, amount=count@L1)

# group: We don't want curtain wall elements to be copied around
filterByBoolMask = List.FilterByBoolMask(list=deconstruct.rest@L2, mask=cycle@L2)

code_block_5 = CodeBlock(x=filterByBoolMask.in) { x; }
flatten = List.Flatten(list=filterByBoolMask.out)
getCategory = Element.GetCategory(element=flatten)
string_from_object = FromObject(obj=getCategory)
railings_category_filter = CodeBlock { "Railings"; }
contains = String.Contains(str=string_from_object, searchFor=railings_category_filter, lacing=Longest)

# group: We don't want railings copied around
filterByBoolMask_2 = List.FilterByBoolMask(list=flatten, mask=contains)

type = Custom[Element.Type](element=filterByBoolMask_2.out)  # Gets the family type of a given element (if applicable). Unlike the OOTB node, it also works for elements in linked models.
string_from_object_2 = FromObject(obj=type)
roof_hatch_families_filter = CodeBlock { "Hatch"; }
contains_2 = String.Contains(str=string_from_object_2, searchFor=roof_hatch_families_filter, lacing=Longest)

# group: We don't want roof hatches copied around
filterByBoolMask_3 = List.FilterByBoolMask(list=filterByBoolMask_2.out, mask=contains_2)

create = List.Create(item0=code_block_2, item1=code_block_5, item2=filterByBoolMask_2.in, item3=filterByBoolMask_3.in)
clean = Orchid.Generic.Core.List.Clean(list=create)
flatten_2 = List.Flatten(list=clean)
code_block_6 = CodeBlock(x=flatten_2) { x; }
boolean = BoolSelector(true)  # graph input
meshGeometry = Custom[Springs.Element.MeshGeometry](element=code_block_6, asToolkitMesh=boolean)  # Reads an element's geometry and converts it to either a Dynamo mesh or a toolkit mesh representation. The node will return Dynamo meshes by default. The LOD input represents the triangulation factor. Its range is from 0 to 1. 0 is the lowest level of detail and 1 is the highest. It's set to 0 by default.
merge = Custom[Springs.ToolkitMesh.Merge](tkMeshes=meshGeometry@L2)  # Creates a single mesh entity from a list of toolkit meshes.
code_block_7 = CodeBlock(x=merge) { x; }
code_block_8 = CodeBlock { "Family and Type"; }
getParameterValueByName = Element.GetParameterValueByName(element=filterByBoolMask_3.out, parameterName=code_block_8)
groupByKey_2 = List.GroupByKey(list=filterByBoolMask_3.out, keys=getParameterValueByName)
firstItem = List.FirstItem(list=groupByKey_2.groups@L2)
type_2 = Custom[Element.Type](element=firstItem)
code_block_9 = CodeBlock(x=type_2) { x; }

# group: Get
meshGeometry_2 = Custom[Springs.Element.MeshGeometry](element=code_block_9, asToolkitMesh=boolean)

# group: Squash geometry of typical families into 1
merge_2 = Custom[Springs.ToolkitMesh.Merge](tkMeshes=meshGeometry_2@L2)

location = Custom[Element.Location](element=groupByKey_2.groups@L2)  # Returns the location of an element as point, curve or curve loop, along with some booleans to help filtering the results. Unlike the OOTB Element.GetLocation node, it also retunrs sketch lines of sketch-based elements like floor slabs as well as the element's rotation property.
count_2 = List.Count(list=location.points@L2)
cycle_2 = List.Cycle(list=merge_2@L1, amount=count_2@@L1)

# group: Get the bounding boxes of the typical family meshes and find the centre of their bases to use as base points
springs_toolkit_mesh_boundingbox = Custom[Springs.(Toolkit)Mesh.BoundingBox](mesh=merge_2)  # Get the bounding box of a mesh. Works with both built-in meshes and toolkit meshes
midPoint = Custom[Springs.BoundingBox.MidPoint](boundingBox=springs_toolkit_mesh_boundingbox)  # Fetches the mid point of the bounding box.
extents = Custom[Springs.Geometry.Extents](geometry=springs_toolkit_mesh_boundingbox)  # Gets the dimensions of the geometry's bounding box.
code_block_10 = CodeBlock { 2; }
div = extents.height / code_block_10
code_block_11 = CodeBlock { -1; }
mul = div * code_block_11
translate = Geometry.Translate(geometry=midPoint, zTranslation=mul)

code_block_12 = CodeBlock(x=count_2) { x; }

# group: Move the typical family meshes to 0,0
cycle_3 = List.Cycle(list=translate@L1, amount=count_2@@L1)
code_block_13 = CodeBlock { 0; }
byCoordinates = Point.ByCoordinates(x=code_block_13, y=code_block_13, z=code_block_13)
cycle_4 = List.Cycle(list=byCoordinates, amount=code_block_12, lacing=Longest)
byTwoPoints = Vector.ByTwoPoints(start=cycle_3@L2, end=cycle_4@L2)
translate_2 = Autodesk.Dynamo.MeshToolkit.Mesh.Translate(mesh=cycle_2@L2, vector=byTwoPoints@L2)

code_block_14 = CodeBlock(x=location.angle) { x; }

# group: Rotate to correct orientation
ZAxis = Vector.ZAxis()
rotate = Autodesk.Dynamo.MeshToolkit.Mesh.Rotate(mesh=translate_2@L2, axis=ZAxis, degrees=code_block_14@L2)

code_block_15 = CodeBlock(x=location.points) { x; }

# group: Move typical family meshes to specific instance locations
byTwoPoints_2 = Vector.ByTwoPoints(start=cycle_4@L2, end=code_block_15@L2)
translate_3 = Autodesk.Dynamo.MeshToolkit.Mesh.Translate(mesh=rotate@L2, vector=byTwoPoints_2@L2)

create_2 = List.Create(item0=code_block_7, item1=translate_3)
clean_2 = Orchid.Generic.Core.List.Clean(list=create_2)
flatten_3 = List.Flatten(list=clean_2)
scale = CodeBlock { 0.005; }
scale_2 = Autodesk.Dynamo.MeshToolkit.Mesh.Scale(mesh=flatten_3, scaleFactor=scale)
exportMeshes = Autodesk.Dynamo.MeshToolkit.Mesh.ExportMeshes(filename=code_block, meshes=scale_2)
code_block_16 = CodeBlock(x=type_2) { x; }
nullIndice = Custom[List.NullIndice](list=host)  # Get all null indice from a list
