# Dynamo graph Adjusting NURBS manually-MKA-3-Tspline.dyn (Dynamo 2.0.3.8810)

wall_location = WallLocation()  # nothing selected
wall_types = WallTypes()  # nothing selected
byCoordinates = Point.ByCoordinates()
number_slider = DoubleSlider(50, range=0..100 step 0.1)
number_slider_2 = DoubleSlider(50, range=0..100 step 0.1)
byCoordinates_2 = Point.ByCoordinates(x=number_slider, y=number_slider_2)
number_slider_3 = DoubleSlider(3, range=0..100 step 0.1)
number_slider_4 = DoubleSlider(3, range=0..100 step 0.1)
boolean = BoolSelector(true)
byPlaneOriginNormal = TSpline.TSplineSurface.ByPlaneOriginNormal(minCorner=byCoordinates, maxCorner=byCoordinates_2, xSpans=number_slider_3, ySpans=number_slider_4, inSmoothMode=boolean)
innerVertices = TSpline.TSplineTopology.InnerVertices(tSplineTopology=byPlaneOriginNormal)
byCoordinates_3 = Point.ByCoordinates()
number_slider_5 = DoubleSlider(0, range=0..100 step 0.1)
number_slider_6 = DoubleSlider(0, range=0..100 step 0.1)
number_slider_7 = DoubleSlider(-22.569, range=-33.037..100 step 0.1)
byCoordinates_4 = Point.ByCoordinates(x=number_slider_5, y=number_slider_6, z=number_slider_7)
byTwoPoints = Vector.ByTwoPoints(start=byCoordinates_3, end=byCoordinates_4)
moveVertices = TSpline.TSplineSurface.MoveVertices(tSplineSurface=byPlaneOriginNormal, vertices=innerVertices, vector=byTwoPoints)
file_path = Filename("..\..\..\ProgramData\Autodesk\RVT 2018\Family Templates\English\Metric Generic Model.rft")
code_block = CodeBlock { "Test"; }
categories = Categories(index=228)
byGeometry = Custom[Springs.FamilyInstance.ByGeometry](geometry=moveVertices, familyTemplatePath=file_path, familyName=code_block, category=categories)  # You must provide a valid family template path that will be used for all input geometry objects. The project units(and not the templates) will be used to determine the size of the output geometry. The provided category will be used only if the family template supports it. If not, the default template category will be used instead. Likewise, the family material(provided as a string) will be set only if a material with that name exists in the template. If not, the default material will be used instead ("By Category"). For void cuts, the material settings will be ignored. The Subcategory name is an optional input. If you'd like to skip assigning a Subcategory to any new instance, simply use null. The node expects a unique family name for each geometry object. The rest of the input lists will be processed as if the node lacing is set to longest.
faces = Element.Faces(element=byGeometry.instance)
byFace = Wall.ByFace(locationLine=wall_location, wallType=wall_types, surface=faces)
