# Dynamo graph AreaFromFilledRegion-ActiveView-TextCreate-WYM.dyn (Dynamo 2.0.3.8810)

boolean = BoolSelector(true)
python_script = Python(IN[0]=boolean)
# ---------- python_script.python (39 lines) ----------
#Copyright(c) 2015, Konrad K Sobon
# @arch_laboratory, http://archi-lab.net

import clr
clr.AddReference('ProtoGeometry')
from Autodesk.DesignScript.Geometry import *

# Import RevitAPI
clr.AddReference("RevitAPI")
import Autodesk
from Autodesk.Revit.DB import *
from Autodesk.Revit.DB.Analysis import *

# Import DocumentManager and TransactionManager
clr.AddReference("RevitServices")
import RevitServices
from RevitServices.Persistence import DocumentManager
from RevitServices.Transactions import TransactionManager

doc = DocumentManager.Instance.CurrentDBDocument

# Import ToDSType(bool) extension method
clr.AddReference("RevitNodes")
import Revit
clr.ImportExtensions(Revit.Elements)
clr.ImportExtensions(Revit.GeometryConversion)


inView = FilteredElementCollector(doc, doc.ActiveView.Id).OfClass(FilledRegion)


output = []
for regions in inView:
    output.append(regions.ToDSType(True))
    
OUT = output

#Assign your output to the OUT variable
#OUT = [i.ToDSType(True) for i in inView],[j.ToDSType(True) for j in inProject]
# ----------------------------------------

# group: Groups by Name, in this case Type has been used to define Name
code_block = CodeBlock { "Family and Type"; }
getParameterValueByName = Element.GetParameterValueByName(element=python_script, parameterName=code_block)
code_block_2 = CodeBlock(e=getParameterValueByName) { e.Name; }
groupByKey = List.GroupByKey(list=python_script, keys=code_block_2)

# group: Filter out filled regions to get only the ones we want
code_block_3 = CodeBlock { ["Orange", "Green", "Blue", "Purple", "Red"]; true; }
contains = String.Contains(str=groupByKey.unique_keys, searchFor=code_block_3.out0@L1, ignoreCase=code_block_3.out1)
code_block_4 = CodeBlock { true; }
indexOf = List.IndexOf(list=contains@L2, element=code_block_4)
code_block_5 = CodeBlock { -1; }
eq = indexOf == code_block_5
filterByBoolMask = List.FilterByBoolMask(list=indexOf, mask=eq)
itemAtIndex = Custom[Springs.List.ItemAtIndex+](list=groupByKey.groups, index=filterByBoolMask.out)  # Identical to the built in node but works with negative indices
itemAtIndex_2 = Custom[Springs.List.ItemAtIndex+](list=groupByKey.unique_keys, index=filterByBoolMask.out)

code_block_6 = CodeBlock { "Area"; }
getParameterValueByName_2 = Element.GetParameterValueByName(element=itemAtIndex, parameterName=code_block_6)
sum = Math.Sum(values=getParameterValueByName_2)
round = Math.Round(number=sum)

# group: Creates a text list of filled region areas in m² and ft²
string_from_object = FromObject(obj=round)
code_block_7 = CodeBlock { "."; }
split = String.Split(str=string_from_object, separater0=code_block_7)
code_block_8 = CodeBlock { 0; }
getItemAtIndex = List.GetItemAtIndex(list=split@L2, index=code_block_8)
code_block_9 = CodeBlock(x=round) { x*10.7639; }
string_from_object_2 = FromObject(obj=code_block_9)
code_block_10 = CodeBlock { "."; }
split_2 = String.Split(str=string_from_object_2, separater0=code_block_10)
code_block_11 = CodeBlock { 0; }
getItemAtIndex_2 = List.GetItemAtIndex(list=split_2@L2, index=code_block_11)
code_block_12 = CodeBlock(x=getItemAtIndex, y=getItemAtIndex_2) { x + " m² / " + y + " ft²"; }
code_block_13 = CodeBlock()  # //sq m to Sq ft

# group: Pushes Area into Comments Parameter for use in tagging
code_block_14 = CodeBlock { "Mark"; }
setParameterByName = Element.SetParameterByName(element=itemAtIndex, parameterName=code_block_14, value=code_block_12)

# group: Creates a total list of filled region areas in m² and ft²
code_block_15 = CodeBlock()  # //sq m to Sq ft
sum_2 = Math.Sum(values=round)
string_from_object_3 = FromObject(obj=sum_2)
code_block_16 = CodeBlock { "."; }
split_3 = String.Split(str=string_from_object_3, separater0=code_block_16)
code_block_17 = CodeBlock { 0; }
getItemAtIndex_3 = List.GetItemAtIndex(list=split_3@L2, index=code_block_17)
code_block_18 = CodeBlock(x=sum_2) { x*10.7639; }
string_from_object_4 = FromObject(obj=code_block_18)
code_block_19 = CodeBlock { "."; }
split_4 = String.Split(str=string_from_object_4, separater0=code_block_19)
code_block_20 = CodeBlock { 0; }
getItemAtIndex_4 = List.GetItemAtIndex(list=split_4@L2, index=code_block_20)
code_block_21 = CodeBlock(x=getItemAtIndex_3, y=getItemAtIndex_4) { "Total : " + x + " m² / " + y + " ft²"; }

# group: Creates a text note in the centre of the view that totals the info in the tags
get_revit_activeview = Custom[Get Revit ActiveView]()  # Active View
code_block_22 = CodeBlock { 5000; 0; 3000; }

byCoordinates = Point.ByCoordinates(x=code_block_22.out0, y=code_block_22.out1, z=code_block_22.out2)
code_block_23 = CodeBlock(x=itemAtIndex_2) { x; }

# group: Adds the name back to the area
code_block_24 = CodeBlock(z=code_block_23, y=code_block_12) { z + "  : "+ y; }

addItemToEnd = List.AddItemToEnd(item=code_block_21, list=code_block_24)
flatten = List.Flatten(list=addItemToEnd)
string_from_array = FromArray(arr=flatten)
watch = Watch(string_from_array)
code_block_25 = CodeBlock { ","; }

# group: This makes a return in the text list
code_block_26 = CodeBlock { ",\n"; }

replace = String.Replace(str=watch, searchFor=code_block_25, replaceWith=code_block_26)
watch_2 = Watch(replace)

# group: Removes comma from end of lines
code_block_27 = CodeBlock { ","; ""; }
replace_2 = String.Replace(str=watch_2, searchFor=code_block_27.out0, replaceWith=code_block_27.out1)

# group: String from Array adds a {} around the text, this removes it
code_block_28 = CodeBlock { 0; 1; }
remove = String.Remove(str=replace_2, startIndex=code_block_28.out0, count=code_block_28.out1)
code_block_29 = CodeBlock { -1; 1; }
remove_2 = String.Remove(str=remove, startIndex=code_block_29.out0, count=code_block_29.out1)

watch_3 = Watch(remove_2)
default = TextNoteType.Default()
boolean_2 = BoolSelector(true)
byViewPointAndType = Custom[TextNote.ByViewPointAndType](View=get_revit_activeview, Point=byCoordinates, Text=watch_3, TextNoteType=default, RunIt=boolean_2)  # This node creates a unwrapped (single line) text note in a given view, at a given location with a given text note type style assigned.
code_block_30 = CodeBlock()  # //get all filled regions in view
