# Dynamo graph Batch Plot - SBC-TAH.dyn (Dynamo 2.0.3.8810)

# group: Start
# note: This graph batch plots pdfs to a defined folder and batch exports dwg to it's sub folder.
# The file naming is set for CWG
# The folder automatically has the current date in it's title
# The graph prints using the print settings defined in the document and uses the title block name to determine the correct size and orientation.
# E.g. to work correctly you need to have title block names containing A1 and Portrait
# E.g. to work correctly you need to have a print setting name containig A1 and Portrait
# These can be created by running the associated HTA Print Setting Graph
# The graph runs off a View Set that should be created prior to it's running
# The graph works best with PDF Creator, if you use Adobe PDF you won't be able to automatically have the file location set.
# PDF Creator is a free download.  To import the required settings, go to C:\Program Files \PDF Creator and open the PDFCreator.exe you can then navigate to Settins > Debug > Load settings from file and open the accompanying PrintSettings.ini file.
# note: Package Usage :
# spring nodes
# archilab
# Clockwork
# GeniusLoci
# Rhythm

# group: Creates a View Set of the sheets with Today's revision date
string = StringInput("Today's Revision")
code_block = CodeBlock { "Sheets"; }
byName = Category.ByName(name=code_block)
all_elements_of_category = ElementsOfCategory(Category=byName)
code_block_2 = CodeBlock { "."; }
now = DateTime.Now()
code_block_3 = CodeBlock { "d"; "/"; }
format = DateTime.Format(dateTime=now, format=code_block_3.out0)
split = String.Split(str=format, separater0=code_block_3.out1)
code_block_4 = CodeBlock(x=split) { x[0]; x[1]; x[2]; }
code_block_5 = CodeBlock { "20"; ""; }
replace = String.Replace(str=code_block_4.out2, searchFor=code_block_5.out0, replaceWith=code_block_5.out1)
boolean = BoolSelector(true)

revisions = archilab.Revit.Views.Sheets.Revisions(sheet=all_elements_of_category)

# group (continued): Creates a View Set of the sheets with Today's revision date
# note: Custom Node: archilab v.2019.2.11
revision_properties = Custom[Revision Properties](Revision=revisions)  # This node will return some most common Revision properties like Description or Issue Date.
# note: Custom Node: Clockwork v.1.31.2
count = List.Count(list=revision_properties.Date)

code_block_6 = CodeBlock { ""; }
replaceEmptyLists = Custom[List.ReplaceEmptyLists](seq=revision_properties.Date, Replacement=code_block_6)  # Replaces all empty lists within a given list with a substitute
lastItem = List.LastItem(list=replaceEmptyLists@L2)

# group: For Review?
for_review = BoolSelector(false)  # graph input

code_block_7 = CodeBlock(x=for_review) { x; }
code_block_8 = CodeBlock { "XX"; }
if_ = If(test=code_block_7, true=code_block_8, false=code_block_4.out1)

# group (continued): Creates a View Set of the sheets with Today's revision date
create = List.Create(item0=if_, item1=code_block_4.out0, item2=replace)
join = String.Join(separator=code_block_2, string0=create)
cycle = List.Cycle(list=join, amount=count)
eq = lastItem == cycle
filterByBoolMask = List.FilterByBoolMask(list=all_elements_of_category, mask=eq)
# note: Custom Node: spring nodes v.132.2.7
byViewsName = Custom[Springs.ViewSet.ByViewsName](views=filterByBoolMask.in, setName=string, Overwrite=boolean)  # Creates a set of views(or sheets) for printing. If the set exists, set Overwrite to true to replace it.

# group: or View Set?
# note: Custom Node: archilab v.2019.2.11
view_set_to_print = ViewSetUi(index=0)  # graph input

code_block_9 = CodeBlock(x=view_set_to_print) { x; }

# group: Get view set sheets
# note: Custom Node: Clockwork v.1.31.2
passthrough = Custom[Passthrough](passThrough=string, waitFor=byViewsName)  # Forces a sequential order of execution. The node wired into the output of the Passthrough node will be executed *after* the node wired into the waitFor input (e.g. important for some Revit operations). The value of the passThrough input will be passed on to the node wired into the output port of the Passthrough node.
python_script_get_views_by_view = Python(IN[0]=passthrough)  # "Python Script Get Views by View Set Name"
# ---------- python_script_get_views_by_view.python (37 lines) ----------
#Copyright(c) 2015, Konrad Sobon
# @arch_laboratory, http://archi-lab.net

import clr
clr.AddReference('ProtoGeometry')
from Autodesk.DesignScript.Geometry import *

# Import DocumentManager and TransactionManager
clr.AddReference("RevitServices")
import RevitServices
from RevitServices.Persistence import DocumentManager
from RevitServices.Transactions import TransactionManager

doc = DocumentManager.Instance.CurrentDBDocument

# Import Element wrapper extension methods
clr.AddReference("RevitNodes")
import Revit
clr.ImportExtensions(Revit.Elements)

# Import RevitAPI
clr.AddReference("RevitAPI")
import Autodesk
from Autodesk.Revit.DB import *

viewSet = UnwrapElement(IN[0])

viewSets = FilteredElementCollector(doc).OfClass(ViewSheetSet)

for i in viewSets:
	if i.Name == viewSet:
		vs = i
	else:
		continue

#Assign your output to the OUT variable
OUT = [i.ToDSType(True) for i in vs.Views]
# ----------------------------------------
# note: Custom Node: archilab v.2019.2.11
get_views_from_view_set = Custom[Get Views from View Set](ViewSet=code_block_9)  # This node will take a name of a view set and return views/sheet elements contained in it.

# group: Today's Revision?
print_sheets_from_today_s = BoolSelector(false)  # "Print Sheets from Today's Revision?"; graph input

print_today_s_revision = CodeBlock(x=print_sheets_from_today_s) { x; }
scopeif_clockwork = CodeBlock(trueval=python_script_get_views_by_view, falsevl=get_views_from_view_set, test=print_today_s_revision) { result = [trueval, falsevl]; result[test ? 0 : 1]; }
code_block_10 = CodeBlock(x=scopeif_clockwork.out1) { x; }
code_block_11 = CodeBlock(x=code_block_10) { x; }
parameters = Element.Parameters(element=code_block_11)

# group: Turn revisions on sheet that aren't the current one to hidden
# note: Custom Node: archilab v.2019.2.11
revisions_2 = archilab.Revit.Views.Sheets.Revisions(sheet=code_block_11)
# note: Custom Node: Clockwork v.1.31.2
dropLastItem = Custom[List.DropLastItem](list=revisions_2@L2)  # Drops the last item from a given list.
flatten = List.Flatten(list=dropLastItem)
uniqueItems = List.UniqueItems(list=flatten)
select_revision_visibility = RevisionVisibility(index=1)
python_script = Python(IN[0]=uniqueItems, IN[1]=select_revision_visibility)
# ---------- python_script.python (28 lines) ----------
import clr
clr.AddReference('RevitAPI')
import Autodesk
from Autodesk.Revit.DB import *
import System

clr.AddReference('RevitNodes')
import Revit
clr.ImportExtensions(Revit.Elements)

clr.AddReference('RevitServices')
import RevitServices
from RevitServices.Persistence import DocumentManager
from RevitServices.Transactions import TransactionManager
doc = DocumentManager.Instance.CurrentDBDocument

revisions = UnwrapElement(IN[0])

vis = System.Enum.Parse(Autodesk.Revit.DB.RevisionVisibility, IN[1])

TransactionManager.Instance.EnsureInTransaction(doc)

for r in revisions:
	newvis = r.Visibility = vis

TransactionManager.Instance.TransactionTaskDone()

OUT = revisions, [v.Visibility for v in revisions]
# ----------------------------------------

code_block_12 = CodeBlock()  # //The rest must be a3 right?!
code_block_13 = CodeBlock()  # //The rest of the rest!
code_block_14 = CodeBlock()  # //the rest are all a3 right?

# group: Gets Sheets & Parameters
element_types = ElementTypes(index=244)
all_elements_of_type = ElementsOfType(element_type=element_types)

# group: Project Parameters
code_block_15 = CodeBlock(x=all_elements_of_type) { x; }
code_block_16 = CodeBlock(x=code_block_11) { x; }

# group: Parameters for use
code_block_17 = CodeBlock { ["HTA Client Code", "BS Project", "Author","BS Role"]; }
code_block_18 = CodeBlock { ["BS Document Type"]; }
code_block_19 = CodeBlock { "SHEET_NUMBER"; }
code_block_20 = CodeBlock { "SHEET_NAME"; }

# group: Sheet Parameters
code_block_21 = CodeBlock(x=code_block_11) { x; }
code_block_22 = CodeBlock(x=code_block_11) { x; }
code_block_23 = CodeBlock(x=code_block_11) { x; }
code_block_24 = CodeBlock(x=code_block_11) { x; }
code_block_25 = CodeBlock(x=code_block_11) { x; }

code_block_26 = CodeBlock { ["Zone Code A"]; }
getParameterValueByName = Element.GetParameterValueByName(element=code_block_21@L1, parameterName=code_block_26)
code_block_27 = CodeBlock { ["Zone Code B"]; }
getParameterValueByName_2 = Element.GetParameterValueByName(element=code_block_22@L1, parameterName=code_block_27)

# group: Include Revision?
include_revision = BoolSelector(false)  # graph input

code_block_28 = CodeBlock(x=include_revision) { x; }
code_block_29 = CodeBlock(x=code_block_11) { x; }
code_block_30 = CodeBlock { "Current Revision"; }

# group: Generate Drawing Title Using Parameters
code_block_31 = CodeBlock { "_"; }
# note: Element Parameters
getParameterValueByName_3 = Element.GetParameterValueByName(element=code_block_15@L1, parameterName=code_block_17)
# note: Client, project name and author the same on every drawing so list cyclecounts how many there are and renames that many times
flatten_2 = List.Flatten(list=getParameterValueByName_3)
code_block_32 = CodeBlock(x=flatten_2) { x[0]; x[1]; x[2]; x[3]; }
code_block_33 = CodeBlock { "-"; }
concat = String.Concat(string0=code_block_32.out0, string1=code_block_33, string2=code_block_32.out1, string3=code_block_33, string4=code_block_32.out3)
count_2 = List.Count(list=code_block_16)
cycle_2 = List.Cycle(list=concat, amount=count_2)
code_block_34 = CodeBlock { "_"; }
flatten_3 = List.Flatten(list=getParameterValueByName)
code_block_35 = CodeBlock { "-"; }
flatten_4 = List.Flatten(list=getParameterValueByName_2)
code_block_36 = CodeBlock(x=flatten_3, y=code_block_35, z=flatten_4) { x + y+ z; }
code_block_37 = CodeBlock { "_"; }
getParameterValueByName_4 = Element.GetParameterValueByName(element=code_block_23@L1, parameterName=code_block_18)
flatten_5 = List.Flatten(list=getParameterValueByName_4)
code_block_38 = CodeBlock { "_"; }
# note: Custom Node: archilab v.2019.2.11
get_built_in_parameter = Custom[Get Built In Parameter](ParameterNames=code_block_19, Elements=code_block_24)  # This node will take an input of a built in parameter name and element to return that parameters value.
flatten_6 = List.Flatten(list=get_built_in_parameter)
# note: Built in Parameter as most reliable
getParameterValueByName_5 = Element.GetParameterValueByName(element=code_block_29, parameterName=code_block_30)
get_built_in_parameter_2 = Custom[Get Built In Parameter](ParameterNames=code_block_20, Elements=code_block_25)

code_block_39 = CodeBlock(x=code_block_36, y=code_block_37, z=flatten_5) { x + y+ z; }

# group (continued): Generate Drawing Title Using Parameters
code_block_40 = CodeBlock(x=code_block_39, y=code_block_38, z=flatten_6) { x + y+ z; }
code_block_41 = CodeBlock(x=cycle_2, y=code_block_34, z=code_block_40) { x + y+ z; }

code_block_42 = CodeBlock(x=code_block_41) { x; }
code_block_43 = CodeBlock(x=getParameterValueByName_5) { x; }

# group: Include Revision?
count_3 = List.Count(list=code_block_42)
cycle_3 = List.Cycle(list=code_block_28, amount=count_3)
filterByBoolMask_2 = List.FilterByBoolMask(list=code_block_42, mask=cycle_3)
code_block_44 = CodeBlock(x=filterByBoolMask_2.in, y=code_block_43) { x + "_" + y; }
code_block_45 = CodeBlock(x=filterByBoolMask_2.out) { x; }
code_block_46 = CodeBlock(a=code_block_44, b=code_block_45, x=code_block_28) { choice = [a,b]; choice[x ? 0 :1]; }

# group: Include Title?
include_drawing_title = BoolSelector(false)  # graph input

code_block_47 = CodeBlock(x=include_drawing_title) { x; }
code_block_48 = CodeBlock(x=get_built_in_parameter_2) { x; }

# group: Include drawing title?
count_4 = List.Count(list=code_block_46.out1)
cycle_4 = List.Cycle(list=code_block_47, amount=count_4)
filterByBoolMask_3 = List.FilterByBoolMask(list=code_block_46.out1, mask=cycle_4)
code_block_49 = CodeBlock(x=filterByBoolMask_3.in, y=code_block_48) { x + " - " + y; }
code_block_50 = CodeBlock(x=filterByBoolMask_3.out) { x; }
code_block_51 = CodeBlock(a=code_block_49, b=code_block_50, x=code_block_47) { choice = [a,b]; choice[x ? 0 :1]; }

code_block_52 = CodeBlock(x=code_block_51.out1) { x; }

# group: Save to desktop?
save_to_desktop = BoolSelector(false)  # graph input

code_block_53 = CodeBlock(x=save_to_desktop) { x; }
python_script_2 = Python()
# ---------- python_script_2.python (11 lines) ----------
import clr
import sys
sys.path.append("C:\Program Files (x86)\IronPython 2.7\Lib")

from os import path
import os
desktop = os.path.join(os.path.join(os.environ['USERPROFILE']), 'Desktop')

#user = os.environ.get('USERNAME')

OUT = desktop, #user
# ----------------------------------------
code_block_54 = CodeBlock(x=python_script_2) { x[0]; }

# group: or Folder Location?
or_save_location = StringInput("\\Chorlton\cd\SBC-TAH\Y-Out")  # graph input

code_block_55 = CodeBlock(x=or_save_location) { x; }
if_2 = If(test=code_block_53, true=code_block_54, false=code_block_55)
code_block_56 = CodeBlock(x=code_block_7) { x; }
code_block_57 = CodeBlock(x=code_block_56) { x; }
code_block_58 = CodeBlock { "XX"; }

# group: Folder Seperator
code_block_59 = CodeBlock { "-"; }

# group: Folder Name
folder_name = StringInput("TEST")  # graph input

# group: folder name by sheet categories
code_block_60 = CodeBlock { " & "; }
code_block_61 = CodeBlock { " "; }
code_block_62 = CodeBlock { "Sheet Series"; }
getParameterValueByName_6 = Element.GetParameterValueByName(element=code_block_10, parameterName=code_block_62)
code_block_63 = CodeBlock { "-"; }
split_2 = String.Split(str=getParameterValueByName_6, separater0=code_block_63)
restOfItems = List.RestOfItems(list=split_2@L2)
join_2 = String.Join(separator=code_block_61, string0=restOfItems@L2)
uniqueItems_2 = List.UniqueItems(list=join_2)
join_3 = String.Join(separator=code_block_60, string0=uniqueItems_2@L2)
code_block_64 = CodeBlock { "-(FOR INTERNAL REVIEW)"; }
code_block_65 = CodeBlock(x=join_3, y=code_block_64) { x + y; }

if_3 = If(test=code_block_57, true=code_block_65, false=join_3)
code_block_66 = CodeBlock(x=folder_name, y=if_3) { z = x + y; z[0]; }
code_block_67 = CodeBlock { 0; }

# group: Create new folder with current date and title
# note: if the inputs have different list structures you'll get an odd output
string_2 = StringInput("\")
now_2 = DateTime.Now()
components = DateTime.Components(dateTime=now_2)
string_from_object = FromObject(obj=components.year)
code_block_68 = CodeBlock { "0"; }
split_3 = String.Split(str=string_from_object, separater0=code_block_68)
code_block_69 = CodeBlock(x=split_3) { x[1]; }
string_from_object_2 = FromObject(obj=components.month)
code_block_70 = CodeBlock { 2; }
code_block_71 = CodeBlock { "0"; }
padLeft = String.PadLeft(str=string_from_object_2, newWidth=code_block_70, padChars=code_block_71)
string_from_object_3 = FromObject(obj=components.day)
padLeft_2 = String.PadLeft(str=string_from_object_3, newWidth=code_block_70, padChars=code_block_71)
code_block_72 = CodeBlock { 50; }

if_4 = If(test=code_block_57, true=code_block_58, false=padLeft_2)
concat_2 = String.Concat(string0=string_2, string1=code_block_69, string2=padLeft, string3=if_4, string4=code_block_59, string5=code_block_66.out1)

# group (continued): Create new folder with current date and title
length = String.Length(str=concat_2)
le = length <= code_block_72
if_5 = If(test=le, true=length, false=code_block_72)
substring = String.Substring(str=concat_2, startIndex=code_block_67, length=if_5)
if_6 = If(test=le, true=concat_2, false=substring)

concat_3 = String.Concat(string0=if_2, string1=if_6)

# group (continued): Create new folder with current date and title
code_block_73 = CodeBlock(x=concat_3) { x; }
fromPath = DirectoryObject(path=code_block_73)  # "Directory.FromPath"

# note: Custom Node: Clockwork v.1.31.2
passthrough_2 = Custom[Passthrough](passThrough=code_block_73, waitFor=fromPath)
code_block_74 = CodeBlock(x=passthrough_2) { x; }
string_3 = StringInput("\")

# group: File names for pdfs
# note: Custom Node: archilab v.2019.2.11
new_name = CodeBlock(x=code_block_52) { x; }
file_extension = CodeBlock { ""; }
code_block_75 = CodeBlock { ""; }
code_block_76 = CodeBlock(x=code_block_74, y=string_3) { x+ y; }

clear_list = Custom[Clear List](Input=new_name)  # This node will remove all Null and Empty Lists from any list.

# group (continued): File names for pdfs
# note: Can't be in a list, wants a string not a directory path
string_from_list = Custom[String From List](List=clear_list, Suffix=file_extension, Seperator=code_block_75)  # This node will take an input of a list or nested list and then join each element in a list with a given seperator while adding a suffix.

python_script_3 = Python(IN[0]=string_from_list, IN[1]=code_block_76)
# ---------- python_script_3.python (14 lines) ----------
#From Michael Park

import clr
clr.AddReference('ProtoGeometry')
from Autodesk.DesignScript.Geometry import *

#The inputs to this node will be stored as a list in the IN variables.
dataEnteringNode = IN

#Assign your output to the OUT variable.
OUT = []

for names in IN[0]:
    OUT.append("\\".join([IN[1], str(names) + ".pdf"]))
# ----------------------------------------
code_block_77 = CodeBlock(x=python_script_3) { x; }

# group: Create Sub Folder for DWGs
# note: Custom Node: Clockwork v.1.31.2
passthrough_3 = Custom[Passthrough](passThrough=code_block_73, waitFor=fromPath)
# note: Custom Node: archilab v.2019.2.11
string_4 = StringInput("\DWG")

code_block_78 = CodeBlock(x=passthrough_3, y=string_4) { x+ y; }

# group: DWG Required?
export_dwg = BoolSelector(true)  # graph input

dwg_export = CodeBlock(x=export_dwg) { x; }
dwg_export_2 = CodeBlock(x=dwg_export) { x; }
filterByBoolMask_4 = List.FilterByBoolMask(list=code_block_78, mask=dwg_export_2)

# group (continued): Create Sub Folder for DWGs
# note: We don't want a DWG folder if there are no DWGS
fromPath_2 = DirectoryObject(path=filterByBoolMask_4.in)  # "Directory.FromPath"
end = Revit.Transaction.Transaction.End(input=filterByBoolMask_4.out)

passthrough_4 = Custom[Passthrough](passThrough=filterByBoolMask_4.in, waitFor=fromPath_2)

# group (continued): Create Sub Folder for DWGs
code_block_79 = CodeBlock(x=passthrough_4) { x[0]; }

directory_path = CodeBlock(x=code_block_79) { x; }

# group: Geolocated dwg?
export_dwg_geolocated = BoolSelector(false)  # graph input

geo_located_dwg = CodeBlock(x=export_dwg_geolocated) { x; }
geo_located_dwg_2 = CodeBlock(x=geo_located_dwg) { x; }
geo_located_dwg_3 = CodeBlock(x=geo_located_dwg_2) { x; }
sheets = CodeBlock(x=code_block_11) { x; }
code_block_80 = CodeBlock(x=sheets) { x; }
code_block_81 = CodeBlock { -1; }

# group: Get viewports off sheets to use as geolocated dwgs... if there are no viewports, just use the empty sheet
# note: Custom Node: archilab v.2019.2.11
viewports = archilab.Revit.Views.Sheets.Viewports(sheet=code_block_80)
# note: Is there more than 1 viewport?
count_5 = List.Count(list=viewports@L2)
code_block_82 = CodeBlock { 1; }
gt = count_5 > code_block_82
# note: Get the index which does have more than 1 viewport
code_block_83 = CodeBlock { true; }
code_block_84 = CodeBlock(x=viewports) { x; }
code_block_85 = CodeBlock { false; }
# note: this will == 0 if there are no sheets with multiple viewports
indexOf = List.IndexOf(list=gt, element=code_block_85)
removeItemAtIndex = List.RemoveItemAtIndex(list=code_block_84, indices=indexOf)
# note: Custom Node: Rhythm v.2018.7.30
getView = Rhythm.Revit.Elements.Viewport.GetView(viewport=removeItemAtIndex)
# note: If there are no viewports which are multiples we end up with -1 which chucks a warning, which is irritating, this avoids that
firstItem = List.FirstItem(list=getView@L2)

python_script_4 = Python(IN[0]=gt, IN[1]=code_block_83)
# ---------- python_script_4.python (6 lines) ----------
import clr

list = IN[0]
test = IN[1]

OUT = list.IndexOf(test)
# ----------------------------------------
flatten_7 = List.Flatten(list=python_script_4)
eq_2 = code_block_81 == flatten_7
code_block_86 = CodeBlock { 0; }
if_7 = If(test=eq_2, true=code_block_86, false=flatten_7)

# group (continued): Get viewports off sheets to use as geolocated dwgs... if there are no viewports, just use the empty sheet
replaceItemAtIndex = archilab.Lists.Lists.ReplaceItemAtIndex(list=code_block_80, index=if_7, item=firstItem)

# group: Rename Files
new_name_2 = CodeBlock(x=code_block_52) { x; }
# note: Custom Node: archilab v.2019.2.11
clear_list_2 = Custom[Clear List](Input=new_name_2)
file_extension_2 = CodeBlock { ".dwg"; }
code_block_87 = CodeBlock { ""; }
string_from_list_2 = Custom[String From List](List=clear_list_2, Suffix=file_extension_2, Seperator=code_block_87)

code_block_88 = CodeBlock(x=string_from_list_2) { x; }

# group: DWG Export Settings
dwg_export_settings = StringInput("HTA Export To BS 1192 Layers")

# group: Dwg Export Settings
element_types_2 = ElementTypes(index=105)
all_elements_of_type_2 = ElementsOfType(element_type=element_types_2)
name = Element.Name(element=all_elements_of_type_2)
# note: Custom Node: archilab v.2019.2.11
contains = Custom[String.Contains](StringList=name, FilterList=dwg_export_settings)  # This node takes a list of strings and checks if any string contains a matching string from filter input.
filterByBoolMask_5 = List.FilterByBoolMask(list=all_elements_of_type_2, mask=contains)

code_block_89 = CodeBlock(x=filterByBoolMask_5.in) { x; }
dwg_export_3 = CodeBlock(x=dwg_export_2) { x; }

# group: CAD Version for export
autocad_version = StringInput("2007")

# group: Set your dwg version
python_script_autocad_version = Python()  # unwired: IN[0]
# ---------- python_script_autocad_version.python (17 lines) ----------
import clr
clr.AddReference('ProtoGeometry')
from Autodesk.DesignScript.Geometry import *
# Import DocumentManager and TransactionManager
clr.AddReference('RevitServices')
import RevitServices
from RevitServices.Persistence import DocumentManager
from RevitServices.Transactions import TransactionManager
# Import RevitAPI
clr.AddReference('RevitAPI')
import Autodesk
from Autodesk.Revit.DB import *
from Autodesk.Revit.DB import Structure
import System

#Assign your output to the OUT variable
OUT = System.Enum.GetValues(Autodesk.Revit.DB.ACADVersion)
# ----------------------------------------
string_from_object_4 = FromObject(obj=python_script_autocad_version)
code_block_90 = CodeBlock(x=autocad_version) { "R" + x; }
eq_3 = string_from_object_4 == code_block_90
filterByBoolMask_6 = List.FilterByBoolMask(list=python_script_autocad_version, mask=eq_3)

code_block_91 = CodeBlock(x=filterByBoolMask_6.in) { x[0]; }
views = CodeBlock(x=code_block_11) { x; }

# group: Get title block from sheet and find it's name to get size
code_block_92 = CodeBlock { "Title Blocks"; }
byName_2 = Category.ByName(name=code_block_92)
boolean_2 = BoolSelector(true)
# note: Get information about everything on the sheet
# note: Custom Node: spring nodes v.132.2.7
elementsInView = Custom[Springs.Collector.ElementsInView](view=code_block_11, category=byName_2, refresh=boolean_2)  # Selects all elements visible in the input view.
# note: Custom Node: archilab v.2019.2.11
type = archilab.Revit.Elements.Elements.Type(element=elementsInView)

flatten_8 = List.Flatten(list=type)
code_block_93 = CodeBlock { "A0"; }

# group: Print orientation
code_block_94 = CodeBlock { "Portrait"; }

code_block_95 = CodeBlock { "A1"; }
code_block_96 = CodeBlock { "A2"; }

# group: Takes the title blocks on sheets, and filters them according to their title block name and orientation
views_2 = CodeBlock(x=views) { x; }
# note: Custom Node: Clockwork v.1.31.2
familyName = Custom[FamilyType.FamilyName](familyType=flatten_8)  # Returns the *family* name of a given family *type*
a0_string_contains = String.Contains(str=familyName, searchFor=code_block_93)
filterByBoolMask_7 = List.FilterByBoolMask(list=views_2, mask=a0_string_contains)
filterByBoolMask_8 = List.FilterByBoolMask(list=familyName, mask=a0_string_contains)
contains_2 = String.Contains(str=filterByBoolMask_8.in, searchFor=code_block_94)
a0_p_or_l_list_filterbyboolmask = List.FilterByBoolMask(list=filterByBoolMask_7.in, mask=contains_2)
a1_string_contains = String.Contains(str=filterByBoolMask_8.out, searchFor=code_block_95)
# note: Filter the print list by title block sizes
filterByBoolMask_9 = List.FilterByBoolMask(list=filterByBoolMask_8.out, mask=a1_string_contains)
contains_3 = String.Contains(str=filterByBoolMask_9.in, searchFor=code_block_94)
a2_string_contains = String.Contains(str=filterByBoolMask_9.out, searchFor=code_block_96)
filterByBoolMask_10 = List.FilterByBoolMask(list=filterByBoolMask_9.out, mask=a2_string_contains)
contains_4 = String.Contains(str=filterByBoolMask_10.in, searchFor=code_block_94)

filterByBoolMask_11 = List.FilterByBoolMask(list=filterByBoolMask_7.out, mask=a1_string_contains)

# group (continued): Takes the title blocks on sheets, and filters them according to their title block name and orientation
a1_p_or_l_list_filterbyboolmask = List.FilterByBoolMask(list=filterByBoolMask_11.in, mask=contains_3)
filterByBoolMask_12 = List.FilterByBoolMask(list=filterByBoolMask_11.out, mask=a2_string_contains)
a2_p_or_l_list_filterbyboolmask = List.FilterByBoolMask(list=filterByBoolMask_12.in, mask=contains_4)

code_block_97 = CodeBlock(x=filterByBoolMask_12.out) { x; }
code_block_98 = CodeBlock(x=filterByBoolMask_10.out) { x; }

# group (continued): Takes the title blocks on sheets, and filters them according to their title block name and orientation
contains_5 = String.Contains(str=code_block_98, searchFor=code_block_94)
filterByBoolMask_13 = List.FilterByBoolMask(list=code_block_97, mask=contains_5)

code_block_99 = CodeBlock(x=get_built_in_parameter) { x; }
code_block_100 = CodeBlock(x=code_block_99) { x; }
sheet_numbers = CodeBlock(x=code_block_100) { x; }

# group: Name sheet numbers
string_from_object_5 = FromObject(obj=sheet_numbers)

printer_name = StringInput("PDFCreator")  # graph input
code_block_101 = CodeBlock { "Fit"; }
code_block_102 = CodeBlock { "A0"; }

# group: Print orientation
code_block_103 = CodeBlock { "Portrait"; }

code_block_104 = CodeBlock { "A1"; }
code_block_105 = CodeBlock { "A2"; }

# group: Print settings... you need one for each plot type you're going to do... e.g. A2 landscape and A0 portrait
code_block_106 = CodeBlock()  # //the rest of the rest
# note: Custom Node: archilab v.2019.2.11
current_document = Custom[Current Document]()  # Retrieves Current Document
# note: Custom Node: GeniusLoci v.2019.10.6
printsettings_from_document = Custom[Printsettings from document](docOrRevitLinkInstance=current_document)  # Collects printsettings and their names in the active or given document. Inspired by an archilab node.
code_block_107 = CodeBlock()  # //we only want 1

contains_6 = String.Contains(str=printsettings_from_document.Printsetting_s_name, searchFor=code_block_101)
a0_list_filterbyboolmask = List.FilterByBoolMask(list=printsettings_from_document.Printsetting, mask=contains_6)
a0_list_filterbyboolmask_2 = List.FilterByBoolMask(list=printsettings_from_document.Printsetting_s_name, mask=contains_6)

# group (continued): Print settings... you need one for each plot type you're going to do... e.g. A2 landscape and A0 portrait
contains_7 = String.Contains(str=a0_list_filterbyboolmask_2.out, searchFor=code_block_102)
a0_list_filterbyboolmask_3 = List.FilterByBoolMask(list=a0_list_filterbyboolmask.out, mask=contains_7)
name_2 = Element.Name(element=a0_list_filterbyboolmask_3.in)
contains_8 = String.Contains(str=name_2, searchFor=code_block_103)
p_or_l_list_filterbyboolmask = List.FilterByBoolMask(list=a0_list_filterbyboolmask_3.in, mask=contains_8)
firstItem_2 = List.FirstItem(list=p_or_l_list_filterbyboolmask.in)
firstItem_3 = List.FirstItem(list=p_or_l_list_filterbyboolmask.out)

a0_list_filterbyboolmask_4 = List.FilterByBoolMask(list=a0_list_filterbyboolmask_2.out, mask=contains_7)

# group (continued): Print settings... you need one for each plot type you're going to do... e.g. A2 landscape and A0 portrait
contains_9 = String.Contains(str=a0_list_filterbyboolmask_4.out, searchFor=code_block_104)
a1_list_filterbyboolmask = List.FilterByBoolMask(list=a0_list_filterbyboolmask_3.out, mask=contains_9)

name_3 = Element.Name(element=a1_list_filterbyboolmask.in)

# group (continued): Print settings... you need one for each plot type you're going to do... e.g. A2 landscape and A0 portrait
contains_10 = String.Contains(str=name_3, searchFor=code_block_103)
p_or_l_list_filterbyboolmask_2 = List.FilterByBoolMask(list=a1_list_filterbyboolmask.in, mask=contains_10)
firstItem_4 = List.FirstItem(list=p_or_l_list_filterbyboolmask_2.in)
firstItem_5 = List.FirstItem(list=p_or_l_list_filterbyboolmask_2.out)

a1_list_filterbyboolmask_2 = List.FilterByBoolMask(list=a0_list_filterbyboolmask_4.out, mask=contains_9)

# group (continued): Print settings... you need one for each plot type you're going to do... e.g. A2 landscape and A0 portrait
contains_11 = String.Contains(str=a1_list_filterbyboolmask_2.out, searchFor=code_block_105)
a2_list_filterbyboolmask = List.FilterByBoolMask(list=a1_list_filterbyboolmask.out, mask=contains_11)

name_4 = Element.Name(element=a2_list_filterbyboolmask.in)
contains_12 = String.Contains(str=name_4, searchFor=code_block_103)
p_or_l_list_filterbyboolmask_3 = List.FilterByBoolMask(list=a2_list_filterbyboolmask.in, mask=contains_12)

# group (continued): Print settings... you need one for each plot type you're going to do... e.g. A2 landscape and A0 portrait
firstItem_6 = List.FirstItem(list=p_or_l_list_filterbyboolmask_3.in)
firstItem_7 = List.FirstItem(list=p_or_l_list_filterbyboolmask_3.out)

code_block_108 = CodeBlock(x=a2_list_filterbyboolmask.out) { x; }

# group (continued): Print settings... you need one for each plot type you're going to do... e.g. A2 landscape and A0 portrait
name_5 = Element.Name(element=code_block_108)
contains_13 = String.Contains(str=name_5, searchFor=code_block_103)
p_or_l_list_filterbyboolmask_4 = List.FilterByBoolMask(list=code_block_108, mask=contains_13)
firstItem_8 = List.FirstItem(list=p_or_l_list_filterbyboolmask_4.in)
firstItem_9 = List.FirstItem(list=p_or_l_list_filterbyboolmask_4.out)

# group: Uses the filtered list of sheets to get a number of each type of print setting required
a0_p_list_count = List.Count(list=a0_p_or_l_list_filterbyboolmask.in)
cycle_5 = List.Cycle(list=firstItem_2, amount=a0_p_list_count)
a0_l_list_count = List.Count(list=a0_p_or_l_list_filterbyboolmask.out)
cycle_6 = List.Cycle(list=firstItem_3, amount=a0_l_list_count)
count_6 = List.Count(list=a1_p_or_l_list_filterbyboolmask.in)
cycle_7 = List.Cycle(list=firstItem_4, amount=count_6)
count_7 = List.Count(list=a1_p_or_l_list_filterbyboolmask.out)
cycle_8 = List.Cycle(list=firstItem_5, amount=count_7)
count_8 = List.Count(list=a2_p_or_l_list_filterbyboolmask.in)
cycle_9 = List.Cycle(list=firstItem_6, amount=count_8)
count_9 = List.Count(list=a2_p_or_l_list_filterbyboolmask.out)
cycle_10 = List.Cycle(list=firstItem_7, amount=count_9)
count_10 = List.Count(list=filterByBoolMask_13.in)
cycle_11 = List.Cycle(list=firstItem_8, amount=count_10)
count_11 = List.Count(list=filterByBoolMask_13.out)
cycle_12 = List.Cycle(list=firstItem_9, amount=count_11)
create_2 = List.Create(item0=cycle_5, item1=cycle_6, item2=cycle_7, item3=cycle_8, item4=cycle_9, item5=cycle_10, item6=cycle_11, item7=cycle_12)

# group: PDF Required?
pdf_required = BoolSelector(true)  # graph input

# group: Create pdf
printer_name_2 = StringInput("Adobe PDF")  # frozen
create_3 = List.Create(item0=a0_p_or_l_list_filterbyboolmask.in, item1=a0_p_or_l_list_filterbyboolmask.out, item2=a1_p_or_l_list_filterbyboolmask.in, item3=a1_p_or_l_list_filterbyboolmask.out, item4=a2_p_or_l_list_filterbyboolmask.in, item5=a2_p_or_l_list_filterbyboolmask.out, item6=filterByBoolMask_13.in, item7=filterByBoolMask_13.out)
code_block_109 = CodeBlock { "Select"; }
boolean_3 = BoolSelector(true)
flatten_9 = List.Flatten(list=create_2)

clean = List.Clean(list=create_3)

# group (continued): Create pdf
flatten_10 = List.Flatten(list=clean)

# group: Re orders sheets back to how they were before we ordered by sheet size and orientation
code_block_110 = CodeBlock { "SHEET_NUMBER"; }
# note: Custom Node: archilab v.2019.2.11
get_built_in_parameter_3 = Custom[Get Built In Parameter](ParameterNames=code_block_110, Elements=flatten_10)
string_from_object_6 = FromObject(obj=get_built_in_parameter_3)
indexOf_2 = List.IndexOf(list=string_from_object_6, element=string_from_object_5@L1)

getItemAtIndex = List.GetItemAtIndex(list=flatten_10, index=indexOf_2)
getItemAtIndex_2 = List.GetItemAtIndex(list=flatten_9, index=indexOf_2)

# group (continued): Create pdf
python_script_5 = Python(IN[0]=getItemAtIndex, IN[1]=code_block_109, IN[2]=boolean_3, IN[3]=printer_name, IN[4]=getItemAtIndex_2, IN[5]=code_block_77, IN[6]=pdf_required)
# ---------- python_script_5.python (169 lines) ----------
#Copyright(c) 2015, Konrad K Sobon
# @arch_laboratory, http://archi-lab.net
# Revised by viktor_kuzev
# Revised by Michael Park
# Revised by Alban de Chasteigner

import clr
clr.AddReference('ProtoGeometry')
from Autodesk.DesignScript.Geometry import *

# Import Element wrapper extension methods
clr.AddReference("RevitNodes")
import Revit
clr.ImportExtensions(Revit.Elements)

# Import geometry conversion extension methods
clr.ImportExtensions(Revit.GeometryConversion)

# Import DocumentManager and TransactionManager
clr.AddReference("RevitServices")
import RevitServices
from RevitServices.Persistence import DocumentManager
from RevitServices.Transactions import TransactionManager

doc = DocumentManager.Instance.CurrentDBDocument
uiapp = DocumentManager.Instance.CurrentUIApplication
app = uiapp.Application

# Import RevitAPI
clr.AddReference("RevitAPI")
import Autodesk
from Autodesk.Revit.DB import *

import sys
pyt_path = r'C:\Program Files (x86)\IronPython 2.7\Lib'
sys.path.append(pyt_path)
import System

# The inputs to this node will be stored as a list in the IN variable.
dataEnteringNode = IN

sheets = IN[0]
pRange = System.Enum.Parse(Autodesk.Revit.DB.PrintRange, IN[1])
combined = IN[2]
printerName = IN[3]
printSettings = IN[4]
filePath = IN[5]
runIt = IN[6]

if isinstance(filePath, list):
	s_length = len(sheets)
	fp_length = len(filePath)
	if len(sheets) == len(filePath):
		pass
	else:
		filePath = filePath * (s_length / fp_length)
		if len(filePath) == len(sheets):
			pass
		else:
			OUT = "Filepaths and Sheets weren't the same length"
			exit()

elif isinstance(filePath, str):
	filepath = [filepath] * len(sheets)

if isinstance(sheets, list):
	viewSheets = []
	for i in sheets:
		viewSheets.append(UnwrapElement(i))
else:
	viewSheets = UnwrapElement(sheets)

if isinstance(printSettings, list):
	printSetting = []
	for i in printSettings:
		printSetting.append(UnwrapElement(i))
else:
	printSetting = UnwrapElement(printSettings)

TransactionManager.Instance.EnsureInTransaction(doc)
printManager = doc.PrintManager		
printSetup = printManager.PrintSetup
printManager.SelectNewPrintDriver(printerName)
if isinstance(printSettings, list):
	printSetup.CurrentPrintSetting = printSetting[0]
else:
	printSetup.CurrentPrintSetting = printSetting
printManager.Apply()
TransactionManager.Instance.TransactionTaskDone()

def PrintView(doc, sheet, pRange, printerName, combined, filePath, printSetting):
	# create view set
	viewSet = ViewSet()
	viewSet.Insert(sheet)
	# determine print range
	printManager = doc.PrintManager
	printManager.PrintRange = pRange
	printManager.Apply()
	# make new view set current
	viewSheetSetting = printManager.ViewSheetSetting
	viewSheetSetting.CurrentViewSheetSet.Views = viewSet
	# set printer
	printManager.SelectNewPrintDriver(printerName)
	printManager.Apply()
	# set combined and print to file
	if printManager.IsVirtual:
		printManager.CombinedFile = combined
		printManager.Apply()
		printManager.PrintToFile = True
		printManager.Apply()
	else:
		printManager.CombinedFile = combined
		printManager.Apply()
		printManager.PrintToFile = False
		printManager.Apply()
	# set file path
	printManager.PrintToFileName = filePath
	printManager.Apply()
	# apply print setting
	try:
		printSetup = printManager.PrintSetup
		printSetup.CurrentPrintSetting = printSetting
		printManager.Apply()
	except:
		pass
	# save settings and submit print
	TransactionManager.Instance.EnsureInTransaction(doc)
	viewSheetSetting.SaveAs("tempSetName")
	printManager.Apply()
	printManager.SubmitPrint()
	viewSheetSetting.Delete()
	TransactionManager.Instance.TransactionTaskDone()

	return True


try:
	viewSets = FilteredElementCollector(doc).OfClass(ViewSheetSet)
	for i in viewSets:
		if i.Name == "tempSetName":
			TransactionManager.Instance.EnsureInTransaction(doc)
			doc.Delete(i.Id)
			TransactionManager.Instance.ForceCloseTransaction()
		else:
			continue

	errorReport = None
	message = "Success"
	if runIt:
		if isinstance(viewSheets, list) and isinstance(printSetting, list):
			for i, j, fp in zip(viewSheets, printSetting, filePath):
				PrintView(doc, i, pRange, printerName, combined, fp, j)
		elif isinstance(viewSheets, list) and not isinstance(printSetting, list):
			for i, fp in zip(viewSheets, filePath):
				PrintView(doc, i, pRange, printerName, combined, fp, printSetting)
		elif not isinstance(viewSheets, list) and not isinstance(printSetting, list):
			PrintView(doc, viewSheets, pRange, printerName, combined, filePath[0], printSetting)
	else:
		message = "Set RunIt to True"
except:
	# if error accurs anywhere in the process catch it
	import traceback
	errorReport = traceback.format_exc()

# Assign your output to the OUT variable
if errorReport is None:
	OUT = message
else:
	OUT = errorReport
# ----------------------------------------

# group: Delay dwg creation until after the pdfs have run... pdfs are slower and so this order makes the graph faster, it also gives the bound pdf some more time before it runs
# note: Custom Node: Clockwork v.1.31.2
passthrough_5 = Custom[Passthrough](passThrough=code_block_91, waitFor=python_script_5)

# group: Create DWG
geolocated_dwg = If(test=geo_located_dwg_3, true=replaceItemAtIndex, false=sheets)
flatten_11 = List.Flatten(list=geolocated_dwg)
flatten_12 = List.Flatten(list=code_block_88)
code_block_111 = CodeBlock { true; false; }
if_8 = If(test=dwg_export_3, true=code_block_111.out0, false=code_block_111.out1)
# note: Genius Loci
python_script_dwg_export = Python(IN[0]=directory_path, IN[1]=flatten_11, IN[2]=flatten_12, IN[3]=code_block_89, IN[4]=if_8, IN[5]=passthrough_5)
# ---------- python_script_dwg_export.python (84 lines) ----------
# Copyright(c) 2016, Konrad K Sobon
# @arch_laboratory, http://archi-lab.net

# Import Element wrapper extension methods
import clr
clr.AddReference("RevitNodes")
import Revit
clr.ImportExtensions(Revit.Elements)

# Import DocumentManager and TransactionManager
clr.AddReference("RevitServices")
import RevitServices
from RevitServices.Persistence import DocumentManager
doc = DocumentManager.Instance.CurrentDBDocument

# Import RevitAPI
clr.AddReference("RevitAPI")
import Autodesk
from Autodesk.Revit.DB import *

import System
from System.Collections.Generic import *

import sys
pyt_path = r'C:\Program Files (x86)\IronPython 2.7\Lib'
sys.path.append(pyt_path)

#The inputs to this node will be stored as a list in the IN variable.
dataEnteringNode = IN

def ProcessList(_func, _list):
    return map( lambda x: ProcessList(_func, x) if type(x)==list else _func(x), _list )

def ProcessParallelLists(_func, *lists):
	return map( lambda *xs: ProcessParallelLists(_func, *xs) if all(type(x) is list for x in xs) else _func(*xs), *lists )

def Unwrap(item):
	return UnwrapElement(item)

folderPath = IN[0]

if isinstance(IN[1], list):
	views = ProcessList(Unwrap, IN[1])
else:
	views = list(Unwrap(IN[1]))

if isinstance(IN[2], list):
	names = IN[2]
else:
	names = list(IN[2])

RunIt = IN[4]

Version = Unwrap(IN[5])

def ExportDwg(name, view, folder = folderPath):
	options = DWGExportOptions()
	options.FileVersion=Version
	options.MergedViews = True 
	options.SharedCoords = True
#	options.GetPredefinedOptions(doc, IN[3])
	views = List[ElementId]()
	views.Add(view.Id)
	result = doc.Export(folder, name, views, options)
	return result

if RunIt:
	try:
		errorReport = None
		# run export
		ProcessParallelLists(ExportDwg, names, views)
		
	except:
		# if error accurs anywhere in the process catch it
		import traceback
		errorReport = traceback.format_exc()
else:
	errorReport = "Please set the RunIt to True!"

#Assign your output to the OUT variable
if errorReport == None:
	OUT = 0
else:
	OUT = errorReport
# ----------------------------------------

seconds_to_delay_creation_of = DoubleInput(10)  # "Seconds to delay creation of bound pdf"; graph input

# group: Create Bound Pdf
# note: Custom Node: Clockwork v.1.31.2
passthrough_6 = Custom[Passthrough](passThrough=code_block_77, waitFor=python_script_dwg_export)
python_script_6 = Python(IN[0]=passthrough_6, IN[1]=seconds_to_delay_creation_of)
# ---------- python_script_6.python (14 lines) ----------
import clr
clr.AddReference('ProtoGeometry')
from Autodesk.DesignScript.Geometry import *
#The inputs to this node will be stored as a list in the IN variable.
import time

dataEnteringNode = IN
data = IN[0]
sec = IN[1]

time.sleep(sec)

#Assign your output to the OUT variable
OUT = data
# ----------------------------------------
bound_pdf_name = StringInput("_Bound.pdf")
code_block_112 = CodeBlock(x=code_block_76, y=bound_pdf_name) { x + y; }
python_script_7 = Python(IN[0]=code_block_112, IN[1]=seconds_to_delay_creation_of)  # same code as python_script_6
# note: Custom Node: GeniusLoci v.2019.10.6
mergePDFs = Printing.Merge.MergePDFs(Filenames=python_script_6, TargetPdf=python_script_7)

# group: End Graph
end_2 = Revit.Transaction.Transaction.End(input=mergePDFs)

# group: Save before running?
save_active_document_first = BoolSelector(true)  # graph input

code_block_113 = CodeBlock(x=save_active_document_first) { x; }

# group: Save before running?
# note: Custom Node: archilab v.2019.2.11
current_document_2 = Custom[Current Document]()
python_script_8 = Python(IN[0]=current_document_2, IN[1]=code_block_113)
# ---------- python_script_8.python (20 lines) ----------
import clr
clr.AddReference('RevitAPI')
from Autodesk.Revit.DB import *

clr.AddReference("RevitServices")
import RevitServices
from RevitServices.Persistence import DocumentManager
from RevitServices.Transactions import TransactionManager

doc = IN[0]
bool = IN[1]

TransactionManager.Instance.ForceCloseTransaction()

if bool:
   doc.Save()
   OUT = 'Saved'

else:
    OUT = 'Not Saved'
# ----------------------------------------

code_block_114 = CodeBlock()  # //Genius Loci

# group: PDFs Out
PDFs = Watch(python_script_5)  # graph output

# group: DWGs Out
DWGs = Watch(python_script_dwg_export)  # graph output

# group: Bound PDF Out
bound_pdf = Watch(mergePDFs)  # graph output
