# Dynamo graph CeilingHeightRayBounce.dyn (Dynamo 1.3.2.2480)

all_elements_in_active_view = ElementsInView()
categories = Categories("Rooms")
filterByCategory = Custom[Element.FilterByCategory](elements=all_elements_in_active_view, category=categories)  # Filter elements by category
code_block = CodeBlock(e=filterByCategory.Elements) { Flatten(e); }
getLocation = Element.GetLocation(code_block)
code_block_2 = CodeBlock(x=getLocation) { x[0]; }
ZAxis = Vector.ZAxis()
code_block_3 = CodeBlock { 1; }
views = Views("{3D}")
byOriginDirection = Revit.References.RayBounce.ByOriginDirection(code_block_2, ZAxis, code_block_3, views)
deconstruct = List.Deconstruct(list=byOriginDirection@L2)
byStartPointEndPoint = Line.ByStartPointEndPoint(startPoint=deconstruct.first@L2, endPoint=deconstruct.rest@L2)
length = Curve.Length(byStartPointEndPoint)
