# Dynamo graph Centre of Corridor Veroni.dyn (Dynamo 2.0.3.8104)

select_model_element = DSModelElementSelection()  # 1 picked in the model
finishBoundary = Room.FinishBoundary(room=select_model_element)
byJoinedCurves = PolyCurve.ByJoinedCurves(curves=finishBoundary)
flatten = List.Flatten(list=byJoinedCurves)
byPatch = Surface.ByPatch(closedCurve=flatten)
code_block = CodeBlock { 0..1..#500; }
pointAtParameter = Curve.PointAtParameter(curve=flatten, param=code_block, lacing=Longest)
UVParameterAtPoint = Surface.UVParameterAtPoint(surface=byPatch, point=pointAtParameter, lacing=Longest)
byParametersOnSurface = Tessellation.Voronoi.ByParametersOnSurface(uvs=UVParameterAtPoint, face=byPatch)
intersect = Geometry.Intersect(geometry=byPatch, other=byParametersOnSurface)
flatten_2 = List.Flatten(list=intersect)
doesIntersect = Geometry.DoesIntersect(geometry=byJoinedCurves, other=flatten_2, lacing=Longest)
filterByBoolMask = List.FilterByBoolMask(list=flatten_2, mask=doesIntersect)
code_block_2 = CodeBlock(x=filterByBoolMask.out) { x; }
simplify = Curve.Simplify()  # unwired: curve, tolerance
intersectAll = Curve.IntersectAll()  # unwired: curves
