# Dynamo graph Clean file for Issue.dyn (Dynamo 2.0.3.8104)

# group: Delete View Templates
boolean = BoolSelector(true)  # graph input
python_script = Python(IN[0]=boolean)
# ---------- python_script.python (49 lines) ----------
# Copyright(c) 2016, Konrad K Sobon
# @arch_laboratory, http://archi-lab.net

# Import DocumentManager and TransactionManager
import clr
clr.AddReference("RevitServices")
import RevitServices
from RevitServices.Persistence import DocumentManager
from RevitServices.Transactions import TransactionManager
doc = DocumentManager.Instance.CurrentDBDocument

# Import RevitAPI
clr.AddReference("RevitAPI")
import Autodesk
from Autodesk.Revit.DB import *

import sys
pyt_path = r'C:\Program Files (x86)\IronPython 2.7\Lib'
sys.path.append(pyt_path)

#The inputs to this node will be stored as a list in the IN variable.
dataEnteringNode = IN

if IN[0]:
	try:
		errorReport = None
		TransactionManager.Instance.EnsureInTransaction(doc)
		
		allViewTemp = FilteredElementCollector(doc).OfClass(View).ToElements()
		toDelete = []
		for i in allViewTemp:
			if i.IsTemplate:
				try:
					doc.Delete(i.Id)
				except:
					pass

		TransactionManager.Instance.TransactionTaskDone()
	except:
		# if error accurs anywhere in the process catch it
		import traceback
		errorReport = traceback.format_exc()
else:
	errorReport = "Set input to True"
#Assign your output to the OUT variable
if errorReport == None:
	OUT = 0
else:
	OUT = errorReport
# ----------------------------------------
watch = Watch(python_script)

current = Orchid.RevitProject.Common.Document.Current()
all = Orchid.RevitProject.Views.View.All(document=current)

# group: Don't purge views with these words in title
code_block = CodeBlock { ["Coordination","Splash"]; }

# group: Delete views (apart from Splash and Setout etc.)
# note: Custom Node: Orchid
#    v. 202.4.2.7024
name = Element.Name(element=all)
code_block_2 = CodeBlock(x=code_block) { x; }
boolean_2 = BoolSelector(true)  # graph input
contains = String.Contains(str=name, searchFor=code_block_2@L2, ignoreCase=boolean_2, lacing=CrossProduct)
# note: Custom Node: Clockwork v.1.31.2
anyTrue = Custom[List.AnyTrue](seq=contains@L2)  # Returns true if any item in a list of booleans is true.
filterByBoolMask = List.FilterByBoolMask(list=all, mask=anyTrue)
flatten = List.Flatten(list=filterByBoolMask.in)
watch_2 = Watch(flatten)
flatten_2 = List.Flatten(list=filterByBoolMask.out)
watch_3 = Watch(flatten_2)

# group: Don't delete splash screen title block
code_block_3 = CodeBlock { "HTA-Splash screen"; }

# group: Delete Title Blocks
code_block_4 = CodeBlock { "Title Blocks"; }
byName = Category.ByName(name=code_block_4)
boolean_3 = BoolSelector(true)  # graph input
# note: Custom Node: Clockwork v.1.31.2
all_families_of_category = Custom[All Families Of Category](category=byName, toggle=boolean_3)  # Gets all famiies of a given category in the model (does *not *work for system families); unwired: docOrRevitLinkInstance
# note: Keep Splash screen title block
byName_2 = FamilyType.ByName(name=code_block_3)
family = FamilyType.Family(familyType=byName_2)
setDifference = List.SetDifference(list1=all_families_of_category, list2=family)

# group: Delete Sheets
boolean_4 = BoolSelector(true)  # graph input
# note: Custom Node: LunchBox
#     v.2018.7.6
lunchbox_sheet_collector = Custom[LunchBox Sheet Collector](Toggle=boolean_4)  # Collects sheets from the current document
# note: Keep Splash screen sheet
code_block_5 = CodeBlock { "XXXX"; }
boolean_5 = BoolSelector(false)  # graph input
boolean_6 = BoolSelector(true)  # graph input
# note: Custom Node: spring nodes v.132.2.7
sheets = Custom[Springs.Collector.Sheets](searchFor=code_block_5, NameOrNumber=boolean_5, refresh=boolean_6)  # Search for sheets by either their name or their number. Use a false boolean switch to search by number.
code_block_6 = CodeBlock(x=sheets.exact_match) { x[0]; }
eq = lunchbox_sheet_collector.Number == code_block_6
filterByBoolMask_2 = List.FilterByBoolMask(list=lunchbox_sheet_collector.Number, mask=eq)

# group: Don't purge HTA Revit Links
string = StringInput("HTA")  # graph input

# group: Remove Revit Links
element_types = ElementTypes(index=268)  # graph input
all_elements_of_type = ElementsOfType(element_type=element_types)
element_types_2 = ElementTypes(index=267)  # graph input
all_elements_of_type_2 = ElementsOfType(element_type=element_types_2)
create = List.Create(item0=all_elements_of_type, item1=all_elements_of_type_2)
code_block_7 = CodeBlock(e=create) { e.Name; }
contains_2 = String.Contains(str=code_block_7, searchFor=string)
filterByBoolMask_3 = List.FilterByBoolMask(list=create, mask=contains_2)

# group: Don't purge dwgs with this name
# note: It won't work if the path is wrong
string_2 = StringInput("OS Plan")  # graph input

# group: Remove Dwg Links
element_types_3 = ElementTypes(index=160)  # graph input
all_elements_of_type_3 = ElementsOfType(element_type=element_types_3)
string_3 = StringInput("Name")  # graph input
getParameterValueByName = Element.GetParameterValueByName(element=all_elements_of_type_3, parameterName=string_3)
contains_3 = String.Contains(str=getParameterValueByName, searchFor=string_2)
filterByBoolMask_4 = List.FilterByBoolMask(list=all_elements_of_type_3, mask=contains_3)

# group: Delete
join = List.Join(list0=watch_3, list1=setDifference, list2=filterByBoolMask_2.out, list3=filterByBoolMask_3.out, list4=filterByBoolMask_4.out)
# note: Custom Node: archilab v.2019.2.11
delete = archilab.Revit.Elements.Elements.Delete(element=join)

# group: Don't purge until elements deleted
# note: Custom Node: Orchid
#    v. 202.4.2.7024
current_2 = Orchid.RevitProject.Common.Document.Current()
# note: Custom Node: Clockwork v.1.31.2
passthrough = Custom[Passthrough](passThrough=current_2, waitFor=delete)  # Forces a sequential order of execution. The node wired into the output of the Passthrough node will be executed *after* the node wired into the waitFor input (e.g. important for some Revit operations). The value of the passThrough input will be passed on to the node wired into the output port of the Passthrough node.

# group: Purge File
code_block_8 = CodeBlock { true; }
# note: Custom Node: Orchid
#    v. 202.4.2.7024
purge = Orchid.RevitProject.Common.Document.Purge(document=passthrough, completely=code_block_8)
