# Dynamo graph Create solids (Direct Shape) from rooms_v2-MKA.dyn (Dynamo 2.0.3.8104)

code_block = CodeBlock { x; }  # unwired: x
python_script = Python(IN[0]=code_block)  # frozen
# ---------- python_script.python (47 lines) ----------
#Copyright(c) 2017, Konrad K Sobon
# @arch_laboratory, http://archi-lab.net

import clr
import sys
pyt_path = r'C:\Program Files (x86)\IronPython 2.7\Lib'
sys.path.append(pyt_path)

# Import Element wrapper extension methods
clr.AddReference("RevitNodes")
import Revit
clr.ImportExtensions(Revit.Elements)
# toProtoType etc.
clr.ImportExtensions(Revit.GeometryConversion)

# Import DocumentManager and TransactionManager
clr.AddReference("RevitServices")
import RevitServices
from RevitServices.Persistence import DocumentManager
from RevitServices.Transactions import TransactionManager
doc = DocumentManager.Instance.CurrentDBDocument

# Import RevitAPI
clr.AddReference("RevitAPI")
import Autodesk
from Autodesk.Revit.DB import *
import System

room = UnwrapElement(IN[0])

curves = []

TransactionManager.Instance.EnsureInTransaction(doc)

opt = SpatialElementBoundaryOptions()
opt.SpatialElementBoundaryLocation = SpatialElementBoundaryLocation.Finish
opt.StoreFreeBoundaryFaces = True

boundaries = room.GetBoundarySegments(opt)

for boundary in boundaries:
    for b in boundary:
        curves.append(b.GetCurve().ToProtoType())

TransactionManager.Instance.TransactionTaskDone()

OUT = curves
# ----------------------------------------
code_block_2 = CodeBlock { 1554866; }
byElementId = archilab.Revit.Selection.Select.ByElementId(id=code_block_2)
python_script_2 = Python(IN[0]=byElementId)
# ---------- python_script_2.python (41 lines) ----------
#thanks to everyone who has helped :)
import clr
import sys

# Import Element wrapper extension methods
clr.AddReference("RevitNodes")
import Revit
# toProtoType etc.
clr.ImportExtensions(Revit.GeometryConversion)

# Import DocumentManager
clr.AddReference("RevitServices")
import RevitServices
from RevitServices.Persistence import DocumentManager
doc = DocumentManager.Instance.CurrentDBDocument

# Import RevitAPI
clr.AddReference("RevitAPI")
import Autodesk
from Autodesk.Revit.DB import *
import System

clr.AddReference('RevitAPIIFC')
from Autodesk.Revit.DB.IFC import *

room = UnwrapElement(IN[0])

curves = []

opt = SpatialElementBoundaryOptions()
opt.SpatialElementBoundaryLocation = SpatialElementBoundaryLocation.Finish
opt.StoreFreeBoundaryFaces = True


boundaries = ExporterIFCUtils.GetRoomBoundaryAsCurveLoopArray(room, opt, False)

for boundary in boundaries:
   for b in boundary:
        curves.append(b.ToProtoType())

OUT = curves
# ----------------------------------------
finishBoundary = Room.FinishBoundary(room=byElementId)
endPoint = Curve.EndPoint(curve=finishBoundary)
code_block_3 = CodeBlock { true; }
byPoints = PolyCurve.ByPoints(points=endPoint, connectLastToFirst=code_block_3)
code_block_4 = CodeBlock { 3000; }
extrudeAsSolid = Curve.ExtrudeAsSolid(curve=byPoints, distance=code_block_4)
categories = Categories(index=228)  # graph input
code_block_5 = CodeBlock { "Test"; }
byGeometry = Custom[Springs.BrepShape.ByGeometry](geometry=extrudeAsSolid, category=categories, name=code_block_5)  # Convert the input geometry to DirectShape element inside the Revit document. Works only in Revit 2017 and later. Usies the more advanced BrepBuilder. It supports solids or surfaces, however periodic faces like spheres, cylinders and cones are not supported. Each created DS will have a unique type. Make sure that each input geometry has a unique name. You can either feed a single category and material for all geometries or a unique one for each geometry - the node's lacing is set to longest by default. The default category is Generic Model.
