# Dynamo graph Dimension Align Pattern.dyn (Dynamo 2.0.3.8810)

python_script = Python()  # unwired: IN[0]
# ---------- python_script.python (71 lines) ----------
#Copyright(c) 2017, Konrad K Sobon
# @arch_laboratory, http://archi-lab.net

import clr
import sys
pyt_path = r'C:\Program Files (x86)\IronPython 2.7\Lib'
sys.path.append(pyt_path)

# Import Element wrapper extension methods
clr.AddReference("RevitNodes")
import Revit
clr.ImportExtensions(Revit.Elements)
# toProtoType etc.
clr.ImportExtensions(Revit.GeometryConversion)

# Import DocumentManager and TransactionManager
clr.AddReference("RevitServices")
import RevitServices
from RevitServices.Persistence import DocumentManager
from RevitServices.Transactions import TransactionManager
doc = DocumentManager.Instance.CurrentDBDocument

# Import RevitAPI
clr.AddReference("RevitAPI")
import Autodesk
from Autodesk.Revit.DB import *
import System

paramName = IN[0]
paramValues = IN[2]

if not isinstance(IN[1], list):
	elements = [IN[1]]
else:
	elements = IN[1]

def GetBuiltInParam(paramName):
	builtInParams = System.Enum.GetValues(BuiltInParameter)
	test = []
	for i in builtInParams:
		if i.ToString() == paramName:
			test.append(i)
			break
		else:
			continue
	return test[0]

try:
	errorReport = None
	TransactionManager.Instance.EnsureInTransaction(doc)
	
	bipName = GetBuiltInParam(paramName)
	for i, j in zip(elements, paramValues):
		param = UnwrapElement(i).get_Parameter(bipName)
		if param.StorageType == StorageType.ElementId:
			id = ElementId(j)
			param.Set(id)
		else:
			param.Set(j)
	
	TransactionManager.Instance.TransactionTaskDone()
except:
	# if error accurs anywhere in the process catch it
	import traceback
	errorReport = traceback.format_exc()

#Assign your output to the OUT variable
if errorReport == None:
	OUT = IN[1]
else:
	OUT = errorReport
# ----------------------------------------
select_model_elements = DSModelElementsSelection()  # 3 picked in the model
code_block = CodeBlock { 1; }
chop = List.Chop(list=select_model_elements, lengths=code_block)
getLocation = Element.GetLocation(element=chop)
code_block_2 = CodeBlock(x=getLocation) { x; }
addItemToEnd = List.AddItemToEnd()  # unwired: item, list
compound_pattern_reference = Custom[Compound Pattern Reference](element=chop@L2)  # Retrieves Surface, Material, Fill Pattern and its references of a roof, floor, ceiling or wall. These references can then be used to dimension the FillPattern.
firstItem = List.FirstItem(list=compound_pattern_reference.Horizontal_References@@L2)
wall_edges_references = Custom[Wall Edges References](wall=chop@L2)  # Get the vertical edges and their references from the exterior and interior faces at the ends.
firstItem_2 = List.FirstItem(list=wall_edges_references.Exterior_Side_References@@L2)
code_block_3 = CodeBlock(x=firstItem_2) { x; }
combine = List.Combine(comb=addItemToEnd, list1=firstItem, list2=code_block_3)
flatten = List.Flatten()  # unwired: list
map = List.Map(list=combine, f_x=flatten)
code_block_4 = CodeBlock(x=map) { x; }
al_get_all_dimension_types = Custom[AL.Get All Dimension Types]()  # This node will query all of the available dimension styles (this includes linear as well as arc, circle etc).
code_block_5 = CodeBlock(x=al_get_all_dimension_types) { x[0]; }
activeViewFromCurrentDocument = Custom[Document.ActiveViewFromCurrentDocument]()  # Gets the active view of the current document
dimension_byreferences = Custom[Dimension ByReferences](line=code_block_2@L2, References=code_block_4@L2, dimensionType=code_block_5, view=activeViewFromCurrentDocument)  # Creates a new linear dimension from at least two element references.
end = Revit.Transaction.Transaction.End(input=dimension_byreferences)
value = Dimension.Value(dimension=end)
code_block_6 = CodeBlock(x=value) { x*304.8; }
getReferenceElements = Rhythm.Revit.Elements.Dimension.GetReferenceElements(dimension=end)
code_block_7 = CodeBlock(x=firstItem) { x[0]; }
