# Dynamo graph DimensionsCheckBrickDimensionsInActiveView-OverrideColour&+Suffix - v2test.dyn "HTA DimensionsCheckBrickDimensionsInActiveView-OverrideColour&+Suffix - v2test" (Dynamo 2.0.3.8810)

# group: Set up for using script
# note: Inserting CO type dimensions
# This script probably requires no specific editing to use.
# It overrides the colour of dimensions in a view and adds a suffix depending on the dimension length:
# CO+
# CO-
# CO Coord
# CO Cut (none brick dims require a cut brick)
# note: Packages
# This script requires several packages to be installed. If you are experienced with dynamo these should be easy to identify and install. If you need assistance please ask.
# note: Caveats
# - Always save and backup work before running
# - Use at own discretion
# - Running dims don't work
# -Dp needs to be set to a high enough figure to catch wonky dims, recommended to check to 5 dp

# group: Get dimensions in active view
categories = Categories(index=155)
current = Document.Current()
activeView = Document.ActiveView(document=current)
# note: Archilab
byCategoryAndView = archilab.Revit.Selection.Select.ByCategoryAndView(category=categories, view=activeView)

# group: Filter nulls
watch = Watch(byCategoryAndView)
python_script_dimension_value = Python(IN[0]=watch)
# ---------- python_script_dimension_value.python (23 lines) ----------
import clr
clr.AddReference('RevitAPI')
clr.AddReference('RevitNodes')

from Autodesk.Revit.DB import DisplayUnitType, UnitUtils
from Revit import Elements

#parts = IN[0]
lists = IN[0]

# values
value = []


# output unit
unit = DisplayUnitType.DUT_MILLIMETERS

for list in lists:
    # value
    value.append(list.GetParameterValueByName('Value'))


OUT = value
# ----------------------------------------
string = StringInput("")
eq = python_script_dimension_value == string
filterByBoolMask = List.FilterByBoolMask(list=watch, mask=eq)

code_block = CodeBlock(x=filterByBoolMask.in) { x; }

# group: Make Not Overridden Dims Red
code_block_2 = CodeBlock { 255; 0; }
byARGB = Color.ByARGB(r=code_block_2.out0, g=code_block_2.out1, b=code_block_2.out1)
overrideColorInView = Element.OverrideColorInView(element=code_block, color=byARGB)

# group: Set Suffix for not overridden
code_block_3 = CodeBlock { ""; }
setSuffix = Dimension.SetSuffix(dimension=code_block, values=code_block_3)

# group: Running Dims don't work for this, as you can't override sub elements colour, you can extract the information to review them
python_script_dimension_value_2 = Python()  # "Python Script Dimension Value Test"; frozen; unwired: IN[0]
# ---------- python_script_dimension_value_2.python (23 lines) ----------
import clr
clr.AddReference('RevitAPI')
from Autodesk.Revit.DB import *

clr.AddReference("RevitNodes")
import Revit
clr.ImportExtensions(Revit.GeometryConversion)

clr.AddReference("RevitServices")
import RevitServices
from RevitServices.Persistence import DocumentManager
from RevitServices.Transactions import TransactionManager

doc = DocumentManager.Instance.CurrentDBDocument

items = UnwrapElement(IN[0])
elementlist = list()


for item in items:
    elementlist.append(item.Value)

OUT = elementlist
# ----------------------------------------
getItemAtIndex = List.GetItemAtIndex()  # unwired: list, index
code_block_4 = CodeBlock { 0; }

code_block_5 = CodeBlock { x; }  # unwired: x
python_script_dimension_value_10 = Python(IN[0]=filterByBoolMask.out)
# ---------- python_script_dimension_value_10.python (58 lines) ----------
import clr
clr.AddReference('RevitAPI')
clr.AddReference('RevitNodes')
clr.AddReference('ProtoGeometry')
from Autodesk.DesignScript.Geometry import *

import math
from math import *

import sys

from Autodesk.Revit.DB import DisplayUnitType, UnitUtils
from Revit import Elements

#parts = IN[0]
dims = IN[0]

# values
value = []
review = []
test = []
outputTrue = []
outputFalse = []

# output unit
unit = DisplayUnitType.DUT_MILLIMETERS

for dim in dims:
    # value
    value.append(dim.GetParameterValueByName('Value'))

#t = 0.005
#test.Add(round(t, 2))

for v in value:
	#output.append(math.ceil(v))
	review.Add(round(v, 2))	


for r in review:
	if r == 10:
#	reviewResult.append('true')		
		outputTrue.append(dims.pop(0))
	else:
#		reviewResult.append('false')
		outputFalse.append(dims.pop(0))
		
OUT = outputTrue, outputFalse
#__doc__ only runs if you from math import *
#t = ceil.__doc__
#s = sin.__doc__

#built in modules
#modules = sys.builtin_module_names

#OUT = dir(clr)
#OUT = modules
#OUT = test
# ----------------------------------------
code_block_6 = CodeBlock(x=python_script_dimension_value_10) { x[1]; x[0]; }

# group: Override '10' dims
code_block_7 = CodeBlock(x=code_block_6.out1) { x; }
code_block_8 = CodeBlock { ""; }
setSuffix_2 = Dimension.SetSuffix(dimension=code_block_7, values=code_block_8)
code_block_9 = CodeBlock { 255; 105; 180; }
byARGB_2 = Color.ByARGB(a=code_block_9.out0, r=code_block_9.out1, g=code_block_9.out2)
overrideColorInView_2 = Element.OverrideColorInView(element=code_block_7, color=byARGB_2)

# group: Variables
code_block_10 = CodeBlock()
# ---------- code_block_10.designscript (5 lines) ----------
def brick()
{
  // Set the default CO-
  return = 102.5;
};
# ----------------------------------------

# group: Could use modulus instead?
code_block_11 = CodeBlock { ((Math.Round(coMinus, 2))%112.5)-10 == 0; }  # frozen; unwired: coMinus
code_block_12 = CodeBlock { co%112.5 == 0; }  # frozen; unwired: co
code_block_13 = CodeBlock { ((Math.Round(coPlus, 2))%112.5)+10 == 0; }  # frozen; unwired: coPlus

# group: Functions
code_block_14 = CodeBlock()
# ---------- code_block_14.designscript (30 lines) ----------
// CO for x bricks
def CO(x)
{
  return = (brick() + 10) * x;
};

// CO+ for y bricks
def COPlus(y)
{
  return = CO(y) + 10;
};

// CO- for z bricks
def COMinus(z)
{
  return = CO(z) -10;
};

// Return a number n as a string with i decimal places
def dp(n, i)
{
    a = n * DSCore.Math.Pow(10, i);
    v = DSCore.Math.Round(a);
    w = v / DSCore.Math.Pow(10, i);
	y = ToString(w);
	b = DSCore.String.IndexOf(y, ".");
	c = DSCore.String.Substring(y, 0, b + i + 1);
	//return = String.Substring("abcdef", 0, 4);
	return = c;
};
# ----------------------------------------

watch_2 = Watch(code_block_6.out0)
code_block_15 = CodeBlock { CO(1); }

# group: Take each dimension and calculate the closest CO number above and below
value = Dimension.Value(dimension=watch_2)
code_block_16 = CodeBlock { 1; }

flatten = List.Flatten(list=value)

# group (continued): Take each dimension and calculate the closest CO number above and below
convert_between_units = DynamoConvert(flatten, MeasurementType="Length", FromConversion="Feet", ToConversion="Millimeters")
div = convert_between_units / code_block_15
floor = Math.Floor(number=div)
ceiling = Math.Ceiling(number=div)
round = Math.Round(number=convert_between_units, digits=code_block_16)

# group: Convert the CO number to its dimension in mm
code_block_17 = CodeBlock(x=floor, y=ceiling)
# ---------- code_block_17.designscript (37 lines) ----------
// 0
CO(x);
// 1
COMinus(x);
//2
COPlus(x);
// 3
CO(y);
// 4
COMinus(y);
// 5
COPlus(y);

// We'll later need to figure out
// what these relate to so here's
// a helper function
def returnCOType(a)
{
return = [Imperative]
{
if(a == 0 || a == 3)
{
  return = "CO";
}
elseif(a == 1 || a == 4)
{
  return = "CO-";
}
elseif(a == 2 || a == 5)
{
  return = "CO+";
}
else {
 return = "Cut";
}
}
};
# ----------------------------------------
create = List.Create(item0=code_block_17.out0, item1=code_block_17.out1, item2=code_block_17.out2, item3=code_block_17.out3, item4=code_block_17.out4, item5=code_block_17.out5)
transpose = List.Transpose(lists=create)
watch_3 = Watch(round)

# group: Check if the CO dimensions match the element dimension
indexOf = List.IndexOf(list=transpose, element=watch_3, lacing=Longest)

code_block_18 = CodeBlock(x=indexOf) { returnCOType(x); }

# group (continued): Check if the CO dimensions match the element dimension
string_from_object = FromObject(obj=code_block_18)

# group: Group the dimension by if it's co-ordinating or not
create_2 = List.Create(item0=string_from_object, item1=watch_2)
transpose_2 = List.Transpose(lists=create_2)
code_block_19 = CodeBlock { 0; }
getItemAtIndex_2 = List.GetItemAtIndex(index=code_block_19)  # unwired: list
map = List.Map(list=transpose_2, f_x=getItemAtIndex_2)
groupByKey = List.GroupByKey(list=transpose_2, keys=map)
create_3 = List.Create()  # unwired: item0
map_2 = List.Map(list=groupByKey.unique_keys, f_x=create_3)
code_block_20 = CodeBlock { 1; }
getItemAtIndex_3 = List.GetItemAtIndex(list=groupByKey.groups@@L2, index=code_block_20)

# group: Create list headed by coordinating type
create_4 = List.Create(item0=map_2, item1=getItemAtIndex_3)
transpose_3 = List.Transpose(lists=create_4)
flatten_2 = List.Flatten()  # unwired: list
map_3 = List.Map(list=transpose_3, f_x=flatten_2)

# group: Split list by coordination type
deconstruct = List.Deconstruct(list=map_3@L2)

code_block_21 = CodeBlock(x=deconstruct.rest) { x; }
code_block_22 = CodeBlock(x=code_block_21) { x; }
code_block_23 = CodeBlock(x=deconstruct.first) { x; }

# group: Set Suffix
create_5 = List.Create()  # unwired: item0
map_4 = List.Map(list=code_block_23, f_x=create_5)
setSuffix_3 = Dimension.SetSuffix(dimension=code_block_22@L2, values=map_4@L2)

# group: Filter by CO-
code_block_24 = CodeBlock(x=code_block_21) { x; }
code_block_25 = CodeBlock(x=deconstruct.first) { x; }

code_block_26 = CodeBlock(x=code_block_25) { x; }
code_block_27 = CodeBlock(x=code_block_26) { x; }
code_block_28 = CodeBlock(x=code_block_27) { x == "CO+"; }

# group: Filter by CO+
code_block_29 = CodeBlock(x=code_block_24) { x; }
filterByBoolMask_2 = List.FilterByBoolMask(list=code_block_29, mask=code_block_28)

# group: Make CO+ Orange
code_block_30 = CodeBlock { 255; 128; }
byARGB_3 = Color.ByARGB(r=code_block_30.out0, g=code_block_30.out1)
overrideColorInView_3 = Element.OverrideColorInView(element=filterByBoolMask_2.in, color=byARGB_3)

code_block_31 = CodeBlock(x=code_block_27) { x; }
code_block_32 = CodeBlock(x=code_block_31) { x == "CO"; }

# group: Filter by CO
code_block_33 = CodeBlock(x=code_block_29) { x; }
filterByBoolMask_3 = List.FilterByBoolMask(list=code_block_33, mask=code_block_32)

# group: Make CO Coord Green
code_block_34 = CodeBlock { 200; 100; }
byARGB_4 = Color.ByARGB(r=code_block_34.out1, g=code_block_34.out0, b=code_block_34.out1)
overrideColorInView_4 = Element.OverrideColorInView(element=filterByBoolMask_3.in, color=byARGB_4)

code_block_35 = CodeBlock(x=code_block_26) { x == "CO-"; }

# group (continued): Filter by CO-
filterByBoolMask_4 = List.FilterByBoolMask(list=code_block_24, mask=code_block_35)

# group: Make CO- Blue
code_block_36 = CodeBlock { 200; 100; }
byARGB_5 = Color.ByARGB(r=code_block_36.out1, g=code_block_36.out1, b=code_block_36.out0)
overrideColorInView_5 = Element.OverrideColorInView(element=filterByBoolMask_4.in, color=byARGB_5)

code_block_37 = CodeBlock(x=code_block_31) { x; }
code_block_38 = CodeBlock(x=code_block_37) { x == "Cut"; }

# group: Filter by Cut
code_block_39 = CodeBlock(x=code_block_33) { x; }
filterByBoolMask_5 = List.FilterByBoolMask(list=code_block_39, mask=code_block_38)

# group: Make Cut Bricks Red
code_block_40 = CodeBlock { 200; 0; }
byARGB_6 = Color.ByARGB(r=code_block_40.out0, g=code_block_40.out1, b=code_block_40.out1)
overrideColorInView_6 = Element.OverrideColorInView(element=filterByBoolMask_5.in, color=byARGB_6)
