# Dynamo graph Door Number By Linked Unit Clockwise COM-DER-RotatedLinksbyProjectNorthHouses.dyn (Dynamo 1.3.2.2480)

# group: HI!
# note: Things to do before running
# Careful of empty lists, Dynamo can eroneously prune
# Make sure that all units are on the right level, as this is used if a door has neither a to or from room
# Given the number of levels in the WGP unit layouts file, this is likely to cause an issue
# Make sure that Units & Rooms have rooms in them!
# Makes sure links are loaded
# There has been an issue of corrupted groups disrupting the ordering of the numbers, if such disruptions occur, try deleting and reinstating the affected groups
# If you find wrong numbers, have a look at a 3D view to check lines and geometry is the size and position you expect
# note: Welcome
# This graph has been built to number unit doors according to their unit number.
# It does this clockwise from the entrance door.
# It uses rooms from linked block files and reads their number
# It uses the linked entrance door to begin the numbering and does so using the intersection of the door element with the room element
# It takes the average x & y coords of the unit doors as the centre point to rotate about
# It numbers from 2 on the basis that the entrance door will always be 1
# It excludes rooms with 0 area
# It manages rotated project norths
# It manages multi level units, on the basis that they are type E
# note: Packages
# Archi-lab
# Clockwork
# Rhythm
# Springs
# note: Fails
# Ideally the graph would clash the rooms against the entrance doors and internal doors, this would make the structure of the graph simpler.  Unfortunately the clash of internal doors to rooms gave incorrect results, so instead the graph clashes internal doors against rooms and then has to reorder, pulling room info to sort with.

# group: Input group
code_block = CodeBlock { "X"; }

# group: Working group
code_block_2 = CodeBlock { "X"; }

# group: Checking group
code_block_3 = CodeBlock { "X"; }

# group: Set parameter group
code_block_4 = CodeBlock { "X"; }

# group: Doors in Project
categories = Categories("Doors")
all_elements_of_category = ElementsOfCategory(categories)

doors_in_project = CodeBlock(x=all_elements_of_category) { x; }
internal_doors = CodeBlock(x=doors_in_project) { x; }
code_block_5 = CodeBlock(x=internal_doors) { x; }

# group: Get Internal door bounding box to use as intersection
boundingBox = Element.BoundingBox(internal_doors, lacing=CrossProduct)

code_block_6 = CodeBlock { 0.1; }

# group: For some reason these doors have enormous bounding boxes which were erronously clashing with rooms adjacent. Bounding box intersect works just fine if one is fully inside the other
scale = Custom[Springs.BoundingBox.Scale](boundingBox=boundingBox, xAmmount=code_block_6, yAmmount=code_block_6, zAmmount=code_block_6)  # Scales the bounding box in three dimensions according to it's center.

flatten = Flatten(scale)

# group: Get Ent Doors from Links, (also includes circ but not a problem) make sure they are all loaded!
# note: Site isn't relevant
get_documents = Custom[Get Documents]()  # Queries all linked Revit files and retrieves their Name, LinkInstance and Document properties.

link_instance = CodeBlock(x=get_documents.Link_Instance) { x; }

# group: Rotated differently to the archi-lab node. works with lists
categories_2 = Categories("Rooms")
# note: Springs
linkedInstanceElements = Custom[Springs.Collector.LinkedInstanceElements](LinkInstance=link_instance, category=categories_2)  # Extract elements by category from the selected linked instances. The transform vector can be used to get the exact location of the elements in the local file

code_block_7 = CodeBlock { 1; }

# group: floor to floor
code_block_8 = CodeBlock { -2700; }

# group: Floor to floor
code_block_9 = CodeBlock { 2700; }

# group: This is rotated differently to the archi-lab node. Works with lists
categories_3 = Categories("Doors")
# note: Springs
linkedInstanceElements_2 = Custom[Springs.Collector.LinkedInstanceElements](LinkInstance=get_documents.Link_Instance, category=categories_3)

# group: Entrance door filter
code_block_10 = CodeBlock { "Entrance"; }

code_block_11 = CodeBlock { 2; }
transform_doors = CodeBlock(x=linkedInstanceElements_2.transform_s) { x; }

# group: Filter to get rid of links with no rooms
isNotEmpty = Custom[List.IsNotEmpty](seq=linkedInstanceElements.elements@L2)  # Just the inversion of the built-in Is Empty List node.
filterByBoolMask = List.FilterByBoolMask(list=linkedInstanceElements.elements, mask=isNotEmpty)
transform_rooms = CodeBlock(x=linkedInstanceElements.transform_s) { x; }
filterByBoolMask_2 = List.FilterByBoolMask(list=transform_rooms, mask=isNotEmpty)
filterByBoolMask_3 = List.FilterByBoolMask(list=linkedInstanceElements_2.elements, mask=isNotEmpty)
filterByBoolMask_4 = List.FilterByBoolMask(list=transform_doors, mask=isNotEmpty)

# group: Filter to get rid of rooms with no area
code_block_12 = CodeBlock { "ROOM_AREA"; }
# note: Archi-lab
get_built_in_parameter = Custom[Get Built In Parameter](ParameterNames=code_block_12, Elements=filterByBoolMask.in@L2)  # This node will take an input of a built in parameter name and element to return that parameters value.
code_block_13 = CodeBlock { 0; }
gt = get_built_in_parameter@L2 > code_block_13
filterByBoolMask_5 = List.FilterByBoolMask(list=filterByBoolMask.in@L3, mask=gt@L3)

flatten_2 = List.Flatten(list=filterByBoolMask_5.in, amt=code_block_7)

# group: Total transform is the combined shift that the located file has relative to the current file, this group finds the location points and shifts a piece of geometry to allow clashing. You can't move the actual thing because it's in a linked file
rooms = CodeBlock(x=flatten_2) { x; }
boundaries = Custom[Room.Boundaries](room=rooms@L2, lacing=CrossProduct)  # Gets a list of all boundary elements of a given room or area
# note: Clockwork
endPoint = Curve.EndPoint(boundaries.curves@L2)
create = List.Create()  # unwired: arg0
map = List.Map(list=filterByBoolMask_2.in, f_x=create)
count = List.Count(endPoint@@L2)
cycle = List.Cycle(list=map@L2, amount=count@@L2)
transform = Geometry.Transform(endPoint@L2, cycle@@L2)
# note: Archi-lab
code_block_14 = CodeBlock { true; }
byPoints = PolyCurve.ByPoints(points=transform@@L2, connectLastToFirst=code_block_14)
patch = Curve.Patch(byPoints)
code_block_15 = CodeBlock { 2500; }
code_block_16 = CodeBlock { false; }
thicken = Surface.Thicken(surface=patch@@L2, thickness=code_block_15, both_sides=code_block_16)

flatten_3 = Flatten(thicken)
code_block_17 = CodeBlock(x=flatten_2) { x; }
flatten_4 = Flatten(code_block_17)

# group: Type E units are the only units which have a single floor, move the 1st floors of the other types down to gnd so they can be clashed with the entrance both solids and room lists must be kept consistant
name = Room.Name(flatten_4@L2)
code_block_18 = CodeBlock { "E-"; }
contains = String.Contains(str=name, searchFor=code_block_18)
filterByBoolMask_6 = List.FilterByBoolMask(list=flatten_4, mask=contains)
# note: Clockwork (Rhythm failed)
level = Custom[Element.Level](element=filterByBoolMask_6.out)  # Gets an element's level
string_from_object = FromObject(level)
code_block_19 = CodeBlock { "L1"; }
contains_2 = String.Contains(str=string_from_object, searchFor=code_block_19)

filterByBoolMask_7 = List.FilterByBoolMask(list=flatten_3, mask=contains)
code_block_20 = CodeBlock(x=filterByBoolMask_7.out) { x; }
code_block_21 = CodeBlock(x=code_block_20) { x; }

# group (continued): Type E units are the only units which have a single floor, move the 1st floors of the other types down to gnd so they can be clashed with the entrance both solids and room lists must be kept consistant
filterByBoolMask_8 = List.FilterByBoolMask(list=code_block_21, mask=contains_2)
translate = Geometry.Translate(geometry=filterByBoolMask_8.in@L2, zTranslation=code_block_8)

code_block_22 = CodeBlock(x=filterByBoolMask_8.out) { x; }
create_2 = List.Create(translate, code_block_22, filterByBoolMask_7.in)

# group: Move 1st floor elements back up, check
firstItem = List.FirstItem(create_2)
translate_2 = Geometry.Translate(geometry=firstItem@L2, zTranslation=code_block_9)
restOfItems = List.RestOfItems(create_2)
create_3 = List.Create(translate_2, restOfItems)

flatten_5 = Flatten(create_3)

# group: Get Internal door bounding box to use as intersection
boundingBox_2 = Element.BoundingBox(flatten_5, lacing=CrossProduct)

# group: Doors to room
# note: Lacing doesn't seem to matter with these?
intersects = BoundingBox.Intersects(boundingBox_2, lacing=CrossProduct)  # unwired: arg1

map_2 = List.Map(list=flatten, f_x=intersects)
code_block_23 = CodeBlock(x=filterByBoolMask_6.out) { x; }

# group (continued): Type E units are the only units which have a single floor, move the 1st floors of the other types down to gnd so they can be clashed with the entrance both solids and room lists must be kept consistant
filterByBoolMask_9 = List.FilterByBoolMask(list=code_block_23, mask=contains_2)
create_4 = List.Create(filterByBoolMask_9.in, filterByBoolMask_9.out, filterByBoolMask_6.in)

flatten_6 = Flatten(create_4)
filterByBoolMask_10 = List.FilterByBoolMask(list=flatten_6)  # unwired: mask

# group: Gets rooms that match internal doors
map_3 = List.Map(list=map_2, f_x=filterByBoolMask_10.in)

# group: Should only be 1 room (house) to each door!
lastItem = List.LastItem(map_3@L2)

# group: Room number check
code_block_24 = CodeBlock { "ROOM_NUMBER"; }
get_built_in_parameter_2 = Custom[Get Built In Parameter](ParameterNames=code_block_24, Elements=lastItem@L2)
door_numbers_set_by_value = Watch(get_built_in_parameter_2)

flatten_7 = Flatten(door_numbers_set_by_value)

# group: Create a list which includes the room number extracted as a string so that it can be used to reorder the internal doors by room, then group by room
create_5 = List.Create()  # unwired: arg0, arg1, arg2
combine = List.Combine(create_5, code_block_5, lastItem, flatten_7)
code_block_25 = CodeBlock { 2; }
getItemAtIndex = List.GetItemAtIndex(list=combine@L2, index=code_block_25)
code_block_26 = CodeBlock { 0; 3; }
remove = String.Remove(str=getItemAtIndex, startIndex=code_block_26.out0, count=code_block_26.out1)
toNumber = String.ToNumber(remove)
sortIndexByValue = SortIndexByValue(toNumber)
getItemAtIndex_2 = List.GetItemAtIndex(list=combine, index=sortIndexByValue)
code_block_27 = CodeBlock { 2; }
getItemAtIndex_3 = List.GetItemAtIndex(list=getItemAtIndex_2@L2, index=code_block_27)
groupByKey = List.GroupByKey(list=getItemAtIndex_2, keys=getItemAtIndex_3)

# group: Internal Doors grouped by room ordered by room number
code_block_28 = CodeBlock { 0; }
getItemAtIndex_4 = List.GetItemAtIndex(list=groupByKey.groups@@L2, index=code_block_28)

# group: Recreate room numbers after breaking apart to sort
uniqueItems = List.UniqueItems(toNumber)
sort = List.Sort(uniqueItems)
code_block_29 = CodeBlock(x=sort) { x; }
string_from_object_2 = FromObject(code_block_29)
code_block_30 = CodeBlock { 2; "0"; }
padLeft = String.PadLeft(string_from_object_2, code_block_30.out0, code_block_30.out1)
code_block_31 = CodeBlock(X=padLeft) { "A5-" + X; }

# group: Make room number quantities the same as unit door quantities
count_2 = List.Count(getItemAtIndex_4@L2)
cycle_2 = List.Cycle(list=code_block_31@L1, amount=count_2@@L1)

# group: Unit Door number set by room
code_block_32 = CodeBlock { "DOOR_NUMBER"; }
# note: Archi-lab
set_builtin_parameter = Custom[Set BuiltIn Parameter](ParameterName=code_block_32, Elements=getItemAtIndex_4@L2, ParameterValues=cycle_2@L2)  # This node will take an input of a built in parameter name and set that parameter to given value for given elements.

# group: Group internal doors by level so that multi level properties get a sequence running up through the house, not just a straight number by angle to entrance door
code_block_33 = CodeBlock(x=set_builtin_parameter) { x; }
code_block_34 = CodeBlock { "Level"; }
getParameterValueByName = Element.GetParameterValueByName(element=code_block_33@L2, parameterName=code_block_34)
groupByKey_2 = List.GroupByKey(list=code_block_33@L2, keys=getParameterValueByName@L2)
code_block_35 = CodeBlock(x=groupByKey_2.groups) { x; }
code_block_36 = CodeBlock { 1; }
flatten_8 = List.Flatten(list=code_block_35, amt=code_block_36)

code_block_37 = CodeBlock(x=flatten_8) { x; }
unit_doors = CodeBlock(x=code_block_37) { x; }
code_block_38 = CodeBlock(x=filterByBoolMask_3.in) { x; }

# group: Filter by entrance door families
getType = FamilyInstance.GetType(code_block_38@L2)
boolean = BoolSelector(true)

name_2 = FamilyType.Name(getType)

# group (continued): Filter by entrance door families
contains_3 = String.Contains(str=name_2, searchFor=code_block_10, ignoreCase=boolean)
filterByBoolMask_11 = List.FilterByBoolMask(list=code_block_38@L2, mask=contains_3@L2)

# group: Total transform is the combined shift that the located file has relative to the current file, this group finds the location points and shifts a piece of geometry to allow clashing. You can't move the actual thing because it's in a linked file
doors = CodeBlock(x=filterByBoolMask_11.in) { x; }
boundingBox_3 = Element.BoundingBox(doors@L2, lacing=CrossProduct)
ZAxis = Vector.ZAxis()
create_6 = List.Create()  # unwired: arg0
map_4 = List.Map(list=filterByBoolMask_4.in, f_x=create_6)
# note: Archi-lab
code_block_39 = CodeBlock { true; }
code_block_40 = CodeBlock { 500; }
code_block_41 = CodeBlock { false; }

scale_2 = Custom[Springs.BoundingBox.Scale](boundingBox=boundingBox_3, yAmmount=code_block_11)

# group (continued): Total transform is the combined shift that the located file has relative to the current file, this group finds the location points and shifts a piece of geometry to allow clashing. You can't move the actual thing because it's in a linked file
# note: Clockwork
perimeterCurvesByNormal = Custom[BoundingBox.PerimeterCurvesByNormal](boundingbox=scale_2@L2, normal=ZAxis)  # Returns the perimeter curve of a bounding box on a plane determined by a given normal and the centroid of the bounding box
endPoint_2 = Curve.EndPoint(perimeterCurvesByNormal@L3)
count_3 = List.Count(endPoint_2@@L2)
cycle_3 = List.Cycle(list=map_4@L2, amount=count_3@@L2)
transform_2 = Geometry.Transform(endPoint_2@L2, cycle_3@L2)
byPoints_2 = PolyCurve.ByPoints(points=transform_2@L2, connectLastToFirst=code_block_39)
patch_2 = Curve.Patch(byPoints_2)
thicken_2 = Surface.Thicken(surface=patch_2, thickness=code_block_40, both_sides=code_block_41)

door_solids = CodeBlock(x=thicken_2) { x; }

# group: entrance doors to rooms
rooms_2 = CodeBlock(x=create_2) { x; }
flatten_9 = Flatten(rooms_2)
doors_2 = CodeBlock(x=door_solids) { x; }
flatten_10 = Flatten(doors_2)
# note: Lacing doesn't seem to matter with these?
doesIntersect = Geometry.DoesIntersect(geometry=flatten_10, lacing=CrossProduct)  # unwired: other
map_5 = List.Map(list=flatten_9, f_x=doesIntersect)

filterByBoolMask_12 = List.FilterByBoolMask(list=door_solids, lacing=CrossProduct)  # unwired: mask

# group: gets the entrance door solids which match the room ordered by room
map_6 = List.Map(list=map_5, f_x=filterByBoolMask_12.in)

# group: No unit would have more than 1
firstItem_2 = List.FirstItem(map_6@@L2)

code_block_42 = CodeBlock(x=flatten_6) { x; }

# group: Room number check
code_block_43 = CodeBlock { "ROOM_NUMBER"; }
get_built_in_parameter_3 = Custom[Get Built In Parameter](ParameterNames=code_block_43, Elements=code_block_42)
door_numbers_set_by_value_2 = Watch(get_built_in_parameter_3)

rooms_3 = CodeBlock(x=flatten_6) { x; }

# group: Create a list which includes the entrance door and room number extracted as a string to use for sorting. Room level is also included for reference
create_7 = List.Create()  # unwired: arg0, arg1, arg2
code_block_44 = CodeBlock { "Level"; }
# note: The only time you'd have multiple doors into a room would be a corridor, therefore it doesn't matter which door is picked from the list
getParameterValueByName_2 = Element.GetParameterValueByName(element=rooms_3, parameterName=code_block_44)
combine_2 = List.Combine(create_7, firstItem_2, door_numbers_set_by_value_2, getParameterValueByName_2)
code_block_45 = CodeBlock { 1; }
getItemAtIndex_5 = List.GetItemAtIndex(list=combine_2@L2, index=code_block_45)
code_block_46 = CodeBlock { 0; 3; }
remove_2 = String.Remove(str=getItemAtIndex_5, startIndex=code_block_46.out0, count=code_block_46.out1)
toNumber_2 = String.ToNumber(remove_2)
# note: Bit crazy but the numbers returned are the previously listed indexes... now in the right order!
sortIndexByValue_2 = SortIndexByValue(toNumber_2)
getItemAtIndex_6 = List.GetItemAtIndex(list=combine_2, index=sortIndexByValue_2)
code_block_47 = CodeBlock { 1; }
getItemAtIndex_7 = List.GetItemAtIndex(list=getItemAtIndex_6, index=code_block_47, lacing=Longest)
groupByKey_3 = List.GroupByKey(list=getItemAtIndex_6, keys=getItemAtIndex_7)

# group: Compare room numbers for internal doors against room numbers for external doors and get only the external doors which have a room which is also present in the internal doors
code_block_48 = CodeBlock { 0; }
getItemAtIndex_8 = List.GetItemAtIndex(list=groupByKey_3.groups@@L2, index=code_block_48)
room_numbers_that_match_internal = CodeBlock(x=code_block_31) { x; }  # "Room numbers that match internal doors"
room_numbers_that_match_entrance = CodeBlock(x=groupByKey_3.unique_keys) { x; }  # "Room numbers that match entrance doors"
allIndicesOf = List.AllIndicesOf(list=room_numbers_that_match_internal, item=room_numbers_that_match_entrance)
isEmpty = List.IsEmpty(allIndicesOf@L2)
filterByBoolMask_13 = List.FilterByBoolMask(list=getItemAtIndex_8, mask=isEmpty)

# group: Most likely if there is an entrance door which doe have the right room number, but isn't on the same level as the internal doors, it's because it's a ground floor door with an immediate stair corridor up, the ground floor should then be removed. The order of doors is to have 1st foor then ground floor, so if we drop the last item, we drop the ground floor door
list_number = CodeBlock(x=filterByBoolMask_13.out) { x; }
code_block_49 = CodeBlock(x=list_number) { x; }

# group: Identify if internal doors have more levels than the entrance doors
count_4 = Count(code_block_35@L3)
count_5 = Count(list_number@L2)
eq = count_4 == count_5

# group: Identify empty
code_block_50 = CodeBlock { false; }
allIndicesOf_2 = List.AllIndicesOf(list=eq, item=code_block_50)

# group (continued): Most likely if there is an entrance door which doe have the right room number, but isn't on the same level as the internal doors, it's because it's a ground floor door with an immediate stair corridor up, the ground floor should then be removed. The order of doors is to have 1st foor then ground floor, so if we drop the last item, we drop the ground floor door
getItemAtIndex_9 = List.GetItemAtIndex(list=code_block_49, index=allIndicesOf_2)
dropLastItem = Custom[List.DropLastItem](list=getItemAtIndex_9@L2)  # Drops the last item from a given list.

# group: Clockwork replace item at index didn't work with multiple elements in the replacement list
python_script_replace_list_of = Python(IN[0]=list_number, IN[1]=dropLastItem, IN[2]=allIndicesOf_2)  # "Python Script Replace List of Items with List of Indexes"
# ---------- python_script_replace_list_of.python (21 lines) ----------
dataEnteringNode = IN
list = IN[0]
elements = IN[1]
indices = IN[2]
count = 0
i = 0
out = []
for item in list:
	try:
		if count == indices[i]:
			out.append(elements[i])
			i = i+1
			count = count+1
		else:
			out.append(item)
			count = count+1		
	except:
		out.append(item)
		count = count+1

OUT = out
# ----------------------------------------

flatten_11 = Flatten(python_script_replace_list_of)

# group: Gets a point from the solid to use as a location point
edges = Face.Edges(flatten_11)
curveGeometry = Edge.CurveGeometry(edges@@L1)
endPoint_3 = Curve.EndPoint(curveGeometry@@L1)
firstItem_3 = List.FirstItem(endPoint_3@@L2)

code_block_51 = CodeBlock(x=flatten_8) { x; }

# group: Unit door locations
getLocation = Element.GetLocation(code_block_51@@L1)

# group: Use average point of unit doors and entrance door locations to rotate numbering around
addItemToFront = List.AddItemToFront(item=firstItem_3@L1, list=getLocation@L2)
X = Point.X(addItemToFront)
average = Math.Average(X)
Y = Point.Y(addItemToFront)
average_2 = Math.Average(Y)
Z = Point.Z(addItemToFront)
average_3 = Math.Average(Z)
byCoordinates = Point.ByCoordinates(x=average, y=average_2, z=average_3)

unit_door_locations = CodeBlock(x=getLocation) { x; }

# group: Get vector of unit doors and room locations
byTwoPoints = Vector.ByTwoPoints(start=byCoordinates, end=unit_door_locations)

code_block_52 = CodeBlock(x=firstItem_3) { x; }

# group: Get entrance door and average location vector
byTwoPoints_2 = Vector.ByTwoPoints(start=byCoordinates, end=code_block_52)

# group: Compare angle of unit door to entrance door from room location
ZAxis_2 = Vector.ZAxis()
angleAboutAxis = Vector.AngleAboutAxis(byTwoPoints, byTwoPoints_2, ZAxis_2)

# group: Sort unit doors by angles from room location
sortByKey = List.SortByKey(list=unit_doors@L2, keys=angleAboutAxis@L2)

code_block_53 = CodeBlock(x=sortByKey.sorted_list) { x; }
code_block_54 = CodeBlock(x=code_block_53) { x; }
code_block_55 = CodeBlock { "Mark"; }
code_block_56 = CodeBlock { "_"; }
code_block_57 = CodeBlock { 0; }

# group: Entrance is no.E so we start at 1
code_block_58 = CodeBlock { 1; }

# group: Number doors sequentially
count_6 = Count(code_block_53@L2)
# note: Clockwork
n1 = Custom[+1](dbl=count_6@L2)  # Increments a value by 1
code_block_59 = CodeBlock { 1; }
range = Range(start=code_block_58, end=n1, step=code_block_59, lacing=Longest)
create_8 = List.Create(range)

# group: Create list of new door numbers
# note: Rhythm, for some reason the numbers go to 4dp!
concat = String.Concat()  # unwired: arg0, arg1
code_block_60 = CodeBlock { 3; }
flatten_12 = List.Flatten(list=code_block_54, amt=code_block_60)
code_block_61 = CodeBlock { "_"; }
code_block_62 = CodeBlock { 2; }
flatten_13 = List.Flatten(list=create_8, amt=code_block_62)
add = code_block_61 + flatten_13

getParameterValueByName_3 = Element.GetParameterValueByName(element=flatten_12, parameterName=code_block_55)
split = String.Split(getParameterValueByName_3, code_block_56)
getItemAtIndex_10 = List.GetItemAtIndex(list=split@L2, index=code_block_57)
flatten_14 = Flatten(getItemAtIndex_10)

# group: Door Prefix
code_block_63 = CodeBlock(X=flatten_14) { "D." + X; }

code_block_64 = CodeBlock { "."; }
removeAfterGivenCharacter = Custom[String.RemoveAfterGivenCharacter](str=add@L2, Character=code_block_64)  # This will move all characters at and after the given character.
flatten_15 = Flatten(removeAfterGivenCharacter)

# group (continued): Create list of new door numbers
combine_3 = List.Combine(concat, code_block_63, flatten_15)

# group: Set door number
code_block_65 = CodeBlock { "DOOR_NUMBER"; }
flatten_16 = Flatten(code_block_54)
watch = Watch(combine_3)
# note: Archi-lab
set_builtin_parameter_2 = Custom[Set BuiltIn Parameter](ParameterName=code_block_65, Elements=flatten_16@L2, ParameterValues=watch)
get_built_in_parameter_4 = Custom[Get Built In Parameter](ParameterNames=code_block_65, Elements=set_builtin_parameter_2@L2)
watch_2 = Watch(set_builtin_parameter_2)

# group: Check lines for sorting
byStartPointEndPoint = Line.ByStartPointEndPoint(startPoint=byCoordinates, endPoint=code_block_52)

# group: Check lines for sorting
byStartPointEndPoint_2 = Line.ByStartPointEndPoint(startPoint=byCoordinates, endPoint=unit_door_locations)

flatten_17 = Flatten(getItemAtIndex_4)
flatten_18 = Flatten(code_block_5)

# group: Remove flat doors which are not intersecting a room
nullSetDifference = Custom[Springs.NullSetDifference](list1=flatten_17, list2=flatten_18)  # Similar to the built in node, with a built-in safety for null values. Part of the SmartCopyMonitor workflow.

level_2 = Custom[Element.Level](element=nullSetDifference)
groupByKey_4 = List.GroupByKey(list=nullSetDifference, keys=level_2)
code_block_66 = CodeBlock(x=groupByKey_4.groups) { x; }

# group: Door Prefix
code_block_67 = CodeBlock { "D."; }

# group: Uses level to name units
# note: Clockwork
level_3 = Custom[Element.Level](element=groupByKey_4.groups)
string_from_object_3 = FromObject(level_3)
code_block_68 = CodeBlock { "="; }
split_2 = String.Split(string_from_object_3, code_block_68)
code_block_69 = CodeBlock { 1; }
code_block_70 = CodeBlock { 2; }
code_block_71 = CodeBlock { "-"; }
code_block_72 = CodeBlock { 0; }

code_block_73 = CodeBlock { 1; }
# note: Block No.
getItemAtIndex_11 = List.GetItemAtIndex(list=split_2@L2, index=code_block_73)
code_block_74 = CodeBlock { "_"; }
split_3 = String.Split(getItemAtIndex_11, code_block_74)

# group (continued): Uses level to name units
# note: Block No.
getItemAtIndex_12 = List.GetItemAtIndex(list=split_3@L2, index=code_block_69)
getItemAtIndex_13 = List.GetItemAtIndex(list=split_3@L2, index=code_block_70)
split_4 = String.Split(getItemAtIndex_13, code_block_71)
# note: Level No.
getItemAtIndex_14 = List.GetItemAtIndex(list=split_4@L2, index=code_block_72)

# group: Door number splitter
code_block_75 = CodeBlock { "-"; }

# group: Notional symbol for doors without rooms
code_block_76 = CodeBlock { "X"; }

# group: Door number splitter
code_block_77 = CodeBlock { "_"; }

# group: Gives Unit Doors without Rooms a unique code
code_block_78 = CodeBlock { "Mark"; }
code_block_79 = CodeBlock { 1; }
count_7 = Count(groupByKey_4.groups@L2)
range_2 = Range(start=code_block_79, end=count_7, step=code_block_79, lacing=Longest)
code_block_80 = CodeBlock(t=code_block_67, u=getItemAtIndex_12, v=code_block_75, w=code_block_76, x=getItemAtIndex_14, y=code_block_77, z=range_2) { t+u+v+w+x+y+z; }
setParameterByName = Element.SetParameterByName(element=code_block_66, parameterName=code_block_78, value=code_block_80)

# group: Unit Door number check
code_block_81 = CodeBlock { "DOOR_NUMBER"; }
# note: Archi-lab
get_built_in_parameter_5 = Custom[Get Built In Parameter](ParameterNames=code_block_81, Elements=setParameterByName@L2)
watch_3 = Watch(get_built_in_parameter_5)

# group: Unit door number check
# note: Archi-lab
code_block_82 = CodeBlock { "DOOR_NUMBER"; }
get_built_in_parameter_6 = Custom[Get Built In Parameter](ParameterNames=code_block_82, Elements=all_elements_of_category)
door_numbers_set_by_value_3 = Watch(get_built_in_parameter_6)

# group: Room number check
number = Room.Number(flatten_2)

# group: Door number check
code_block_83 = CodeBlock { "Mark"; }
getParameterValueByName_4 = Element.GetParameterValueByName(element=filterByBoolMask_11.in, parameterName=code_block_83)
watch_4 = Watch(getParameterValueByName_4)

# group: Crashes Graph!
solids = Element.Solids()  # unwired: arg0

# group: Unit door number check
# note: Archi-lab
get_built_in_parameter_7 = Custom[Get Built In Parameter](ParameterNames=code_block_32, Elements=set_builtin_parameter@L2)
door_numbers_set_by_value_4 = Watch(get_built_in_parameter_7)

# group: Gets rooms which are in both, should match list number
setIntersection = SetIntersection(room_numbers_that_match_internal, room_numbers_that_match_entrance)

# group: Internal Door Extrusion Check
ZAxis_3 = Vector.ZAxis()
perimeterCurvesByNormal_2 = Custom[BoundingBox.PerimeterCurvesByNormal](boundingbox=scale@L2, normal=ZAxis_3)
endPoint_4 = Curve.EndPoint(perimeterCurvesByNormal_2@L3)
code_block_84 = CodeBlock { true; }
byPoints_3 = PolyCurve.ByPoints(points=endPoint_4@L2, connectLastToFirst=code_block_84)
patch_3 = Curve.Patch(byPoints_3)
code_block_85 = CodeBlock { 500; }
code_block_86 = CodeBlock { false; }
thicken_3 = Surface.Thicken(surface=patch_3, thickness=code_block_85, both_sides=code_block_86)

code_block_87 = CodeBlock {  }
