# Dynamo graph DwgTextToTopo-1.dyn (Dynamo 2.0.3.8104)

select_model_element = DSModelElementSelection()  # 1 picked in the model
boolean = BoolSelector(false)
getCOMObjects = Custom[ImportInstance.GetCOMObjects](LinkedDWG=select_model_element, VisibleAutoCAD=boolean)  # Get the particular COM objects (Text/MText/Attribute/Hatch) inside a linked DWG by opening and reading data via AutoCAD running in background
code_block = CodeBlock(x=getCOMObjects.1_COM_Text_MTexts) { x; }
removeNulls = Lists.Manage.RemoveNulls(Data=code_block)
MTextProperties = Custom[ActiveX.MTextProperties](COM_MText=removeNulls.Cleaned)  # Get COM TEXT/MTEXT properties
code_block_2 = CodeBlock(x=MTextProperties.3_AlignmentPoint) { x; }
code_block_3 = CodeBlock(x=MTextProperties.0_Content) { x; }
code_block_4 = CodeBlock { "A".."Z"; }
contains = String.Contains(str=code_block_3, searchFor=code_block_4, lacing=CrossProduct)
code_block_5 = CodeBlock { true; }
contains_2 = List.Contains(list=contains@L2, item=code_block_5)
filterByBoolMask = List.FilterByBoolMask(list=code_block_2, mask=contains_2)
filterByBoolMask_2 = List.FilterByBoolMask(list=code_block_3, mask=contains_2)
toNumber = String.ToNumber(str=filterByBoolMask_2.out)
translate = Geometry.Translate(geometry=filterByBoolMask.out, zTranslation=toNumber)
byPoints = Topography.ByPoints(points=translate)
