# Dynamo graph FacadeGridPanelsSplitSurface.dyn (Dynamo 2.0.2.6826)

# group: Dwg
select_model_elements = DSModelElementsSelection()  # 1 picked in the model

geometry = Element.Geometry(element=select_model_elements)
code_block = CodeBlock(x=geometry) { x[0]; }
patch = Curve.Patch(curve=code_block)
code_block_2 = CodeBlock { 0.5; }
pointAtParameter = Surface.PointAtParameter(surface=patch, u=code_block_2, v=code_block_2)
normalAtParameter = Surface.NormalAtParameter(surface=patch, u=code_block_2, v=code_block_2)
byOriginNormal = Plane.ByOriginNormal(origin=pointAtParameter, normal=normalAtParameter)
code_block_3 = CodeBlock { 1.5; }
scale = Geometry.Scale(geometry=patch, plane=byOriginNormal, xamount=code_block_3, yamount=code_block_3, zamount=code_block_3)
code_block_4 = CodeBlock { 30; 35; }
panelDiamond = Geometry.Panel.PanelDiamond(srf=scale, u=code_block_4.out0, v=code_block_4.out1)
intersect = Geometry.Intersect(geometry=patch, other=panelDiamond.QuadPanels)
flatten = List.Flatten(list=intersect)
code_block_5 = CodeBlock { "Surface"; }
removeIfNot = List.RemoveIfNot(list=flatten, type=code_block_5)
perimeterCurves = Surface.PerimeterCurves(surface=removeIfNot)
