# Dynamo graph Fractal Python.dyn (Dynamo 2.0.3.8810)

python_script = Python()  # frozen; unwired: IN[0], IN[1], IN[2], IN[3], IN[4]
# ---------- python_script.python (66 lines) ----------
# Load the Python Standard and DesignScript Libraries
import sys
import clr
clr.AddReference('ProtoGeometry')
from Autodesk.DesignScript.Geometry import *

##### Defnitions #####

"""
line = the root line object (in this case the trunk)
param = the parameter to start branching
angle = the angle between new branch and last branch.
percent = the percentage of the length the new branch will have from the last branch.
num = the numberof iterations

"""
def FractalFunction(line, param, angle, percent, num):
	# Get the direction of this branch...
	dir = line.Direction
	# Rotate the vector about XY plane to give new branch direction...
	vec = Vector.Rotate(dir, Plane.XY(), angle)
	# Get the start location of the new branch on this branch.
	pt = Curve.PointAtParameter(line,param)
	# Create new branch...
	line = Line.ByStartPointDirectionLength(pt,vec,(line.Length / 100)*percent)
	# Add new branch to array...
	arr.append(line)
	# Decrease branch count...
	num = num - 1
	# check if branch count is greater than 0, if so then recursively call this function passing in new branch to operate on
	if num > 0:
		FractalFunction(line, param, angle, percent, num)
		FractalFunction(line, param, -angle, percent, num)

def FractalFractal(lines, params, numF):
	for line in lines:
		for param in params:
			FractalFunction(line, param, angle, percent, num)
			FractalFunction(line, param, -angle, percent, num)
			arr.append(line)
			lines.append(line)
			
	numF = numF - 1	
	
	if numF > 0:
		FractalFractal(lines, params, numF)	

##### Inputs #####

lines = IN[0]
params = IN[1]
angle = IN[2]
percent = IN[3]
num = IN[4]
numF = IN[4]

##### Main Script #####

arr = []

FractalFractal(lines, params, numF)
		

##### Output #####

OUT = arr 
# ----------------------------------------
number_slider = DoubleSlider(1, range=0..1 step 0.1)
code_block = CodeBlock()  # // percent
code_block_2 = CodeBlock()  # // num
code_block_3 = CodeBlock()  # // angle
code_block_4 = CodeBlock()  # // param
code_block_5 = CodeBlock()  # // length
python_script_2 = Python()  # frozen; unwired: IN[0], IN[1], IN[2], IN[3], IN[4]
# ---------- python_script_2.python (57 lines) ----------
# Load the Python Standard and DesignScript Libraries
import sys
import clr
clr.AddReference('ProtoGeometry')
from Autodesk.DesignScript.Geometry import *

##### Defnitions #####

"""
line = the root line object (in this case the trunk)
param = the parameter to start branching
angle = the angle between new branch and last branch.
percent = the percentage of the length the new branch will have from the last branch.
num = the numberof iterations

"""
def FractalFunction(line, mirrLine, param, angle, percent, num):
	# Get the direction of this branch...
	dir = line.Direction
	org = line.EndPoint
	zAxis = Vector.ByCoordinates(0,0,1)
	dirPerp = Vector.Rotate(dir, zAxis, 90)
	pln = Plane.ByOriginNormal(org, dirPerp)
	# Rotate the vector about XY plane to give new branch direction...
	vec = Vector.Rotate(dir, Plane.XY(), angle)
	# Get the start location of the new branch on this branch.
	pt = Curve.PointAtParameter(line,param)
	# Create new branch...
	line = Line.ByStartPointDirectionLength(pt,vec,(line.Length / 100)*percent)
	lineMirr = 	Geometry.Mirror(line, pln)
	# Add new branch to array...
	arr.append(line)
	arr.append(lineMirr)
	# Decrease branch count...
	num = num - 1
	# check if branch count is greater than 0, if so then recursively call this function passing in new branch to operate on
	if num > 0:
		FractalFunction(line, mirrLine, param, angle, percent, num)	



##### Inputs #####
line = IN[0]
mirrLine = IN[0]
param = IN[1]
angle = IN[2]
percent = IN[3]
num = IN[4]

##### Main Script #####

arr = []
FractalFunction(line, mirrLine, param, angle, percent, num)

##### Output #####

OUT = arr
# ----------------------------------------
python_script_3 = Python()  # frozen; unwired: IN[0], IN[1], IN[2], IN[3], IN[4]
# ---------- python_script_3.python (53 lines) ----------
# Load the Python Standard and DesignScript Libraries
import sys
import clr
clr.AddReference('ProtoGeometry')
from Autodesk.DesignScript.Geometry import *

##### Defnitions #####

"""
line = the root line object (in this case the trunk)
param = the parameter to start branching
angle = the angle between new branch and last branch.
percent = the percentage of the length the new branch will have from the last branch.
num = the numberof iterations

"""
def FractalFunction(line, param, angle, percent, num):
	# Get the direction of this branch...
	dir = line.Direction
	# Rotate the vector about XY plane to give new branch direction...
	vec = Vector.Rotate(dir, Plane.XY(), angle)
	# Get the start location of the new branch on this branch.
	pt = Curve.PointAtParameter(line,param)
	# Create new branch...
	line = Line.ByStartPointDirectionLength(pt,vec,(line.Length / 100)*percent)
	# Add new branch to array...
	arr.append(line)
	# Decrease branch count...
	num = num - 1
	# check if branch count is greater than 0, if so then recursively call this function passing in new branch to operate on
	if num > 0:
		FractalFunction(line, param, angle, percent, num)	
		FractalFunction(line, param, -angle, percent, num)
	
##### Inputs #####

line = IN[0]
param = IN[1]
angle = IN[2]
percent = IN[3]
num = IN[4]

##### Main Script #####

arr = []

arr.append(line)
FractalFunction(line, param, angle, percent, num)
FractalFunction(line, param, -angle, percent, num)

##### Output #####

OUT = arr 
# ----------------------------------------
python_script_4 = Python()  # frozen; unwired: IN[0], IN[1], IN[2], IN[3], IN[4]
# ---------- python_script_4.python (57 lines) ----------
# Load the Python Standard and DesignScript Libraries
import sys
import clr
clr.AddReference('ProtoGeometry')
from Autodesk.DesignScript.Geometry import *

##### Defnitions #####

"""
line = the root line object (in this case the trunk)
param = the parameter to start branching
angle = the angle between new branch and last branch.
percent = the percentage of the length the new branch will have from the last branch.
num = the numberof iterations

"""
def FractalFunction(lines, param, angle, percent, num):
	# Get the direction of this branch...
	lines = []
	for line in lines:
		dir = line.Direction
		# Rotate the vector about XY plane to give new branch direction...
		vec = Vector.Rotate(dir, Plane.XY(), angle)
		for p in param:
			# Get the start location of the new branch on this branch.
			point = Curve.PointAtParameter(line,p)
			# Create new branch...
			lines.append(Line.ByStartPointDirectionLength(point,vec,(line.Length / 100)*percent))
			# Add new branch to array...
		arr.extend(lines)
	# Decrease branch count...
	num = num - 1#
	# check if branch count is greater than 0, if so then recursively call this function passing in new branch to operate on
	if num > 0:
		FractalFunction(lines, param, angle, percent, num)	
		FractalFunction(lines, param, -angle, percent, num)
	
##### Inputs #####

lines = IN[0]
param = IN[1]
angle = IN[2]
percent = IN[3]
num = IN[4]

##### Main Script #####

arr = []

arr.append(lines)

FractalFunction(lines, param, angle, percent, num)
FractalFunction(lines, param, -angle, percent, num)

##### Output #####

OUT = arr 
# ----------------------------------------
python_script_5 = Python()  # frozen; unwired: IN[0], IN[1], IN[2], IN[3], IN[4]
# ---------- python_script_5.python (77 lines) ----------
# Load the Python Standard and DesignScript Libraries
import sys
import clr
clr.AddReference('ProtoGeometry')
from Autodesk.DesignScript.Geometry import *


import time


##### Defnitions #####

"""
line = the root line object (in this case the trunk)
param = the parameter to start branching
angle = the angle between new branch and last branch.
percent = the percentage of the length the new branch will have from the last branch.
num = the numberof iterations

"""
def FractalFunction(line, param, angle, percent, num):
	# Get the direction of this branch...
	dir = line.Direction
	# Rotate the vector about XY plane to give new branch direction...
	vec = Vector.Rotate(dir, Plane.XY(), angle)
	lines = []
	for p in param:
		# Get the start location of the new branch on this branch.
		point = Curve.PointAtParameter(line,p)
		# Create new branch...
		lines.append(Line.ByStartPointDirectionLength(point,vec,(line.Length / 100)*percent))
		# Add new branch to array...
		arr.extend(lines)
	# Decrease branch count...
	num = num - 1#
	# check if branch count is greater than 0, if so then recursively call this function passing in new branch to operate on
	if num > 0:
		FractalFunction(line, param, angle, percent, num)	
		FractalFunction(line, param, -angle, percent, num)

def FractalFractal(line, param, numF):

	start_time =time.time()
	i=0
	result=[]
	ss=time.time()-start_time
	while ss<60:
		result.append(i)
		i+=1
		#do something
		ss=time.time()-start_time

		for line in lines:
			FractalFunction(line, param, angle, percent, num)
			FractalFunction(line, param, -angle, percent, num)
			numF = numF - 1
			lines.append(line)
		
		if numF > 0:
			FractalFractal(line, param, numF)

##### Inputs #####

lines = IN[0]
param = IN[1]
angle = IN[2]
percent = IN[3]
num = IN[4]
numF = IN[4]

##### Main Script #####
arr = []
FractalFractal(lines, param, numF)

##### Output #####

OUT = arr 
# ----------------------------------------
byCoordinates = Point.ByCoordinates()
number_slider_2 = DoubleSlider(1, range=0..40 step 1)
byCoordinates_2 = Point.ByCoordinates(y=number_slider_2)
byStartPointEndPoint = Line.ByStartPointEndPoint(startPoint=byCoordinates, endPoint=byCoordinates_2)
code_block_6 = CodeBlock(x=byStartPointEndPoint) { [x]; }
code_block_7 = CodeBlock { 0..1..#6; }
code_block_8 = CodeBlock { 1; }
dropItems = List.DropItems(list=code_block_7, amount=code_block_8)
number_slider_3 = DoubleSlider(40, range=0..40 step 1)
number_slider_4 = DoubleSlider(40, range=0..40 step 1)
number_slider_5 = DoubleSlider(0, range=0..8 step 1)
code_block_9 = CodeBlock(line=code_block_6, param=dropItems, angle=number_slider_3, percent=number_slider_4, num=number_slider_5) { line; param; angle; percent; num; }
python_script_6 = Python(IN[0]=code_block_9.line, IN[1]=code_block_9.param, IN[2]=code_block_9.angle, IN[3]=code_block_9.percent, IN[4]=code_block_9.num)
# ---------- python_script_6.python (64 lines) ----------
# Load the Python Standard and DesignScript Libraries
import sys
import clr
clr.AddReference('ProtoGeometry')
from Autodesk.DesignScript.Geometry import *

##### Defnitions #####

"""
line = the root line object (in this case the trunk)
param = the parameter to start branching
angle = the angle between new branch and last branch.
percent = the percentage of the length the new branch will have from the last branch.
num = the numberof iterations

"""
def FractalFunction(line, param, angle, percent, num):
	# Get the direction of this branch...
	dir = line.Direction
	# Rotate the vector about XY plane to give new branch direction...
	vec = Vector.Rotate(dir, Plane.XY(), angle)
	lines = []
	for p in param:
		# Get the start location of the new branch on this branch.
		point = Curve.PointAtParameter(line,p)
		# Create new branch...
		lines.append(Line.ByStartPointDirectionLength(point,vec,(line.Length / 100)*percent))
		# Add new branch to array...
	array.extend(lines)
	# Decrease branch count...
	num = num - 1
	# check if branch count is greater than 0, if so then recursively call this function passing in new branch to operate on
	if num > 0:
		FractalFunction(line, param, angle, percent, num)	
		FractalFunction(line, param, -angle, percent, num)


def FractalFractal(array, number):
	for a in array: 
		FractalFunction(a, param, angle, percent, number)
		FractalFunction(a, param, -angle, percent, number)
		
	number = number - 1
	
	if number > 0:
		FractalFractal(array, number)

##### Inputs #####

array = IN[0]
param = IN[1]
angle = IN[2]
percent = IN[3]
num = IN[4]
numF = IN[4]

##### Main Script #####

FractalFractal(array, numF)


##### Output #####

OUT = array
# ----------------------------------------
python_script_7 = Python()  # frozen; unwired: IN[0], IN[1], IN[2], IN[3], IN[4]
# ---------- python_script_7.python (67 lines) ----------
# Load the Python Standard and DesignScript Libraries
import sys
import clr
clr.AddReference('ProtoGeometry')
from Autodesk.DesignScript.Geometry import *

##### Defnitions #####

"""
line = the root line object (in this case the trunk)
param = the parameter to start branching
angle = the angle between new branch and last branch.
percent = the percentage of the length the new branch will have from the last branch.
num = the numberof iterations

"""
def FractalFunction(line, param, angle, percent, num):
	# Get the direction of this branch...
	dir = line.Direction
	# Rotate the vector about XY plane to give new branch direction...
	vec = Vector.Rotate(dir, Plane.XY(), angle)
	lines = []
	for p in param:
		# Get the start location of the new branch on this branch.
		point = Curve.PointAtParameter(line,p)
		# Create new branch...
		lines.append(Line.ByStartPointDirectionLength(point,vec,(line.Length / 100)*percent))
		# Add new branch to array...
	arr.extend(lines)
	# Decrease branch count...
	num = num - 1
	# check if branch count is greater than 0, if so then recursively call this function passing in new branch to operate on
	if num > 0:
		FractalFunction(line, param, angle, percent, num)	
		FractalFunction(line, param, -angle, percent, num)


def FractalFractal(array):
	for a in array: 
		FractalFunction(a, param, angle, percent, numF)
		FractalFunction(a, param, -angle, percent, numF)
		
	numF = numF - 1
	
	if num > 0:
		FractalFunction(a, param, angle, percent, numF)	
		FractalFunction(a, param, -angle, percent, numF)

##### Inputs #####

line = IN[0]
param = IN[1]
angle = IN[2]
percent = IN[3]
num = IN[4]
numF = IN[4]

##### Main Script #####

arr = []
FractalFractal(arr)



##### Output #####

OUT = arr 
# ----------------------------------------
