# Dynamo graph GridGenerator-OffGrids.dyn (Dynamo 1.3.2.2480)

current = Document.Current()
activeView = Document.ActiveView(current)
same_numer_of_x_y = BoolSelector(true)
add = _ + _  # unwired: arg0, arg1
code_block = CodeBlock { 0; }
off_grid_required = BoolSelector(true)
# note: This graph creates grids and dimensions them, by default it creates a square grid, but it can be cusomised to create independant quantities of x and y grids with different lengths.
# It numbers grids in the x axis and uses alphabetical in the y axis
# It can use an 'off grid' in the X axis if required
x_distance_grid_to_grid = IntegerSlider(7500, range=0..100000 step 1)

# group: X Off Grid Spacing
integer_slider = IntegerSlider(3500, range=0..10000 step 1)

# group: SERIES
code_block_2 = CodeBlock(n=x_distance_grid_to_grid, _c=integer_slider) { {n,n,n,n,_c}; }
count = Count(code_block_2)

quantity_of_grids_x = IntegerSlider(14, range=0..100 step 1)
code_block_3 = CodeBlock(a=quantity_of_grids_x, b=count) { a/b; }
floor = Math.Floor(code_block_3)

# group: This is the repeating sequence
cycle = List.Cycle(list=code_block_2, amount=floor)

mod = quantity_of_grids_x % count

# group: this adds the remainder after the sequence has compeleted
code_block_4 = CodeBlock(mod=mod) { 0..mod-1; }
getItemAtIndex = List.GetItemAtIndex(list=cycle, index=code_block_4)

# group: This adds the two together
create = List.Create(cycle, getItemAtIndex)

code_block_5 = CodeBlock(x=x_distance_grid_to_grid) { x; }
code_block_6 = CodeBlock(lst=code_block_5, n=quantity_of_grids_x) { DSCore.List.Cycle(lst, n); }

# group: This is if there is no off grid
if_ = Custom[RIE.If](Test=off_grid_required, True=create, False=code_block_6)  # An If node that keeps list structure, empty lists and so forth.

flatten = Flatten(if_)
scan = ScanList(add, code_block, flatten)  # "List.Scan"
code_block_7 = CodeBlock(x=scan) { x; }
quantity_of_grids_y = IntegerSlider(49, range=0..100 step 1)
code_block_8 = CodeBlock(x=code_block_5) { x; }
sequence = Sequence(amount=quantity_of_grids_y, step=code_block_8, lacing=Longest)
if_2 = If(test=same_numer_of_x_y, true=code_block_7, false=sequence)
y_start_point = Point.ByCoordinates(y=if_2)
different_lengths_y = BoolSelector(false)
y_length = IntegerSlider(36048, range=0..100000 step 1)
code_block_9 = CodeBlock(x=quantity_of_grids_x) { x; }
cycle_2 = List.Cycle(list=y_length, amount=code_block_9)
square_grid = BoolSelector(true)
square_grid_2 = CodeBlock(x=quantity_of_grids_x, y=x_distance_grid_to_grid) { (x-2) * y; }
x_length = IntegerSlider(39076, range=0..100000 step 1)
if_3 = If(test=square_grid, true=square_grid_2, false=x_length)
cycle_3 = List.Cycle(list=if_3, amount=code_block_9)
if_4 = If(test=different_lengths_y, true=cycle_2, false=cycle_3)
y_end_point = Point.ByCoordinates(x=if_4, y=if_2)
y_grid_bystartpointendpoint = Grid.ByStartPointEndPoint(y_start_point, y_end_point)
string = StringInput("X")
string_2 = StringInput("-")
boolean = BoolSelector(true)
renameNumerical = Custom[Grid.RenameNumerical](grid=y_grid_bystartpointendpoint, sortAxis=string, tempPrefix=string_2, toggle=boolean)  # Renames grids numerically. Use toggle to temp rename grids to avoid duplicate renaming.
curve = Grid.Curve(renameNumerical)
endPoint = Curve.EndPoint(curve)
Y = Point.Y(endPoint)
maximumItem = List.MaximumItem(Y)
offset = CodeBlock { 0; }
add_2 = maximumItem + offset
code_block_10 = CodeBlock { 0; }
byCoordinates = Point.ByCoordinates(y=add_2, z=code_block_10)
minimumItem = List.MinimumItem(Y)
sub = minimumItem - offset
byCoordinates_2 = Point.ByCoordinates(y=sub, z=code_block_10)
byStartPointEndPoint = Line.ByStartPointEndPoint(startPoint=byCoordinates, endPoint=byCoordinates_2)
byElements = Dimension.ByElements(activeView, renameNumerical, byStartPointEndPoint)
x_start_point = Point.ByCoordinates(x=code_block_7)
x_end_point = Point.ByCoordinates(x=code_block_7, y=cycle_3)
x_grid_bystartpointendpoint = Grid.ByStartPointEndPoint(x_start_point, x_end_point)
string_3 = StringInput("Y")
string_4 = StringInput("-")
renameAlphabetical = Custom[Grid.RenameAlphabetical](grid=x_grid_bystartpointendpoint, sortAxis=string_3, tempPrefix=string_4, toggle=boolean)  # Renames grids alphabetically from A to ZZ. Excludes I and O. Use toggle to temp rename grids to avoid duplicate renaming.
curve_2 = Grid.Curve(renameAlphabetical)
endPoint_2 = Curve.EndPoint(curve_2)
X = Point.X(endPoint_2)
maximumItem_2 = List.MaximumItem(X)
offset_2 = CodeBlock { 0; }
add_3 = maximumItem_2 + offset_2
code_block_11 = CodeBlock { 0; }
byCoordinates_3 = Point.ByCoordinates(x=add_3, z=code_block_11)
minimumItem_2 = List.MinimumItem(X)
sub_2 = minimumItem_2 - offset_2
byCoordinates_4 = Point.ByCoordinates(x=sub_2, z=code_block_11)
byStartPointEndPoint_2 = Line.ByStartPointEndPoint(startPoint=byCoordinates_3, endPoint=byCoordinates_4)
byElements_2 = Dimension.ByElements(activeView, renameAlphabetical, byStartPointEndPoint_2)
