# Dynamo graph GroupMembersExcluded.dyn (Dynamo 1.3.4.6666)

# note: A group's 'Type' is not the same as it's name... use Element Name to identify which Group Type is desired.  Swapping out does work!
element_types = ElementTypes("GroupType")
all_elements_of_type = ElementsOfType(element_types)
name = Element.Name(all_elements_of_type)
element_types_2 = ElementTypes("Group")
all_elements_of_type_2 = ElementsOfType(element_types_2)
name_2 = Element.Name(all_elements_of_type_2)
members = Custom[Group.Members](group=all_elements_of_type_2@L1)  # Retrieves the members of a group
code_block = CodeBlock()  # //clockwork
