# Dynamo graph GroupSwap.dyn (Dynamo 1.3.2.2480)

select_model_element = DSModelElementSelection()  # 1 picked in the model
code_block = CodeBlock { "Type"; }
# note: A group's 'Type' is not the same as it's name... use Element Name to identify which Group Type is desired.  Swapping out does work!
element_types = ElementTypes("GroupType")
all_elements_of_type = ElementsOfType(element_types)
code_block_2 = CodeBlock(x=all_elements_of_type) { x[4]; }
setParameterByName = Element.SetParameterByName(element=select_model_element, parameterName=code_block, value=code_block_2)
element_types_2 = ElementTypes("Group")
all_elements_of_type_2 = ElementsOfType(element_types_2)
code_block_3 = CodeBlock { "B-2B4P"; }
# note: Clockwork
filterByName = Custom[Elements.FilterByName](elements=all_elements_of_type_2, searchString=code_block_3)  # Retrieves those elements from a collection whose names match the search string
getParameterValueByName = Element.GetParameterValueByName(element=select_model_element, parameterName=code_block)
name = Element.Name(select_model_element)
name_2 = Element.Name(all_elements_of_type)
