# Dynamo graph Machine Learning Rooms.dyn (Dynamo 2.0.3.8810)

categories = Categories(index=425)
all_elements_of_category = ElementsOfCategory(Category=categories)
code_block = CodeBlock { "Unit Type"; }
setParameterByName = Element.SetParameterByName(parameterName=code_block)  # unwired: element, value
