# Dynamo graph Number From Line.dyn (Dynamo 2.0.3.8810)

# group: Category
categories = Categories(index=332)  # graph input

# group: Active View
activeViewFromCurrentDocument = Custom[Document.ActiveViewFromCurrentDocument]()  # Gets the active view of the current document

# group: Select by category and view
byCategoryAndView = archilab.Revit.Selection.Select.ByCategoryAndView(category=categories, view=activeViewFromCurrentDocument)

# group: Pick a detail spline
select_model_element = DSModelElementSelection()  # 1 picked in the model; graph input

# group: Get the Curve Geometry
curve = CurveElement.Curve(curveElement=select_model_element)

# group: Get geometric center of family
boundingBox = Element.BoundingBox(element=byCategoryAndView)
toCuboid = BoundingBox.ToCuboid(boundingBox=boundingBox)
centroid = Solid.Centroid(solid=toCuboid)

# group: See how far along the curve each point is
parameterAtPoint = Curve.ParameterAtPoint(curve=curve, point=centroid)

# group: Get the index of each value when sorted, get the families at the index
sortIndexByValue = List.SortIndexByValue(list=parameterAtPoint)
getItemAtIndex = List.GetItemAtIndex(list=byCategoryAndView, index=sortIndexByValue)

# group: Parameter Name
code_block = CodeBlock { "Parking Mark"; }

code_block_2 = CodeBlock(x=byCategoryAndView) { x; }

# group: Make the number value
# note: We need to make a list of numbers for all the families, pad any values less than 10 and convert the value to text
count = List.Count(list=code_block_2)
code_block_3 = CodeBlock(x=count) { (1..x) + ""; }
code_block_4 = CodeBlock { 2; "0"; }
padLeft = String.PadLeft(str=code_block_3, newWidth=code_block_4.out0, padChars=code_block_4.out1)

# group: Set the Parameter
setParameterByName = Element.SetParameterByName(element=getItemAtIndex, parameterName=code_block, value=padLeft)
watch = Watch(setParameterByName)
