# Dynamo graph Room Solids Material Create.dyn (Dynamo 2.0.3.8104)

byGeometry = ImportInstance.ByGeometry()  # unwired: geometry
boolean = BoolSelector(false)
placedRooms = Custom[Collector.PlacedRooms](toggle=boolean)  # This will collect placed rooms in current file.
code_block = CodeBlock { "Unit Type"; }
getParameterValueByName = Element.GetParameterValueByName(element=placedRooms, parameterName=code_block)
groupByKey = List.GroupByKey(list=placedRooms, keys=getParameterValueByName)
code_block_2 = CodeBlock(x=groupByKey.groups) { x; }
finishBoundary = Room.FinishBoundary(room=code_block_2)
endPoint = Curve.EndPoint(curve=finishBoundary)
code_block_3 = CodeBlock { true; }
byPoints = PolyCurve.ByPoints(points=endPoint, connectLastToFirst=code_block_3)
ZAxis = Vector.ZAxis()

# group: Height of Solids
number = DoubleInput(2850)

extrudeAsSolid = Curve.ExtrudeAsSolid(curve=byPoints, direction=ZAxis, distance=number)
flatten = List.Flatten(list=extrudeAsSolid)
file_path = Filename("..\..\..\..\ProgramData\Autodesk\RVT 2019\Family Templates\English\Conceptual Mass\Metric Mass.rft")
code_block_4 = CodeBlock(x=groupByKey.unique_keys) { x; }
code_block_5 = CodeBlock(x=code_block_4) { x; }
code_block_6 = CodeBlock { 1; }
chop = List.Chop(list=code_block_5, lengths=code_block_6)
code_block_7 = CodeBlock(x=code_block_2) { x; }
count = List.Count(list=code_block_7@L2)
cycle = List.Cycle(list=chop@L2, amount=count@L1)
code_block_8 = CodeBlock { 1; }
sequence = Sequence(start=code_block_8, amount=count@L2, step=code_block_8)
code_block_9 = CodeBlock(A=cycle, B=sequence) { A + "-" + B; }
flatten_2 = List.Flatten(list=code_block_9)
categories = Categories(index=276)
code_block_10 = CodeBlock(x=groupByKey.unique_keys) { "Unit Type - " + x; }
byName = Material.ByName(name=code_block_10)
code_block_11 = CodeBlock { null; }
nullAllIndicesOf = Custom[Springs.NullAllIndicesOf](list=byName, value=code_block_11)  # list all of the indices of a list that match the specified value. Capable of handling null values, part of the SmartCopyMonitor workflow.
getItemAtIndex = List.GetItemAtIndex(list=code_block_10, index=nullAllIndicesOf)
color_palette = ColorPalette({R: 254, G: 224, B: 185, A: 255})
color_palette_2 = ColorPalette({R: 239, G: 209, B: 179, A: 255})
color_palette_3 = ColorPalette({R: 239, G: 209, B: 179, A: 245})
color_palette_4 = ColorPalette({R: 251, G: 208, B: 211, A: 245})
color_palette_5 = ColorPalette({R: 251, G: 208, B: 211, A: 245})
color_palette_6 = ColorPalette({R: 183, G: 132, B: 196, A: 245})
color_palette_7 = ColorPalette({R: 244, G: 244, B: 196, A: 245})
color_palette_8 = ColorPalette({R: 151, G: 172, B: 196, A: 245})
color_palette_9 = ColorPalette({R: 98, G: 168, B: 191, A: 245})
color_palette_10 = ColorPalette({R: 255, G: 182, B: 124, A: 245})
color_palette_11 = ColorPalette({R: 230, G: 224, B: 124, A: 245})
list_create = List.Create(item0=color_palette, item1=color_palette_2, item2=color_palette_3, item3=color_palette_4, item4=color_palette_5, item5=color_palette_6, item6=color_palette_7, item7=color_palette_8, item8=color_palette_9, item9=color_palette_10, item10=color_palette_11)
code_block_12 = CodeBlock(x=list_create) { x; }
getItemAtIndex_2 = List.GetItemAtIndex(list=code_block_12, index=nullAllIndicesOf)
create_material = Custom[Create Material](Name=getItemAtIndex, color=getItemAtIndex_2)  # Note : This method is deprecated in Revit 2019. Create new materials or overwrite properties of existing materials. Inspired by Dynamo Forum.
end = Revit.Transaction.Transaction.End(input=create_material)
passthrough = Custom[Passthrough](passThrough=code_block_10, waitFor=end)  # Forces a sequential order of execution. The node wired into the output of the Passthrough node will be executed *after* the node wired into the waitFor input (e.g. important for some Revit operations). The value of the passThrough input will be passed on to the node wired into the output port of the Passthrough node.
byName_2 = Material.ByName(name=passthrough)
cycle_2 = List.Cycle(list=byName_2@L2, amount=count@L1)
flatten_3 = List.Flatten(list=cycle_2)
byGeometry_2 = Custom[Springs.FamilyInstance.ByGeometry](geometry=flatten, familyTemplatePath=file_path, familyName=flatten_2, category=categories, materialName=flatten_3)  # You must provide a valid family template path that will be used for all input geometry objects. The project units(and not the templates) will be used to determine the size of the output geometry. The provided category will be used only if the family template supports it. If not, the default template category will be used instead. Likewise, the family material(provided as a string) will be set only if a material with that name exists in the template. If not, the default material will be used instead ("By Category"). For void cuts, the material settings will be ignored. The Subcategory name is an optional input. If you'd like to skip assigning a Subcategory to any new instance, simply use null. The node expects a unique family name for each geometry object. The rest of the input lists will be processed as if the node lacing is set to longest.
code_block_13 = CodeBlock { 1; }
chop_2 = List.Chop(list=list_create, lengths=code_block_13)
