# Dynamo graph Set CAD Layers Plans-1.dyn (Dynamo 2.0.3.8810)

# group: Hi
# note: This graph uses packages:
# BiMorph
# Clockwork
# note: This graph is designed to run in the active view, so that you can create a view template for use with a suite of views.
# It illustrates how you can control visibility and line settings.
# Visibility is set through the active view.
# Line styles are set through the 'global' object style
# note: Created By:
# Mark Ackerley
# (please ask for assistance if something goes wrong)

# group: Unwanted layer names
code_block = CodeBlock { "Fittings-loose"; }
code_block_2 = CodeBlock { "Door-block"; }
code_block_3 = CodeBlock { "UCS"; }
code_block_4 = CodeBlock { ["Outline","Markup","circulation","note", "plot", "front"]; }

code_block_5 = CodeBlock { "SBC-TAH Level"; }
activeViewFromCurrentDocument = Custom[Document.ActiveViewFromCurrentDocument]()  # Gets the active view of the current document

# group: CAD Links
reportInstances = CAD.ReportInstances()

# group: Filter to get only CAD imports GA plans
code_block_6 = CodeBlock { "Name"; }
getParameterValueByName = Element.GetParameterValueByName(element=reportInstances.CADLinks, parameterName=code_block_6)
code_block_7 = CodeBlock { "SBC-TAH Level 0 - BOUND - GA SCALE"; }
contains = String.Contains(str=getParameterValueByName, searchFor=code_block_7)
filterByBoolMask = List.FilterByBoolMask(list=reportInstances.CADLinks, mask=contains)

code_block_8 = CodeBlock(x=filterByBoolMask.in) { x; }
code_block_9 = CodeBlock(x=code_block_8) { x; }
code_block_10 = CodeBlock(x=code_block_9) { x; }

# group: CAD Layer Names
layerNamesInUse = CAD.LayerNamesInUse(importInstance=code_block_8)

code_block_11 = CodeBlock(x=layerNamesInUse.layerNames) { x; }
boolean = BoolSelector(true)
code_block_12 = CodeBlock { true; }

# group: Filter layer names to get the hidden from none hidden
code_block_13 = CodeBlock(x=layerNamesInUse.layerNames) { x; }
join = List.Join(list0=code_block_4)
contains_2 = String.Contains(str=code_block_13@L2, searchFor=join, ignoreCase=boolean, lacing=CrossProduct)
allIndicesOf = List.AllIndicesOf(list=contains_2@@L2, item=code_block_12)
code_block_14 = CodeBlock { 1; }
flatten = List.Flatten(amt=code_block_14)  # unwired: list
map = List.Map(list=allIndicesOf, f_x=flatten)
uniqueItems = List.UniqueItems(list=map@L2)

removeItemAtIndex = List.RemoveItemAtIndex(list=code_block_11@L2, indices=uniqueItems@L2)

# group: Filter empty lists
isEmpty = List.IsEmpty(list=removeItemAtIndex@L2)
filterByBoolMask_2 = List.FilterByBoolMask(list=code_block_10, mask=isEmpty)
filterByBoolMask_3 = List.FilterByBoolMask(list=removeItemAtIndex, mask=isEmpty)

# group: Show wanted layers
activeViewFromCurrentDocument_2 = Custom[Document.ActiveViewFromCurrentDocument]()
boolean_2 = BoolSelector(true)

code_block_15 = CodeBlock(x=code_block_8) { x; }
code_block_16 = CodeBlock(x=code_block_15) { x; }
getItemAtIndex = List.GetItemAtIndex(list=code_block_13@L2, index=uniqueItems@L2)

# group: Filter empty lists
isEmpty_2 = List.IsEmpty(list=getItemAtIndex@L2)
filterByBoolMask_4 = List.FilterByBoolMask(list=code_block_16, mask=isEmpty_2)
filterByBoolMask_5 = List.FilterByBoolMask(list=getItemAtIndex, mask=isEmpty_2)

activeViewFromCurrentDocument_3 = Custom[Document.ActiveViewFromCurrentDocument]()

# group: Hide unwanted layers
boolean_3 = BoolSelector(false)
setLayerVisibility = CAD.SetLayerVisibility(importInstance=filterByBoolMask_4.out@L1, view=activeViewFromCurrentDocument_3, layerName=filterByBoolMask_5.out@L2, visible=boolean_3)
activeViewFromCurrentDocument_4 = Custom[Document.ActiveViewFromCurrentDocument]()

passthrough = Custom[Passthrough](passThrough=activeViewFromCurrentDocument_2, waitFor=setLayerVisibility)  # Forces a sequential order of execution. The node wired into the output of the Passthrough node will be executed *after* the node wired into the waitFor input (e.g. important for some Revit operations). The value of the passThrough input will be passed on to the node wired into the output port of the Passthrough node.

# group (continued): Show wanted layers
setLayerVisibility_2 = CAD.SetLayerVisibility(importInstance=filterByBoolMask_2.out@L1, view=passthrough, layerName=filterByBoolMask_3.out@L2, visible=boolean_2)

code_block_17 = CodeBlock(x=code_block_8) { x; }

# group: Thanks Alban!
getCategory = Element.GetCategory(element=code_block_17)
subcategories = Custom[Category.Subcategories](category=getCategory)  # Retrieves all the subcategories for a given category

string_from_object = FromObject(obj=subcategories)

# group: Dashed layer names
code_block_18 = CodeBlock { ["Swing","Above", "Shower","Offset"]; }

code_block_19 = CodeBlock { true; }

# group: Get layers with desired names to make dashed
boolean_4 = BoolSelector(true)
contains_3 = String.Contains(str=string_from_object@L2, searchFor=code_block_18, ignoreCase=boolean_4, lacing=CrossProduct)
allIndicesOf_2 = List.AllIndicesOf(list=contains_3@@L2, item=code_block_19)
code_block_20 = CodeBlock { 1; }
flatten_2 = List.Flatten(amt=code_block_20)  # unwired: list
map_2 = List.Map(list=allIndicesOf_2, f_x=flatten_2)
uniqueItems_2 = List.UniqueItems(list=map_2@L2)

removeItemAtIndex_2 = List.RemoveItemAtIndex(list=subcategories@L2, indices=uniqueItems_2@L2)

# group: Filter empty lists
isEmpty_3 = List.IsEmpty(list=removeItemAtIndex_2@L2)
filterByBoolMask_6 = List.FilterByBoolMask(list=removeItemAtIndex_2, mask=isEmpty_3)

code_block_21 = CodeBlock(x=filterByBoolMask_6.out) { x; }
code_block_22 = CodeBlock { 192; }
byARGB = Color.ByARGB(r=code_block_22, g=code_block_22, b=code_block_22)
count = List.Count(list=code_block_21@L2)
cycle = List.Cycle(list=byARGB, amount=count)
code_block_23 = CodeBlock { 1; }
code_block_24 = CodeBlock(x=count) { x; }
cycle_2 = List.Cycle(list=code_block_23, amount=code_block_24)

# group: Set overrides in view, this is pretty robust and because it leaves the object styles as CAD, you can always go back and check the line weight is correct
activeViewFromCurrentDocument_5 = Custom[Document.ActiveViewFromCurrentDocument]()
byProperties = Revit.Filter.OverrideGraphicSettings.ByProperties(projectionLineColor=cycle@L2, projectionLineWeight=cycle_2@L2)

passthrough_2 = Custom[Passthrough](passThrough=activeViewFromCurrentDocument_5, waitFor=setLayerVisibility_2)

# group (continued): Set overrides in view, this is pretty robust and because it leaves the object styles as CAD, you can always go back and check the line weight is correct
setCategoryOverrides = View.SetCategoryOverrides(view=passthrough_2, category=code_block_21@L2, overrides=byProperties@L2)

passthrough_3 = Custom[Passthrough](passThrough=activeViewFromCurrentDocument, waitFor=setCategoryOverrides)
code_block_25 = CodeBlock(x=subcategories) { x; }
getItemAtIndex_2 = List.GetItemAtIndex(list=code_block_25@L2, index=uniqueItems_2@L2)

# group: Filter empty lists
isEmpty_4 = List.IsEmpty(list=getItemAtIndex_2@L2)
filterByBoolMask_7 = List.FilterByBoolMask(list=getItemAtIndex_2, mask=isEmpty_4)

code_block_26 = CodeBlock(x=filterByBoolMask_7.out) { x; }
code_block_27 = CodeBlock { 192; }
byARGB_2 = Color.ByARGB(r=code_block_27, g=code_block_27, b=code_block_27)
count_2 = List.Count(list=code_block_26@L2)
cycle_3 = List.Cycle(list=byARGB_2, amount=count_2)
line_patterns = LinePatterns(index=28)
code_block_28 = CodeBlock(x=count_2) { x; }
cycle_4 = List.Cycle(list=line_patterns, amount=code_block_28)
code_block_29 = CodeBlock { 1; }
code_block_30 = CodeBlock(x=count_2) { x; }
cycle_5 = List.Cycle(list=code_block_29, amount=code_block_30)

# group: Set overrides in view, this is pretty robust and because it leaves the object styles as CAD, you can always go back and check the line weight is correct
byProperties_2 = Revit.Filter.OverrideGraphicSettings.ByProperties(projectionLineColor=cycle_3@L2, projectionLinePattern=cycle_4@L2, projectionLineWeight=cycle_5@L2)
setCategoryOverrides_2 = View.SetCategoryOverrides(view=passthrough_3, category=code_block_26@L2, overrides=byProperties_2@L2)

code_block_31 = CodeBlock { 192; }

# group: Set Global Layer Line Colour, doesn't work everywhere but is a good start
code_block_32 = CodeBlock { 1; }
byARGB_3 = Color.ByARGB(r=code_block_31, g=code_block_31, b=code_block_31)
setObjectStyle = CAD.SetObjectStyle(importInstance=code_block_15@L1, layerName=layerNamesInUse.layerNames@L2, projectionWeight=code_block_32, color=byARGB_3)

activeViewFromCurrentDocument_6 = Custom[Document.ActiveViewFromCurrentDocument]()
