# Dynamo graph Set CAD Layers Sheets-1.dyn (Dynamo 2.0.3.8810)

# group: Hi
# note: This graph uses packages:
# BiMorph
# Clockwork
# note: This graph is built to convert the colours of linked DWGs to lineweights, matching the CAD colour table
# For this to work, it must be done by view (Revit often ignores the object styles).
# The DWG must be exploded before import so that Revit can override polylines and hatch correctly.
# note: Created By:
# Mark Ackerley
# (please ask for assistance if something goes wrong)

# group: Set Global Layer Line Colour This is Often Ignored!
setObjectStyle = CAD.SetObjectStyle()  # frozen; unwired: importInstance, layerName, projectionWeight, color

# group: Filter DWG Links
code_block = CodeBlock { ["Details", "Height Rods"]; }

# group: Get object styles for DWGs
python_script = Python(IN[0]=code_block)
# ---------- python_script.python (78 lines) ----------
#thanks to Konrad and Luke J

import clr
import sys
pyt_path = r'C:\Program Files (x86)\IronPython 2.7\Lib'
sys.path.append(pyt_path)

# Import Element wrapper extension methods
clr.AddReference("RevitNodes")
import Revit
clr.ImportExtensions(Revit.Elements)
# toProtoType etc.
clr.ImportExtensions(Revit.GeometryConversion)

# Import DocumentManager and TransactionManager
clr.AddReference("RevitServices")
import RevitServices
from RevitServices.Persistence import DocumentManager
from RevitServices.Transactions import TransactionManager
doc = DocumentManager.Instance.CurrentDBDocument

# Import RevitAPI
clr.AddReference("RevitAPI")
import Autodesk
from Autodesk.Revit.DB import *
import System

nameEquals = IN[0]

gStyles = FilteredElementCollector(doc).OfClass(GraphicsStyle).ToElements()


#we need to get the name of the gStyle so we can filter to get the dwgs.... all the dwgs names will end in dwg
gStyleDwgCategoryList = []
for i in gStyles:
    if "dwg" in i.GraphicsStyleCategory.Name: 
        gStyleDwgCategoryList.append(i.GraphicsStyleCategory)

gStyleCategoryList = []
gStyleCategoryListName = []
#gStyleCategoryListColour = []

i = 0
while i < len(nameEquals):
    gStyleCategorySubList = []
    gStyleCategorySubListName = []
    gStyleCategorySubListColour = []
    for gSCat in gStyleDwgCategoryList:  
        if nameEquals[i] in gSCat.Name:
            gStyleCategorySubList.append(gSCat)
            gStyleCategorySubListName.append(gSCat.Name)
#            gStyleCategorySubListColour.append(gSCat.LineColor)            
    i = i + 1    
    gStyleCategoryList.append(gStyleCategorySubList)
    gStyleCategoryListName.append(gStyleCategorySubListName)
#    gStyleCategoryListColour.append(gStyleCategorySubListColour)

gStyleName = []
gStyleColour = []
for gSubL in gStyleCategoryList:
    gStyleSubCategories = []
    for gL in gSubL:
         gStyleSubCategories.append(gL.SubCategories)
         gStyleSubCategoriesList = [[] for i in range(0, len(gStyleSubCategories))]
         gStyleSubCategoriesListClr = [[] for i in range(0, len(gStyleSubCategories))]

    for index, item in enumerate(gStyleSubCategories):
        for i in item:
            gStyleSubCategoriesList[index].append(i.Name)

    for index, item in enumerate(gStyleSubCategories):
        for i in item:
            gStyleSubCategoriesListClr[index].append(i.LineColor)

    gStyleName.append(gStyleSubCategoriesList)
    gStyleColour.append(gStyleSubCategoriesListClr)

OUT =  gStyleCategoryListName, gStyleName, gStyleColour
# ----------------------------------------

# group: Object Styles Name
code_block_2 = CodeBlock(x=python_script) { x[1]; }

code_block_3 = CodeBlock(x=python_script) { x[0]; }
python_script_2 = Python()  # frozen; unwired: IN[0], IN[1], IN[2]
# ---------- python_script_2.python (39 lines) ----------
import clr
import sys
pyt_path = r'C:\Program Files (x86)\IronPython 2.7\Lib'
sys.path.append(pyt_path)

# Import Element wrapper extension methods
clr.AddReference("RevitNodes")
import Revit
clr.ImportExtensions(Revit.Elements)
# toProtoType etc.
clr.ImportExtensions(Revit.GeometryConversion)

# Import DocumentManager and TransactionManager
clr.AddReference("RevitServices")
import RevitServices
from RevitServices.Persistence import DocumentManager
from RevitServices.Transactions import TransactionManager
doc = DocumentManager.Instance.CurrentDBDocument

# Import RevitAPI
clr.AddReference("RevitAPI")
import Autodesk
from Autodesk.Revit.DB import *
import System

importInstance = UnwrapElement(IN[0])
layerName = IN[1]
lineWeight = IN[2]
lineColour = Color(0,0,0)
	
subCategories = importInstance.Category.SubCategories
    
if subCategories.Contains(layerName):    
    TransactionManager.Instance.EnsureInTransaction(doc)
    subCategories.get_Item("0").SetLineWeight(5, GraphicsStyleType.Projection)
    TransactionManager.Instance.TransactionTaskDone()
    OUT = 'success'
else:
      OUT = 'fail'
# ----------------------------------------
python_script_3 = Python()  # frozen; unwired: IN[0]
# ---------- python_script_3.python (71 lines) ----------
#Copyright(c) 2017, Konrad K Sobon
# @arch_laboratory, http://archi-lab.net

import clr
import sys
pyt_path = r'C:\Program Files (x86)\IronPython 2.7\Lib'
sys.path.append(pyt_path)

# Import Element wrapper extension methods
clr.AddReference("RevitNodes")
import Revit
clr.ImportExtensions(Revit.Elements)
# toProtoType etc.
clr.ImportExtensions(Revit.GeometryConversion)

# Import DocumentManager and TransactionManager
clr.AddReference("RevitServices")
import RevitServices
from RevitServices.Persistence import DocumentManager
from RevitServices.Transactions import TransactionManager
doc = DocumentManager.Instance.CurrentDBDocument

# Import RevitAPI
clr.AddReference("RevitAPI")
import Autodesk
from Autodesk.Revit.DB import *
import System

paramName = IN[0]
paramValues = IN[2]

if not isinstance(IN[1], list):
	elements = [IN[1]]
else:
	elements = IN[1]

def GetBuiltInParam(paramName):
	builtInParams = System.Enum.GetValues(BuiltInParameter)
	test = []
	for i in builtInParams:
		if i.ToString() == paramName:
			test.append(i)
			break
		else:
			continue
	return test[0]

try:
	errorReport = None
	TransactionManager.Instance.EnsureInTransaction(doc)
	
	bipName = GetBuiltInParam(paramName)
	for i, j in zip(elements, paramValues):
		param = UnwrapElement(i).get_Parameter(bipName)
		if param.StorageType == StorageType.ElementId:
			id = ElementId(j)
			param.Set(id)
		else:
			param.Set(j)
	
	TransactionManager.Instance.TransactionTaskDone()
except:
	# if error accurs anywhere in the process catch it
	import traceback
	errorReport = traceback.format_exc()

#Assign your output to the OUT variable
if errorReport == None:
	OUT = IN[1]
else:
	OUT = errorReport
# ----------------------------------------

# group: CAD Links
reportInstances = CAD.ReportInstances()

# group: Filter to get only CAD imports GA plans
code_block_4 = CodeBlock { "Name"; }
getParameterValueByName = Element.GetParameterValueByName(element=reportInstances.CADLinks, parameterName=code_block_4)
contains = String.Contains(str=getParameterValueByName, searchFor=code_block, lacing=CrossProduct)
transpose = List.Transpose(lists=contains)
code_block_5 = CodeBlock { true; }
indexOf = List.IndexOf(list=transpose@L2, element=code_block_5)

getItemAtIndex = List.GetItemAtIndex(list=reportInstances.CADLinks, index=indexOf)
code_block_6 = CodeBlock(x=getItemAtIndex) { x; }
code_block_7 = CodeBlock(x=code_block_6) { x; }
code_block_8 = CodeBlock(x=code_block_7) { x; }

# group: Thanks Alban!
getCategory = Element.GetCategory(element=code_block_8)
subcategories = Custom[Category.Subcategories](category=getCategory)  # Retrieves all the subcategories for a given category

code_block_9 = CodeBlock { 0; }
byARGB = Color.ByARGB(r=code_block_9, g=code_block_9, b=code_block_9)

# group: Get the Revit line weight for the CAD line numbers
file_path = Filename(".\CAD to Revit Lineweights.xlsx")
file_from_path = FileObject(path=file_path)
code_block_10 = CodeBlock { "Sheet1"; true; false; }
importExcel = Data.ImportExcel(file=file_from_path, sheetName=code_block_10.out0, readAsStrings=code_block_10.out1, showExcel=code_block_10.out2)

code_block_11 = CodeBlock { 1; }
dropItems = List.DropItems(list=importExcel, amount=code_block_11)

# group: CAD line weight
code_block_12 = CodeBlock { 0; }
getItemAtIndex_2 = List.GetItemAtIndex(list=dropItems@L2, index=code_block_12)

# group: Revit line weight
code_block_13 = CodeBlock { 2; }
getItemAtIndex_3 = List.GetItemAtIndex(list=dropItems@L2, index=code_block_13)

byKeysValues = DesignScript.Builtin.Dictionary.ByKeysValues(keys=getItemAtIndex_2, values=getItemAtIndex_3)

# group: Get all the autocad line numbers as RGB values to cross reference with the RGB values which are in the links
file_path_2 = Filename(".\AutoCAD Color Index RGB Equivalents.html.xlsx")
file_from_path_2 = FileObject(path=file_path_2)
code_block_14 = CodeBlock { "AutoCAD Color Index RGB Equival"; true; false; }
importExcel_2 = Data.ImportExcel(file=file_from_path_2, sheetName=code_block_14.out0, readAsStrings=code_block_14.out1, showExcel=code_block_14.out2)
code_block_15 = CodeBlock { 8; }
dropItems_2 = List.DropItems(list=importExcel_2, amount=code_block_15)
code_block_16 = CodeBlock { 3; }
dropItems_3 = List.DropItems(list=dropItems_2@L2, amount=code_block_16)
clean = List.Clean(list=dropItems_3)
clean_2 = List.Clean(list=clean)
toNumber = String.ToNumber(str=clean_2)
code_block_17 = CodeBlock { 1; }
dropItems_4 = List.DropItems(list=toNumber@L2, amount=code_block_17)
code_block_18 = CodeBlock { 0; }
getItemAtIndex_4 = List.GetItemAtIndex(list=dropItems_4@L2, index=code_block_18)
code_block_19 = CodeBlock { 1; }
getItemAtIndex_5 = List.GetItemAtIndex(list=dropItems_4@L2, index=code_block_19)
code_block_20 = CodeBlock { 2; }
getItemAtIndex_6 = List.GetItemAtIndex(list=dropItems_4@L2, index=code_block_20)
byARGB_2 = Color.ByARGB(r=getItemAtIndex_4, g=getItemAtIndex_5, b=getItemAtIndex_6)
# note: Dictionaries only work with keys as strings
string_from_object = FromObject(obj=byARGB_2)
duplicateItemIndicies = archilab.Lists.Lists.DuplicateItemIndicies(list=string_from_object)
removeItemAtIndex = List.RemoveItemAtIndex(list=string_from_object, indices=duplicateItemIndicies.duplicate)
code_block_21 = CodeBlock { 0; }
getItemAtIndex_7 = List.GetItemAtIndex(list=clean_2@L2, index=code_block_21)
removeItemAtIndex_2 = List.RemoveItemAtIndex(list=getItemAtIndex_7, indices=duplicateItemIndicies.duplicate)
byKeysValues_2 = DesignScript.Builtin.Dictionary.ByKeysValues(keys=removeItemAtIndex, values=removeItemAtIndex_2)

# group: Object Styles Colours
code_block_22 = CodeBlock(x=python_script) { x[2]; }
toDynamoColor = Custom[Color.ToDynamoColor](RevitColor=code_block_22@L2)  # Converts Revit colors into Dynamo colors
# note: Use string representation to test for equality
string_from_object_2 = FromObject(obj=toDynamoColor)

# group: Use link's colours to get CAD line weight
valueAtKey = DesignScript.Builtin.Dictionary.ValueAtKey(dictionary=byKeysValues_2, key=string_from_object_2@L2, lacing=Longest)
code_block_23 = CodeBlock { "0"; }
replaceNull = Custom[List.ReplaceNull](seq=valueAtKey@L2, replacement=code_block_23)  # Replaces all null values within a given list with a substitute

valueAtKey_2 = DesignScript.Builtin.Dictionary.ValueAtKey(dictionary=byKeysValues, key=replaceNull@L2, lacing=Longest)

# group: The parameter requires a number
code_block_24 = CodeBlock(x=valueAtKey_2) { x; }
toNumber_2 = String.ToNumber(str=code_block_24)

count = List.Count(list=toNumber_2@L2)
cycle = List.Cycle(list=byARGB, amount=count)
string_from_object_3 = FromObject(obj=subcategories)
code_block_25 = CodeBlock()
# ---------- code_block_25.designscript (4 lines) ----------
"GENF";
//-GENF";
 //grey 192 override;
 true;
# ----------------------------------------
contains_2 = String.Contains(str=string_from_object_3@L2, searchFor=code_block_25.out0, ignoreCase=code_block_25.out1)
code_block_26 = CodeBlock { true; }
allIndicesOf = List.AllIndicesOf(list=contains_2@L2, item=code_block_26)
code_block_27 = CodeBlock { 192; }
byARGB_3 = Color.ByARGB(r=code_block_27, g=code_block_27, b=code_block_27)
replaceItemAtIndex = Custom[List.ReplaceItemAtIndex+](seq=cycle@L2, indices=allIndicesOf@L2, replacement=byARGB_3)  # Replaces the item at a given index of a list by another item. Unlike the OOTB node, it can replace items at multiple indeces.

# group: Set overrides in view, this is pretty robust and because it leaves the object styles as CAD, you can always go back and check the line weight is correct
activeViewFromCurrentDocument = Custom[Document.ActiveViewFromCurrentDocument]()  # Gets the active view of the current document
byProperties = Revit.Filter.OverrideGraphicSettings.ByProperties(projectionLineColor=replaceItemAtIndex@L2, projectionLineWeight=toNumber_2@L2)
setCategoryOverrides = View.SetCategoryOverrides(view=activeViewFromCurrentDocument, category=subcategories@L2, overrides=byProperties@L2)
