# Dynamo graph Set Viewport Locations from First.dyn (Dynamo 2.0.3.8810)

view_type = ViewTypesUi(index=6)
getByType = archilab.Revit.Views.Views.GetByType(viewType=view_type)
n1_view_ordering_parameter_to = StringInput("Sheet Series")  # "1. View ordering parameter to edit E.G "View Series""; graph input
getParameterValueByName = Element.GetParameterValueByName(element=getByType, parameterName=n1_view_ordering_parameter_to)
n2_view_series_to_copy = StringInput("4100 Door Component Drawings")  # "2. View Series to Copy"; graph input
eq = getParameterValueByName == n2_view_series_to_copy
filterByBoolMask = List.FilterByBoolMask(list=getByType, mask=eq)
getViewportsAndViews = Rhythm.Revit.Elements.Sheet.GetViewportsAndViews(sheet=filterByBoolMask.in)
code_block = CodeBlock(x=getViewportsAndViews.viewports) { x; }
flatten = List.Flatten(list=code_block)
firstItem = List.FirstItem(list=flatten)
restOfItems = List.RestOfItems(list=flatten)
setLocationBasedOnOther = Rhythm.Revit.Elements.Viewport.SetLocationBasedOnOther(parentViewport=firstItem, childViewports=restOfItems)
code_block_2 = CodeBlock { 1; }
dropItems = List.DropItems(list=filterByBoolMask.in, amount=code_block_2)
