# Dynamo graph SheetCreator-2.01.dyn (Dynamo 2.0.2.6826)

# group: Gets All Views
# note: This graph takes a list of views, creates sheets (numbered sequentially from starting number), puts the views on the sheets (named by view) at a consistant location.
# The user must complete all the required fields for drawing titles and ordering
# Make sure that views definitely fit on the sheets, if a section overlaps the edge, or if the view is just a bit too close to the edge it will fail.  Consider putting the scale up a size just for this exercise.
# Make sure that the parameter names in the graph match those of your project... Sheet Series and Zone Code vary between templates.  Some title blocks have Checked By, these didn't.
# No need to edit inputs, just run the graph and they will be prompted from you
categories = Categories(index=602)
all_elements_of_category = ElementsOfCategory(Category=categories)

# group: Filters Views to get rid of nulls and view templates
code_block = CodeBlock { null; }
eq = all_elements_of_category == code_block
filterByBoolMask = List.FilterByBoolMask(list=all_elements_of_category, mask=eq)
isViewTemplate = View.IsViewTemplate(view=filterByBoolMask.out)
filterByBoolMask_2 = List.FilterByBoolMask(list=filterByBoolMask.out, mask=isViewTemplate)

# group: Makes sure that annotation crop and crop view are checked... Filters views which don't have these parameters
code_block_2 = CodeBlock { "Annotation Crop"; true; }
parameterExists = Custom[Element.ParameterExists](param=code_block_2.out0, element=filterByBoolMask_2.out)  # Checks if an element contains a parameter of a given name
filterByBoolMask_3 = List.FilterByBoolMask(list=filterByBoolMask_2.out, mask=parameterExists)
setParameterByName = Element.SetParameterByName(element=filterByBoolMask_3.in, parameterName=code_block_2.out0, value=code_block_2.out1)
code_block_3 = CodeBlock { "Crop View"; true; }
parameterExists_2 = Custom[Element.ParameterExists](param=code_block_3.out0, element=setParameterByName)
filterByBoolMask_4 = List.FilterByBoolMask(list=setParameterByName, mask=parameterExists_2)
setParameterByName_2 = Element.SetParameterByName(element=filterByBoolMask_4.in, parameterName=code_block_3.out0, value=code_block_3.out1)

code_block_4 = CodeBlock(x=setParameterByName_2) { x; }

# group: Creates GUI for View Selection
code_block_5 = CodeBlock { "Select Views"; }
code_block_6 = CodeBlock { 400; }
boolean = BoolSelector(true)
boolean_2 = BoolSelector(false)
ui_listview_data = Custom[UI.Listview Data](InputName=code_block_5, Keys=code_block_4, Values=code_block_4, Height_optionnal=code_block_6, ShowElementCount_optionnal=boolean, ShowId_optionnal=boolean_2)  # Create data for ListView input in UI.MultiInputForm ++ . Check out www.data-shapes.net for more infos.

# group: SHEET TEMPLATE
code_block_7 = CodeBlock { "SHEET TEMPLATE"; }
categories_2 = Categories(index=586)
all_elements_of_category_2 = ElementsOfCategory(Category=categories_2)
code_block_8 = CodeBlock(t=all_elements_of_category_2) { t.Name; }
code_block_9 = CodeBlock { 1; }
ui_dropdown_data = Custom[UI.DropDown Data](InputName=code_block_7, Keys=code_block_8, Values=all_elements_of_category_2, DefaultValueIndex=code_block_9)  # Create data for DropDown input in UI.MultiInputForm ++ . Check out www.data-shapes.net for more infos.

# group: SHEET STARTING NUMBER
code_block_10 = CodeBlock { "SHEET STARTING NUMBER"; }
code_block_11 = CodeBlock { "2001"; }
ui_textbox_data = Custom[UI.TextBox Data](InputName=code_block_10, DefaultText=code_block_11)  # Create Data for TextBox input in UI.MultipleInputForm ++ . Check out www.data-shapes.net for more informations

# group: SHEET SERIES
code_block_12 = CodeBlock { "SHEET SERIES"; }
categories_3 = Categories(index=447)
all_elements_of_category_3 = ElementsOfCategory(Category=categories_3)
code_block_13 = CodeBlock { "Sheet Series"; }
getParameterValueByName = Element.GetParameterValueByName(element=all_elements_of_category_3, parameterName=code_block_13)
uniqueItems = List.UniqueItems(list=getParameterValueByName)
code_block_14 = CodeBlock { 1; }
ui_dropdown_data_2 = Custom[UI.DropDown Data](InputName=code_block_12, Keys=uniqueItems, Values=uniqueItems, DefaultValueIndex=code_block_14)

# group: ORIGINATING OFFICE
code_block_15 = CodeBlock { "Originating Office"; }
code_block_16 = CodeBlock { "HTA Edinburgh"; }
ui_textbox_data_2 = Custom[UI.TextBox Data](InputName=code_block_15, DefaultText=code_block_16)

# group: DRAWN BY
code_block_17 = CodeBlock { "Drawn By"; }
code_block_18 = CodeBlock { "XXX"; }
ui_textbox_data_3 = Custom[UI.TextBox Data](InputName=code_block_17, DefaultText=code_block_18)

# group: DOCUMENT TYPE
code_block_19 = CodeBlock { "BS Document Type"; }
code_block_20 = CodeBlock { "DR"; }
ui_textbox_data_4 = Custom[UI.TextBox Data](InputName=code_block_19, DefaultText=code_block_20)

code_block_21 = CodeBlock { "Zone Code B"; }

# group: ZONE CODE B
code_block_22 = CodeBlock { "Building Zone"; }
code_block_23 = CodeBlock { "A3"; }
ui_textbox_data_5 = Custom[UI.TextBox Data](InputName=code_block_21, DefaultText=code_block_23)

# group: FORMING GUI
code_block_24 = CodeBlock { "Select Views for Sheets"; }
file_path = Filename(".\COM-DER_HTA-A_A3-XX_M3_Site_Mark-Ackerley-htalogo35mmx35mm-blk-2827346.jpg")
list_create = List.Create(item0=ui_listview_data, item1=ui_dropdown_data, item2=ui_textbox_data, item3=ui_dropdown_data_2, item4=ui_textbox_data_2, item5=ui_textbox_data_3, item6=ui_textbox_data_4, item7=ui_textbox_data_5)
boolean_3 = BoolSelector(true)
code_block_25 = CodeBlock { "Cancel"; }
code_block_26 = CodeBlock { 800; }
ui_multipleinputform = Custom[UI.MultipleInputForm ++](Description_optional=code_block_24, Logo_optional=file_path, Inputs=list_create, Toggle=boolean_3, CancelButtonText_optional=code_block_25, Width_optional=code_block_26)  # Create a form with multiple inputs. see www.data-shapes.net for tutorials and infos!

code_block_27 = CodeBlock(x=ui_multipleinputform.User_Inputs)
# ---------- code_block_27.designscript (8 lines) ----------
_views=x[0];
_titleBBlock=x[1];
_startingNumber=x[2];
_sheetseries=x[3];
_originatingoffice=x[4];
_drawnby=x[5];
_documenttype=x[6];
_zone=x[7];
# ----------------------------------------

# group: Sheet name as view name
name = Custom[Element.Name+](element=code_block_27._views)  # Gets an element's name. Unlike the OOTB node, this node should work for all Revit elements that have names and will also return the localized names of system parameters, parameter groups, display unit types, parameter types, unit symbol types and unit types.

toNumber = String.ToNumber(str=code_block_27._startingNumber)

# group: CREATES SHEET NUMBER
count = List.Count(list=code_block_27._views@L2)

code_block_28 = CodeBlock { 1; }
sub = count - code_block_28

# group (continued): CREATES SHEET NUMBER
add = toNumber + sub
code_block_29 = CodeBlock(A=toNumber, C=add) { A..C; }
flatten = List.Flatten(list=code_block_29)

string_from_object = FromObject(obj=flatten)

# group: title block
getType = WombatDynamo.Element.GetType(element=code_block_27._titleBBlock)

# group: Creates Sheet
byNameNumberTitleBlockAndView = Sheet.ByNameNumberTitleBlockAndView(sheetName=name, sheetNumber=string_from_object, titleBlockFamilyType=getType, view=code_block_27._views)

sheet_series = CodeBlock(x=code_block_13) { x; }
originating_office = CodeBlock(x=code_block_15) { x; }
originating_office_2 = CodeBlock(x=code_block_27._originatingoffice) { x; }
drawn_by = CodeBlock(x=code_block_17) { x; }
drawn_by_2 = CodeBlock(x=code_block_27._drawnby) { x; }
bs_document_type = CodeBlock(x=code_block_19) { x; }
document_type = CodeBlock(x=code_block_27._documenttype) { x; }
zone_code_b = CodeBlock(x=code_block_21) { x; }
zone = CodeBlock(x=code_block_27._zone) { x; }

# group: Sets Sheet Parameters after creation
setParameterByName_3 = Element.SetParameterByName(element=byNameNumberTitleBlockAndView, parameterName=sheet_series, value=code_block_27._sheetseries)
originating_office_3 = CodeBlock(x=originating_office) { x; }
originating_office_4 = CodeBlock(x=originating_office_2) { x; }
setParameterByName_4 = Element.SetParameterByName(element=setParameterByName_3, parameterName=originating_office_3, value=originating_office_4)
drawn_by_3 = CodeBlock(x=drawn_by) { x; }
drawn_by_4 = CodeBlock(x=drawn_by_2) { x; }
setParameterByName_5 = Element.SetParameterByName(element=setParameterByName_4, parameterName=drawn_by_3, value=drawn_by_4)
bs_document_type_2 = CodeBlock(x=bs_document_type) { x; }
document_type_2 = CodeBlock(x=document_type) { x; }
setParameterByName_6 = Element.SetParameterByName(element=setParameterByName_5, parameterName=bs_document_type_2, value=document_type_2)
zone_code_b_2 = CodeBlock(x=zone_code_b) { x; }
zone_2 = CodeBlock(x=zone) { x; }
setParameterByName_7 = Element.SetParameterByName(element=setParameterByName_6, parameterName=zone_code_b_2, value=zone_2)
