# Dynamo graph TacoHolder-2.dyn (Dynamo 2.1.0.5784)

code_block = CodeBlock()
# ---------- code_block.designscript (2 lines) ----------
a = (0..4..#3);
NurbsCurve.ByControlPoints((DSCore.List.Flatten(DesignScript.Geometry.Point.ByCoordinates(a<1>, a<2>, a<3>), -1)));
# ----------------------------------------
code_block_2 = CodeBlock { 0; }
byCoordinates = Point.ByCoordinates(x=code_block_2, y=code_block_2, z=code_block_2)
number_slider = DoubleSlider(1.8, range=0..5 step 0.1)
translate = Geometry.Translate(geometry=byCoordinates, xTranslation=number_slider)
code_block_3 = CodeBlock(p=number_slider) { p*-1; }
translate_2 = Geometry.Translate(geometry=byCoordinates, xTranslation=code_block_3)
byStartPointEndPoint = Line.ByStartPointEndPoint(startPoint=translate, endPoint=translate_2)
translate_3 = Geometry.Translate(geometry=byStartPointEndPoint, zTranslation=code_block_3)
byCenterPointRadius = Circle.ByCenterPointRadius(centerPoint=byCoordinates, radius=number_slider)
split = Geometry.Split(geometry=byCenterPointRadius, other=byStartPointEndPoint)
byLoft = Surface.ByLoft(crossSections=split, guideCurves=byStartPointEndPoint)
pointAtParameter = Surface.PointAtParameter()  # unwired: surface
byLoft_2 = Surface.ByLoft()  # unwired: crossSections
code_block_4 = CodeBlock(a=split) { a[0]; }
code_block_5 = CodeBlock(a=split) { a[1]; }
translate_4 = Geometry.Translate(geometry=byCoordinates, yTranslation=number_slider)
translate_5 = Geometry.Translate(geometry=byCoordinates, zTranslation=code_block_3)
translate_6 = Geometry.Translate(geometry=byCoordinates, yTranslation=code_block_3)
list_create = List.Create(item0=translate_4, item1=translate_5, item2=translate_6)
flatten = List.Flatten(list=list_create)
byPoints = NurbsCurve.ByPoints(points=flatten)
list_create_2 = List.Create(item0=code_block_4, item1=code_block_5, item2=byPoints)
flatten_2 = List.Flatten(list=list_create_2)
byRuledLoft = Surface.ByRuledLoft(crossSections=flatten_2)
bySweep = Surface.BySweep(profile=byPoints, path=byCenterPointRadius)
