# Dynamo graph TopoToFloor.dyn (Dynamo 1.3.2.2480)

# group: HI!
# note: This graph finds all the building pads in the project and creates a floor object.
# The floor object can then be hatched to create plans.
# You wouldn't want to do this with a topo because the resultant floor cannot hide the triangulation edges

categories = Categories("BuildingPad")
all_elements_of_category = ElementsOfCategory(categories)
solids = Element.Solids(all_elements_of_category)
flatten = Flatten(solids)
categories_2 = Categories("Floors")
floor_names = CodeBlock { "SiteFloor"; }
start_number = CodeBlock { 1; }
count = Count(solids)
range = Range(start=start_number, end=count, step=start_number, lacing=Longest)
joins_names_to_quantity = CodeBlock(x=floor_names, y=range) { x + y; }
byGeometry = Custom[Springs.DirectShape.ByGeometry](geometry=flatten, category=categories_2, name=joins_names_to_quantity)  # Convert the input geometry to DirectShape element inside the Revit document. It supports solids or surfaces. It is based on an alternative process that uses a SAT import and can produce smooth surfaces. Each created DS will have a unique type. Make sure that each input geometry has a unique name. You can either feed a single category for all geometries or a unique category for each geometry - the node's lacing is set to longest by default. The default category is Generic Models.
