# Dynamo graph View Copy & Rename.dyn (Dynamo 2.0.3.8810)

code_block = CodeBlock { "Views"; }
# note: Schedules seem to include revisions which have < at the beginning of their name, this upsets Revit and the graph fails
byName = Category.ByName(name=code_block)
all_elements_of_category = ElementsOfCategory(Category=byName)
boolean = BoolSelector(false)
clean = List.Clean(list=all_elements_of_category, preserveIndices=boolean)
isViewTemplate = View.IsViewTemplate(view=clean)
# note: Gets all views
filterByBoolMask = List.FilterByBoolMask(list=clean, mask=isViewTemplate)
n1_view_ordering_parameter_to = StringInput("View Series")  # "1. View ordering parameter to edit E.G "View Series""; graph input
getParameterValueByName = Element.GetParameterValueByName(element=filterByBoolMask.out, parameterName=n1_view_ordering_parameter_to)
n2_view_series_to_copy = StringInput("2000 GA Plans")  # "2. View Series to Copy"; graph input
eq = getParameterValueByName == n2_view_series_to_copy
filterByBoolMask_2 = List.FilterByBoolMask(list=filterByBoolMask.out, mask=eq)
name = Element.Name(element=filterByBoolMask_2.in)
n2a_secondary_filter_name = StringInput("Plan")  # "2a. Secondary Filter - Name Contains"; graph input
contains = String.Contains(str=name, searchFor=n2a_secondary_filter_name)
filterByBoolMask_3 = List.FilterByBoolMask(list=filterByBoolMask_2.in, mask=contains)
name_2 = Element.Name(element=filterByBoolMask_3.in)
n3_part_of_view_name_to_be = StringInput("Plan")  # "3. Part of View Name to be Replaced"; graph input
n4_new_part_of_view_name = StringInput("Rooms")  # "4. new part of View Name"; graph input
replace = String.Replace(str=name_2, searchFor=n3_part_of_view_name_to_be, replaceWith=n4_new_part_of_view_name)
view_duplicate_option = ViewDuplicateOption(index=0)
duplicate = Orchid.RevitProject.Views.View.Duplicate(view=filterByBoolMask_3.in, name=replace, option=view_duplicate_option)
flatten = List.Flatten(list=duplicate)
n6_new_view_template_if_desired = StringInput("")  # "6. new View Template, if desired"; graph input
apply_viewtemplate = Custom[Apply ViewTemplate](Views=flatten, TempNames=n6_new_view_template_if_desired)  # Apply ViewTemplate(s) to selected view(s).
setNone = Orchid.RevitProject.Views.ViewTemplate.SetNone(view=flatten)
n5_view_template_desired = BoolSelector(false)  # "5. View Template Desired?"; graph input
code_block_2 = CodeBlock(a=apply_viewtemplate, b=setNone, x=n5_view_template_desired) { choice = [a,b]; choice[x ? 0 :1]; }
code_block_3 = CodeBlock { "View Series"; }
n7_new_view_series_if_desired_may = StringInput("_Working Rooms")  # "7. new View Series (if desired) (may be overriden by View Template)"; graph input
setParameterByName = Element.SetParameterByName(element=code_block_2.out1, parameterName=code_block_3, value=n7_new_view_series_if_desired_may)
code_block_4 = CodeBlock()  # //Modelico
view_series_parameter = CodeBlock(x=n1_view_ordering_parameter_to) { x; }
