# Dynamo graph Warnings.dyn (Dynamo 2.0.3.8810)

# group: Get User Desktop Path
python_script = Python()
# ---------- python_script.python (11 lines) ----------
import clr
import sys
sys.path.append("C:\Program Files (x86)\IronPython 2.7\Lib")

from os import path
import os
desktop = os.path.join(os.path.join(os.environ['USERPROFILE']), 'Desktop')

#user = os.environ.get('USERNAME')

OUT = desktop, #user
# ----------------------------------------

# group: Get Project File Name
python_script_2 = Python()
# ---------- python_script_2.python (11 lines) ----------
import clr
clr.AddReference('RevitServices')
from RevitServices.Persistence import DocumentManager

doc = DocumentManager.Instance.CurrentDBDocument
title = doc.Title
#the doc title for the html cuts off after the first .
docTitle = title.split('.')[0]
pathName = doc.PathName.split('.')[0]

OUT = docTitle, pathName.encode('string-escape')
# ----------------------------------------

# group: Export your warnings html to your desktop, this should pick up the path. It is more reliable than extracting warnings from revit with the API, sometimes that misses some
code_block = CodeBlock(x=python_script, z=python_script_2) { x[0] + "\\" + z[0] + ".html"; }
boolean = BoolSelector(true)
parse = Custom[Springs.ErrorReport.Parse](report=code_block, fetch_elements=boolean)  # Process a Revit error report (HTML file) and extract the error types, all affected elements and the total number of errors. If you are executing from a document different than the one the error report belongs to, be sure to set "fetch_elements" to false.

code_block_2 = CodeBlock(x=parse.error_messages) { x; }
code_block_3 = CodeBlock(x=parse.affected_elements) { x; }

# group: Sort and group warnings
code_block_4 = CodeBlock { 1; }
chop = List.Chop(list=code_block_2, lengths=code_block_4)
addItemToFront = List.AddItemToFront(item=chop@L2, list=code_block_3@L2)
code_block_5 = CodeBlock { 1; }
flatten = List.Flatten(amt=code_block_5)  # unwired: list
map = List.Map(list=addItemToFront, f_x=flatten)
code_block_6 = CodeBlock(x=code_block_2) { x; }
code_block_7 = CodeBlock(x=code_block_6) { x; }
sortByKey = List.SortByKey(list=map, keys=code_block_7)
code_block_8 = CodeBlock(x=sortByKey.sorted_list) { x; }
code_block_9 = CodeBlock(x=code_block_7) { x; }
groupByKey = List.GroupByKey(list=code_block_8, keys=code_block_9)
restOfItems = List.RestOfItems(list=groupByKey.groups@L2)
firstItem = List.FirstItem(list=groupByKey.groups@L2)

code_block_10 = CodeBlock(x=restOfItems) { x; }
code_block_11 = CodeBlock(x=firstItem) { x; }

# group: Filter by duplicate Number
string = StringInput("duplicate \"Number\"")
contains = String.Contains(str=code_block_11, searchFor=string)
filterByBoolMask = List.FilterByBoolMask(list=code_block_10, mask=contains)
filterByBoolMask_2 = List.FilterByBoolMask(list=code_block_11, mask=contains)

# group: Filter by duplicate Type Mark
string_2 = StringInput("duplicate \"Type Mark\"")
contains_2 = String.Contains(str=filterByBoolMask_2.out, searchFor=string_2)
filterByBoolMask_3 = List.FilterByBoolMask(list=filterByBoolMask.out, mask=contains_2)
filterByBoolMask_4 = List.FilterByBoolMask(list=filterByBoolMask_2.out, mask=contains_2)

# group: Could not create Wall Sweep
string_3 = StringInput("Could not create Wall Sweep")
contains_3 = String.Contains(str=filterByBoolMask_4.out, searchFor=string_3)
filterByBoolMask_5 = List.FilterByBoolMask(list=filterByBoolMask_3.out, mask=contains_3)
filterByBoolMask_6 = List.FilterByBoolMask(list=filterByBoolMask_4.out, mask=contains_3)

# group: Joined but don't intersect
string_4 = StringInput("elements are joined but do not intersect")
contains_4 = String.Contains(str=filterByBoolMask_6.out, searchFor=string_4)
filterByBoolMask_7 = List.FilterByBoolMask(list=filterByBoolMask_5.out, mask=contains_4)
filterByBoolMask_8 = List.FilterByBoolMask(list=filterByBoolMask_6.out, mask=contains_4)

# group: Joined but don't intersect
joined_but_don_t_intersect = Watch(filterByBoolMask_7.in)  # graph output

# group: Run it
unjoin_elements = BoolSelector(true)  # graph input
code_block_12 = CodeBlock { "Set Run to True"; }
if_ = If(test=unjoin_elements, true=joined_but_don_t_intersect, false=code_block_12)

# group: Unjoin
code_block_13 = CodeBlock { 0; }
getItemAtIndex = List.GetItemAtIndex(list=if_@L2, index=code_block_13)
code_block_14 = CodeBlock { 1; }
getItemAtIndex_2 = List.GetItemAtIndex(list=if_@L2, index=code_block_14)
# note: Custom Node: spring nodes v.132.2.7
unjoin = Custom[Springs.Element.Unjoin](firstElement=getItemAtIndex, secondElement=getItemAtIndex_2)  # Unjoins the element(s) in the second list from the primary input element.

# group: Get Warnings
boolean_2 = BoolSelector(false)
# note: Custom Node: Bang v.2019.3.1
getWarnings = Bang.Revit.Elements.WarningTools.GetWarnings(toggle=boolean_2)

# group: Duplicate Room Numbers
duplicate_room_numbers = Watch(filterByBoolMask.in)  # graph output

# group: Run it
run_new_room_numbers = BoolSelector(true)  # graph input
code_block_15 = CodeBlock { "Set Run to True"; }
if_2 = If(test=run_new_room_numbers, true=duplicate_room_numbers, false=code_block_15)

# group: Give Rooms New Numbers
code_block_16 = CodeBlock { 0; }
getItemAtIndex_3 = List.GetItemAtIndex(list=if_2@L2, index=code_block_16)
string_5 = StringInput("Room Name")
count = List.Count(list=getItemAtIndex_3)
code_block_17 = CodeBlock(x=count) { "Review " + (1..x); }
setParameterByName = Element.SetParameterByName(element=getItemAtIndex_3, parameterName=string_5, value=code_block_17)

python_script_3 = Python(IN[0]=firstItem)  # frozen
# ---------- python_script_3.python (7 lines) ----------
output = []
mid = []
for x in IN[0]:
    if x not in mid:
        mid.append(x)

OUT = mid
# ----------------------------------------
python_script_4 = Python()  # frozen; unwired: IN[0], IN[1]
# ---------- python_script_4.python (33 lines) ----------
output = []
warningText = IN[0]
elements = IN[1]

#we want a list of the unique warnings we're getting
uniqueWT = []
for x in warningText:
    if x not in uniqueWT:
        uniqueWT.append(x)


#we need to find out how many of each warning there are... this returns the count each time we query it
countElementsGroup = []
i = 0
while i < len(warningText):
    countElementsGroup.append(warningText.count(warningText[i]))
    i = i +1

#this prunes out the duplicates in the previous list, one count for each
uniqueElementsGroups = []
i = 1
while i < len(countElementsGroup):
    if countElementsGroup[i] > 1:
        del(countElementsGroup[i:countElementsGroup[i]+1])
    i = i + 1

#we want to make a sub list for the warnings of each type
#for wT, E in zip(warningText, elements):
 #   if uniqueWT == warningText[i]:
  #     if wT not in output:
    #        output.append(x)

OUT = countElementsGroup
# ----------------------------------------
python_script_5 = Python()  # frozen; unwired: IN[0], IN[1]
# ---------- python_script_5.python (27 lines) ----------
output = []
warningText = IN[0]
elements = IN[1]

#we want a list of the unique warnings we're getting
uniqueWT = []
for x in warningText:
    if x not in uniqueWT:
        uniqueWT.append(x)


#we need to find out how many of each warning there are... this returns the count each time we query it
countElementsGroup = []
i = 0
while i < len(warningText):
    countElementsGroup.append(warningText.count(warningText[i]))
    i = i +1



#we want to make a sub list for the warnings of each type
#for wT, E in zip(warningText, elements):
 #   if uniqueWT == warningText[i]:
  #     if wT not in output:
    #        output.append(x)

OUT = countElementsGroup
# ----------------------------------------

# group: Extents greater than 20 miles
string_6 = StringInput("extents greater than 20 miles")
contains_5 = String.Contains(str=filterByBoolMask_8.out, searchFor=string_6)
filterByBoolMask_9 = List.FilterByBoolMask(list=filterByBoolMask_8.out, mask=contains_5)
filterByBoolMask_10 = List.FilterByBoolMask(list=filterByBoolMask_7.out, mask=contains_5)

# group: Wall and a room separation line overlap
string_7 = StringInput("wall and a room separation line overlap")
contains_6 = String.Contains(str=filterByBoolMask_9.out, searchFor=string_7)
filterByBoolMask_11 = List.FilterByBoolMask(list=filterByBoolMask_9.out, mask=contains_6)
filterByBoolMask_12 = List.FilterByBoolMask(list=filterByBoolMask_10.out, mask=contains_6)

# group: Wall is slightly off axis
string_8 = StringInput("Wall is slightly off axis")
contains_7 = String.Contains(str=filterByBoolMask_11.out, searchFor=string_8)
filterByBoolMask_13 = List.FilterByBoolMask(list=filterByBoolMask_11.out, mask=contains_7)
filterByBoolMask_14 = List.FilterByBoolMask(list=filterByBoolMask_12.out, mask=contains_7)

# group: Line in Sketch is slightly off axis
string_9 = StringInput("Line in Sketch is slightly off axis")
contains_8 = String.Contains(str=filterByBoolMask_13.out, searchFor=string_9)
filterByBoolMask_15 = List.FilterByBoolMask(list=filterByBoolMask_13.out, mask=contains_8)
filterByBoolMask_16 = List.FilterByBoolMask(list=filterByBoolMask_14.out, mask=contains_8)

# group: Line is slightly off axis
string_10 = StringInput("Line is slightly off axis")
contains_9 = String.Contains(str=filterByBoolMask_15.out, searchFor=string_10)
filterByBoolMask_17 = List.FilterByBoolMask(list=filterByBoolMask_15.out, mask=contains_9)
filterByBoolMask_18 = List.FilterByBoolMask(list=filterByBoolMask_16.out, mask=contains_9)

# group: Highlighted floors overlap
string_11 = StringInput("Highlighted floors overlap")
contains_10 = String.Contains(str=filterByBoolMask_17.out, searchFor=string_11)
filterByBoolMask_19 = List.FilterByBoolMask(list=filterByBoolMask_17.out, mask=contains_10)
filterByBoolMask_20 = List.FilterByBoolMask(list=filterByBoolMask_18.out, mask=contains_10)

# group: Room separation lines overlap
string_12 = StringInput("room separation lines overlap")
contains_11 = String.Contains(str=filterByBoolMask_19.out, searchFor=string_12)
filterByBoolMask_21 = List.FilterByBoolMask(list=filterByBoolMask_19.out, mask=contains_11)
filterByBoolMask_22 = List.FilterByBoolMask(list=filterByBoolMask_20.out, mask=contains_11)

# group: Walls overlap
string_13 = StringInput("walls overlap")
contains_12 = String.Contains(str=filterByBoolMask_21.out, searchFor=string_13)
filterByBoolMask_23 = List.FilterByBoolMask(list=filterByBoolMask_21.out, mask=contains_12)
filterByBoolMask_24 = List.FilterByBoolMask(list=filterByBoolMask_22.out, mask=contains_12)

# group: Insert conflicts with joined wall
string_14 = StringInput("Insert conflicts with joined Wall")
contains_13 = String.Contains(str=filterByBoolMask_23.out, searchFor=string_14)
filterByBoolMask_25 = List.FilterByBoolMask(list=filterByBoolMask_23.out, mask=contains_13)
filterByBoolMask_26 = List.FilterByBoolMask(list=filterByBoolMask_24.out, mask=contains_13)

# group: Elements have duplicate "Mark" values
string_15 = StringInput("Elements have duplicate \"Mark\" values")
contains_14 = String.Contains(str=filterByBoolMask_25.out, searchFor=string_15)
filterByBoolMask_27 = List.FilterByBoolMask(list=filterByBoolMask_25.out, mask=contains_14)
filterByBoolMask_28 = List.FilterByBoolMask(list=filterByBoolMask_26.out, mask=contains_14)

# group: Multiple Rooms are in the same enclosed region
string_16 = StringInput("Multiple Rooms are in the same enclosed region")
contains_15 = String.Contains(str=filterByBoolMask_27.out, searchFor=string_16)
filterByBoolMask_29 = List.FilterByBoolMask(list=filterByBoolMask_27.out, mask=contains_15)
filterByBoolMask_30 = List.FilterByBoolMask(list=filterByBoolMask_28.out, mask=contains_15)

# group: One element is completely inside another
string_17 = StringInput("One element is completely inside another")
contains_16 = String.Contains(str=filterByBoolMask_29.out, searchFor=string_17)
filterByBoolMask_31 = List.FilterByBoolMask(list=filterByBoolMask_29.out, mask=contains_16)
filterByBoolMask_32 = List.FilterByBoolMask(list=filterByBoolMask_30.out, mask=contains_16)

# group: Ref Plane is slightly off axis
string_18 = StringInput("Ref Plane is slightly off axis")
contains_17 = String.Contains(str=filterByBoolMask_31.out, searchFor=string_18)
filterByBoolMask_33 = List.FilterByBoolMask(list=filterByBoolMask_31.out, mask=contains_17)
filterByBoolMask_34 = List.FilterByBoolMask(list=filterByBoolMask_32.out, mask=contains_17)

# group: The rail is not continuous
string_19 = StringInput("The rail is not continuous")
contains_18 = String.Contains(str=filterByBoolMask_33.out, searchFor=string_19)
filterByBoolMask_35 = List.FilterByBoolMask(list=filterByBoolMask_33.out, mask=contains_18)
filterByBoolMask_36 = List.FilterByBoolMask(list=filterByBoolMask_34.out, mask=contains_18)

# group: There are identical instances in the same place
string_20 = StringInput("There are identical instances in the same place")
contains_19 = String.Contains(str=filterByBoolMask_35.out, searchFor=string_20)
filterByBoolMask_37 = List.FilterByBoolMask(list=filterByBoolMask_35.out, mask=contains_19)
filterByBoolMask_38 = List.FilterByBoolMask(list=filterByBoolMask_36.out, mask=contains_19)

# group: Room is not in a properly enclosed region
string_21 = StringInput("Room is not in a properly enclosed region")
contains_20 = String.Contains(str=filterByBoolMask_37.out, searchFor=string_21)
filterByBoolMask_39 = List.FilterByBoolMask(list=filterByBoolMask_37.out, mask=contains_20)
filterByBoolMask_40 = List.FilterByBoolMask(list=filterByBoolMask_38.out, mask=contains_20)

# group: Stair end exceeds or cannot reach the elevation of the stair
string_22 = StringInput("end exceeds or cannot reach ")
contains_21 = String.Contains(str=filterByBoolMask_39.out, searchFor=string_22)
filterByBoolMask_41 = List.FilterByBoolMask(list=filterByBoolMask_39.out, mask=contains_21)
filterByBoolMask_42 = List.FilterByBoolMask(list=filterByBoolMask_40.out, mask=contains_21)

# group: Two elements were not automatically joined
string_23 = StringInput("Two elements were not automatically joined ")
contains_22 = String.Contains(str=filterByBoolMask_41.out, searchFor=string_23)
filterByBoolMask_43 = List.FilterByBoolMask(list=filterByBoolMask_41.out, mask=contains_22)
filterByBoolMask_44 = List.FilterByBoolMask(list=filterByBoolMask_42.out, mask=contains_22)

uniqueItems = List.UniqueItems(list=filterByBoolMask_43.out)

# group: Remaining Warnings
remaining_warnings = Watch(uniqueItems)  # graph output

# group: Duplicate Type Mark
duplicate_type_mark = Watch(filterByBoolMask_3.in)  # graph output

# group: Run it
give_new_type_marks = BoolSelector(true)  # graph input
code_block_18 = CodeBlock { "Set Run to True"; }
if_3 = If(test=give_new_type_marks, true=duplicate_type_mark, false=code_block_18)

# group: Give New Type Marks
code_block_19 = CodeBlock { 0; }
getItemAtIndex_4 = List.GetItemAtIndex(list=if_3@L2, index=code_block_19)
string_24 = StringInput("Type Mark")
count_2 = List.Count(list=getItemAtIndex_4)
code_block_20 = CodeBlock(x=count_2) { "Review " + (1..x); }
setParameterByName_2 = Element.SetParameterByName(element=getItemAtIndex_4, parameterName=string_24, value=code_block_20)

# group: Could not create Wall Sweep
could_not_create_wall_sweep = Watch(filterByBoolMask_5.in)  # graph output

# group: Run it
give_new_type_marks_2 = BoolSelector(false)  # graph input
code_block_21 = CodeBlock { "Set Run to True"; }
if_4 = If(test=give_new_type_marks_2, true=could_not_create_wall_sweep, false=code_block_21)

# group: Select
code_block_22 = CodeBlock { 0; }
getItemAtIndex_5 = List.GetItemAtIndex(list=if_4@L2, index=code_block_22)
boolean_3 = BoolSelector(false)
selectInRevit = Custom[Springs.SelectInRevit](element=getItemAtIndex_5, reset=boolean_3)  # Selects the input elements inside the Revit UI.

# group: Get CAD name
code_block_23 = CodeBlock { "Type Name"; }
getParameterValueByName = Element.GetParameterValueByName(element=filterByBoolMask_10.in, parameterName=code_block_23)
addItemToFront_2 = List.AddItemToFront(item=getParameterValueByName@L1, list=filterByBoolMask_10.in@L2)

# group: Extents greater than 20 miles
extents_greater_than_20_miles = Watch(addItemToFront_2)  # graph output

# group: Run it
select_dwgs_with_extents_greater = BoolSelector(false)  # "Select DWGs with extents greater than 20 miles"; graph input
code_block_24 = CodeBlock { "Set Run to True"; }
if_5 = If(test=select_dwgs_with_extents_greater, true=extents_greater_than_20_miles, false=code_block_24)

# group: Select
code_block_25 = CodeBlock { 0; }
getItemAtIndex_6 = List.GetItemAtIndex(list=if_5@L2, index=code_block_25)
boolean_4 = BoolSelector(false)
selectInRevit_2 = Custom[Springs.SelectInRevit](element=getItemAtIndex_6, reset=boolean_4)

# group: Wall and a room separation line overlap
wall_and_room_separation_line = Watch(filterByBoolMask_12.in)  # "Wall and room separation line overlap"; graph output

# group: Run it
select_wall_and_room_separation = BoolSelector(true)  # "Select Wall and room separation lines which overlap"; graph input
code_block_26 = CodeBlock { "Set Run to True"; }
if_6 = If(test=select_wall_and_room_separation, true=wall_and_room_separation_line, false=code_block_26)

# group: Select
code_block_27 = CodeBlock { 0; }
getItemAtIndex_7 = List.GetItemAtIndex(list=if_6@L2, index=code_block_27)
boolean_5 = BoolSelector(false)
selectInRevit_3 = Custom[Springs.SelectInRevit](element=getItemAtIndex_7, reset=boolean_5)

# group: Wall is slightly off axis
wall_is_slightly_off_axis = Watch(filterByBoolMask_14.in)  # graph output

# group: Run it
select_walls_off_axis = BoolSelector(true)  # graph input
code_block_28 = CodeBlock { "Set Run to True"; }
if_7 = If(test=select_walls_off_axis, true=wall_is_slightly_off_axis, false=code_block_28)

# group: Select
code_block_29 = CodeBlock { 0; }
getItemAtIndex_8 = List.GetItemAtIndex(list=if_7@L2, index=code_block_29)
boolean_6 = BoolSelector(false)
selectInRevit_4 = Custom[Springs.SelectInRevit](element=getItemAtIndex_8, reset=boolean_6)

# group: Line in Sketch is slightly off axis
line_in_sketch_is_slightly_off = Watch(filterByBoolMask_16.in)  # "Line in sketch is slightly off axis"; graph output

# group: Run it
select_line_in_sketch_off_axis = BoolSelector(false)  # graph input
code_block_30 = CodeBlock { "Set Run to True"; }
if_8 = If(test=select_line_in_sketch_off_axis, true=line_in_sketch_is_slightly_off, false=code_block_30)

# group: Select index 1, we want the host not the line
code_block_31 = CodeBlock { 1; }
getItemAtIndex_9 = List.GetItemAtIndex(list=if_8@L2, index=code_block_31)
boolean_7 = BoolSelector(false)
selectInRevit_5 = Custom[Springs.SelectInRevit](element=getItemAtIndex_9, reset=boolean_7)

# group: Line is slightly off axis
line_is_slightly_off_axis = Watch(filterByBoolMask_18.in)  # graph output

# group: Run it
select_line_is_off_axis = BoolSelector(false)  # graph input
code_block_32 = CodeBlock { "Set Run to True"; }
if_9 = If(test=select_line_is_off_axis, true=line_is_slightly_off_axis, false=code_block_32)

# group: Select
code_block_33 = CodeBlock { 0; }
getItemAtIndex_10 = List.GetItemAtIndex(list=if_9@L2, index=code_block_33)
boolean_8 = BoolSelector(false)
selectInRevit_6 = Custom[Springs.SelectInRevit](element=getItemAtIndex_10, reset=boolean_8)

# group: Highlighted floors overlap
highlighted_floors_overlap = Watch(filterByBoolMask_20.in)  # graph output

# group: Run it
select_overlapping_floors = BoolSelector(false)  # graph input
code_block_34 = CodeBlock { "Set Run to True"; }
if_10 = If(test=select_overlapping_floors, true=highlighted_floors_overlap, false=code_block_34)

# group: Select
flatten_2 = List.Flatten(list=if_10)
boolean_9 = BoolSelector(false)
selectInRevit_7 = Custom[Springs.SelectInRevit](element=flatten_2, reset=boolean_9)

# group: Alternative Selection Options
code_block_35 = CodeBlock(x=filterByBoolMask_22.in) { x; }
select_model_elements = DSModelElementsSelection()  # 1 picked in the model
code_block_36 = CodeBlock(x=select_model_elements) { [x]; }
select_model_element = DSModelElementSelection()  # 1 picked in the model
code_block_37 = CodeBlock(x=select_model_element) { [[x]]; }

# group: Add level that RS Line is on
python_script_6 = Python(IN[0]=code_block_35)
# ---------- python_script_6.python (7 lines) ----------
output = []
for modelLines in UnwrapElement(IN[0]):
    temp = []
    for modelLine in modelLines:
        temp.append([modelLine, modelLine.SketchPlane.Name])
    output.append(temp)
OUT = output
# ----------------------------------------

# group: Room separation lines overlap
room_separation_lines_overlap = Watch(python_script_6)  # graph output

# group: Run it
select_overlapping_room = BoolSelector(false)  # "Select overlapping room separation lines"; graph input
code_block_38 = CodeBlock { "Set Run to True"; }
if_11 = If(test=select_overlapping_room, true=room_separation_lines_overlap, false=code_block_38)

# group: Select
code_block_39 = CodeBlock { 0; }
getItemAtIndex_11 = List.GetItemAtIndex(list=if_11@L2, index=code_block_39)
boolean_10 = BoolSelector(false)
selectInRevit_8 = Custom[Springs.SelectInRevit](element=getItemAtIndex_11, reset=boolean_10)

# group: Walls overlap
walls_overlap = Watch(filterByBoolMask_24.in)  # graph output

# group: Run it
select_overlapping_walls = BoolSelector(true)  # graph input
code_block_40 = CodeBlock { "Set Run to True"; }
if_12 = If(test=select_overlapping_walls, true=walls_overlap, false=code_block_40)

# group: Select
code_block_41 = CodeBlock { 1; }
getItemAtIndex_12 = List.GetItemAtIndex(list=if_12, index=code_block_41)
boolean_11 = BoolSelector(false)
selectInRevit_9 = Custom[Springs.SelectInRevit](element=getItemAtIndex_12, reset=boolean_11)

# group: Insert conflicts with joined wall
insert_conflicts_with_joined = Watch(filterByBoolMask_26.in)  # "Insert conflicts with joined wall"; graph output

# group: Run it
select_insert_conflicts_with = BoolSelector(false)  # "Select insert conflicts with joined wall"; graph input
code_block_42 = CodeBlock { "Set Run to True"; }
if_13 = If(test=select_insert_conflicts_with, true=insert_conflicts_with_joined, false=code_block_42)

# group: Select
code_block_43 = CodeBlock { 0; }
getItemAtIndex_13 = List.GetItemAtIndex(list=if_13@L2, index=code_block_43)
boolean_12 = BoolSelector(false)
selectInRevit_10 = Custom[Springs.SelectInRevit](element=getItemAtIndex_13, reset=boolean_12)

# group: Elements have duplicate "Mark" values
elements_have_duplicate_mark = Watch(filterByBoolMask_28.in)  # "Elements have duplicate Mark values"; graph output

# group: Run it
give_new_mark_values_to_windows = BoolSelector(false)  # "Give new Mark values to windows and doors"; graph input
code_block_44 = CodeBlock { "Set Run to True"; }
if_14 = If(test=give_new_mark_values_to_windows, true=elements_have_duplicate_mark, false=code_block_44)

# group: Filter Marks by windows and doors
code_block_45 = CodeBlock { 0; }
getItemAtIndex_14 = List.GetItemAtIndex(list=if_14@L2, index=code_block_45)
getCategory = Element.GetCategory(element=getItemAtIndex_14)
string_from_object = FromObject(obj=getCategory)
code_block_46 = CodeBlock { "Doors"; "Windows"; }
eq = string_from_object == code_block_46.out0
filterByBoolMask_45 = List.FilterByBoolMask(list=if_14, mask=eq)
eq_2 = string_from_object == code_block_46.out1
filterByBoolMask_46 = List.FilterByBoolMask(list=if_14, mask=eq_2)

# group: Give Doors New Numbers
code_block_47 = CodeBlock { 0; }
getItemAtIndex_15 = List.GetItemAtIndex(list=filterByBoolMask_45.in@L2, index=code_block_47)
string_25 = StringInput("Door Number")
count_3 = List.Count(list=getItemAtIndex_15)
code_block_48 = CodeBlock(x=count_3) { "Review " + (1..x); }
setParameterByName_3 = Element.SetParameterByName(element=getItemAtIndex_15, parameterName=string_25, value=code_block_48)

# group: Give Windows New Numbers
code_block_49 = CodeBlock { 0; }
getItemAtIndex_16 = List.GetItemAtIndex(list=filterByBoolMask_46.in@L2, index=code_block_49)
string_26 = StringInput("Window Number")
count_4 = List.Count(list=getItemAtIndex_16)
code_block_50 = CodeBlock(x=count_4) { "Review " + (1..x); }
setParameterByName_4 = Element.SetParameterByName(element=getItemAtIndex_16, parameterName=string_26, value=code_block_50)

# group: Multiple Rooms are in the same enclosed region
multiple_rooms_are_in_the_same = Watch(filterByBoolMask_30.in)  # "Multiple rooms are in the same enclosed region"; graph output

# group: Run it
select_multiple_rooms_in_the = BoolSelector(false)  # "Select multiple rooms in the same region"; graph input
code_block_51 = CodeBlock { "Set Run to True"; }
if_15 = If(test=select_multiple_rooms_in_the, true=multiple_rooms_are_in_the_same, false=code_block_51)

# group: Select
code_block_52 = CodeBlock { 0; }
getItemAtIndex_17 = List.GetItemAtIndex(list=if_15@L2, index=code_block_52)
boolean_13 = BoolSelector(false)
selectInRevit_11 = Custom[Springs.SelectInRevit](element=getItemAtIndex_17, reset=boolean_13)  # frozen

# group: One element is completely inside another
one_element_is_completely_inside = Watch(filterByBoolMask_32.in)  # "One element is completely inside another"; graph output

# group: Run it
select_element_is_completely = BoolSelector(false)  # "Select element is completely inside another"; graph input
code_block_53 = CodeBlock { "Set Run to True"; }
if_16 = If(test=select_element_is_completely, true=one_element_is_completely_inside, false=code_block_53)

# group: Select
code_block_54 = CodeBlock { 0; }
getItemAtIndex_18 = List.GetItemAtIndex(list=if_16@L2, index=code_block_54)
boolean_14 = BoolSelector(false)
selectInRevit_12 = Custom[Springs.SelectInRevit](element=getItemAtIndex_18, reset=boolean_14)  # frozen

# group: Ref Plane is slightly off axis
ref_plan_is_slightly_off_axis = Watch(filterByBoolMask_34.in)  # graph output

# group: Run it
select_ref_plane_is_slightly_off = BoolSelector(false)  # "Select ref plane is slightly off axis"; graph input
code_block_55 = CodeBlock { "Set Run to True"; }
if_17 = If(test=select_ref_plane_is_slightly_off, true=ref_plan_is_slightly_off_axis, false=code_block_55)

# group: Select
code_block_56 = CodeBlock { 0; }
getItemAtIndex_19 = List.GetItemAtIndex(list=if_17@L2, index=code_block_56)
boolean_15 = BoolSelector(false)
selectInRevit_13 = Custom[Springs.SelectInRevit](element=getItemAtIndex_19, reset=boolean_15)

# group: The rail is not continuous
the_rail_is_not_continuous = Watch(filterByBoolMask_36.in)  # graph output

# group: Run it
select_rail_is_not_continuous = BoolSelector(false)  # graph input
code_block_57 = CodeBlock { "Set Run to True"; }
if_18 = If(test=select_rail_is_not_continuous, true=the_rail_is_not_continuous, false=code_block_57)

# group: Select
code_block_58 = CodeBlock { 0; }
getItemAtIndex_20 = List.GetItemAtIndex(list=if_18@L2, index=code_block_58)
boolean_16 = BoolSelector(false)
selectInRevit_14 = Custom[Springs.SelectInRevit](element=getItemAtIndex_20, reset=boolean_16)

# group: There are identical instances in the same place
there_are_identical_instances_in = Watch(filterByBoolMask_38.in)  # "There are identical instances in the same place"; graph output

# group: Run it
select_identical_instances_in = BoolSelector(false)  # "Select identical instances in the same place"; graph input
code_block_59 = CodeBlock { "Set Run to True"; }
if_19 = If(test=select_identical_instances_in, true=there_are_identical_instances_in, false=code_block_59)

# group: Select
code_block_60 = CodeBlock { 0; }
getItemAtIndex_21 = List.GetItemAtIndex(list=if_19@L2, index=code_block_60)
boolean_17 = BoolSelector(false)
selectInRevit_15 = Custom[Springs.SelectInRevit](element=getItemAtIndex_21, reset=boolean_17)

# group: Room is not in a properly enclosed region
room_is_not_in_a_properly = Watch(filterByBoolMask_40.in)  # "Room is not in a properly enclosed region"; graph output

# group: Run it
select_room_is_not_in_a_properly = BoolSelector(false)  # "Select room is not in a properly enclosed region"; graph input
code_block_61 = CodeBlock { "Set Run to True"; }
if_20 = If(test=select_room_is_not_in_a_properly, true=room_is_not_in_a_properly, false=code_block_61)

# group: Select
code_block_62 = CodeBlock { 0; }
getItemAtIndex_22 = List.GetItemAtIndex(list=if_20@L2, index=code_block_62)
boolean_18 = BoolSelector(false)
selectInRevit_16 = Custom[Springs.SelectInRevit](element=getItemAtIndex_22, reset=boolean_18)

# group: Stair end exceeds or cannot reach the elevation of the stair
stair_end_exceeds_or_cannot = Watch(filterByBoolMask_42.in)  # "Stair end exceeds or cannot reach the elevation of the stair"; graph output

# group: Run it
select_stair_ends_elevation = BoolSelector(false)  # graph input
code_block_63 = CodeBlock { "Set Run to True"; }
if_21 = If(test=select_stair_ends_elevation, true=stair_end_exceeds_or_cannot, false=code_block_63)

# group: Select
code_block_64 = CodeBlock { 0; }
getItemAtIndex_23 = List.GetItemAtIndex(list=if_21@L2, index=code_block_64)
boolean_19 = BoolSelector(false)
selectInRevit_17 = Custom[Springs.SelectInRevit](element=getItemAtIndex_23, reset=boolean_19)

# group: Two elements were not automatically joined
two_elements_were_not = Watch(filterByBoolMask_44.in)  # "Two elements were not automatically joined"; graph output

# group: Run it
select_two_elements_not_joined = BoolSelector(false)  # "Select two elements not joined automatically"; graph input
code_block_65 = CodeBlock { "Set Run to True"; }
if_22 = If(test=select_two_elements_not_joined, true=two_elements_were_not, false=code_block_65)

# group: Select
code_block_66 = CodeBlock { 0; }
getItemAtIndex_24 = List.GetItemAtIndex(list=if_22@L2, index=code_block_66)
boolean_20 = BoolSelector(false)
selectInRevit_18 = Custom[Springs.SelectInRevit](element=getItemAtIndex_24, reset=boolean_20)

# group: Warnings All Unique
uniqueItems_2 = List.UniqueItems(list=firstItem)
all_warnings = Watch(uniqueItems_2)  # graph output

# group: Use this if the html is to be saved with the project local file
current = Document.Current()
filePath = Document.FilePath(document=current)

# group: Isolate in view
activeViewFromCurrentDocument = Custom[Document.ActiveViewFromCurrentDocument]()  # Gets the active view of the current document; unwired: Refresh_true_var
isolate_in_view = Custom[Isolate in View](Element=flatten_2, View=activeViewFromCurrentDocument)  # This node will take input of elements and a view to isolate selected elements in a view.

# group: Isolate in view
isolate_refresh = BoolSelector(false)  # graph input
activeViewFromCurrentDocument_2 = Custom[Document.ActiveViewFromCurrentDocument](Refresh_true_var=isolate_refresh)
isolate_in_view_2 = Custom[Isolate in View](Element=getItemAtIndex_11, View=activeViewFromCurrentDocument_2)

# group: Get User Desktop Path
python_script_7 = Python()  # same code as python_script

# group: Get Project File Name
python_script_8 = Python()  # same code as python_script_2

# group: Yes this is a duplication, to allow the scope if to control whether this entire branch executes
code_block_67 = CodeBlock(x=python_script_7, z=python_script_8) { x[0] + "\\" + z[0] + ".html"; }

# group: Get location of current dyn
python_script_9 = Python()
# ---------- python_script_9.python (44 lines) ----------
"""
DYNAMOAPI: GET CURRENT WORKSPACE NAME
"""
__author__ = 'John Pierson - sixtysecondrevit@gmail.com'
__twitter__ = '@60secondrevit'
__github__ = '@sixtysecondrevit'
__version__ = '1.0.0'
"""
Using reflection we are able to obtain the current Dynamo instance from the Revit instance.
"""
# we need to import the common language runtime to be able to interact with Dynamo & Revit

# Importing Reference Modules
# CLR ( Common Language Runtime Module )
import clr
# Adding the DynamoRevitDS.dll module to work with the Dynamo API
clr.AddReference('DynamoRevitDS')
import Dynamo 

# access to the current Dynamo instance and workspace
dynamoRevit = Dynamo.Applications.DynamoRevit()
currentWorkspace = dynamoRevit.RevitDynamoModel.CurrentWorkspace

# Access current version of dynamo
version=dynamoRevit.RevitDynamoModel.Version

# checks version of dynamo and adjusts output according to version
if version.StartsWith("1."):
	
	# Gets file name which includes full path
	filename=currentWorkspace.FileName
	
	# Splits out file path to just file name
	OUT=filename.Split("\\")[-1].Replace(".dyn","")

elif version.StartsWith("2."):
	#OUT=dir(currentWorkspace)
	filename = currentWorkspace.FileName
	fileNameAndExtension = filename.Split("\\")[-1]
	filePath = filename.Replace(fileNameAndExtension, "")
	OUT=filePath,filename, currentWorkspace.Name

else:
	OUT="Not supported"
# ----------------------------------------

# group: Add warnings rating file name
code_block_68 = CodeBlock(x=python_script_9) { x[0] + "CurrentWarningRatingLibrary.csv"; }

warningLibraryFromCsv = archilab.Revit.Elements.WarningLibrary.WarningLibraryFromCsv(filePath=code_block_68)

# group: Isolate in view
isolate_refresh_2 = BoolSelector(true)  # graph input
activeViewFromCurrentDocument_3 = Custom[Document.ActiveViewFromCurrentDocument](Refresh_true_var=isolate_refresh_2)
isolate_in_view_3 = Custom[Isolate in View](Element=getItemAtIndex_7, View=activeViewFromCurrentDocument_3)

# group: Make Report?
make_a_report = BoolSelector(false)

# group: Get location of current dyn
python_script_10 = Python()  # same code as python_script_9

report_file_name = StringInput("Warnings Report")  # graph output

# group: Add file name
code_block_69 = CodeBlock(x=python_script_10, y=report_file_name) { x[0] + y; }

code_block_70 = CodeBlock(x=code_block_69) { x; }

# group: Output an excel summary of the warnings
parseHtml = archilab.Revit.Elements.Warning.ParseHtml(filePath=code_block_67)
assignRating = archilab.Revit.Elements.Warning.AssignRating(warning=parseHtml, library=warningLibraryFromCsv)
code_block_71 = CodeBlock { "Warnings"; 0; true; }
code_block_72 = CodeBlock { ["Warnings", "Severity", "Count"]; }
errorMessage = archilab.Revit.Elements.Warning.ErrorMessage(warning=assignRating)
groupByKey_2 = List.GroupByKey(list=assignRating, keys=errorMessage)
code_block_73 = CodeBlock(x=groupByKey_2.groups) { x; }
count_5 = List.Count(list=code_block_73@L2)
rating = archilab.Revit.Elements.Warning.Rating(warning=code_block_73)
code_block_74 = CodeBlock { 0; }
getItemAtIndex_25 = List.GetItemAtIndex(list=rating@L2, index=code_block_74)
code_block_75 = CodeBlock(x=groupByKey_2.unique_keys) { x; }
code_block_76 = CodeBlock(x=code_block_75) { x; }
list_create = List.Create(item0=count_5, item1=getItemAtIndex_25, item2=code_block_76)
reverse = List.Reverse(list=list_create)
transpose = List.Transpose(lists=reverse)
addItemToFront_3 = List.AddItemToFront(item=code_block_72, list=transpose)
exportExcel = Data.ExportExcel(filePath=code_block_70, sheetName=code_block_71.out0, startRow=code_block_71.out1, startCol=code_block_71.out1, data=addItemToFront_3, overWrite=code_block_71.out2)

# group: Catch unassigned warnings, the csv doesnt rate all 900 of them
code_block_77 = CodeBlock { null; }
allIndicesOf = List.AllIndicesOf(list=assignRating, item=code_block_77)

code_block_78 = CodeBlock { null; }
scopeIf = ScopedIf(test=make_a_report, true=exportExcel, false=code_block_78)

# group: Set section box to elements in active 3D view
code_block_79 = CodeBlock { 300; }
python_script_11 = Python(IN[0]=getItemAtIndex_12, IN[1]=code_block_79)
# ---------- python_script_11.python (80 lines) ----------
#Copyright(c) 2014, Konrad Sobon
# @arch_laboratory, http://archi-lab.net

import clr
clr.AddReference('ProtoGeometry')
from Autodesk.DesignScript.Geometry import *

# Import ToDSType(bool) extension method
clr.AddReference("RevitNodes")
import Revit
clr.ImportExtensions(Revit.Elements)

# Import DocumentManager and TransactionManager
clr.AddReference("RevitServices")
import RevitServices
from RevitServices.Persistence import DocumentManager
from RevitServices.Transactions import TransactionManager

from System.Collections.Generic import *

# Import RevitAPI
clr.AddReference("RevitAPI")
import Autodesk
from Autodesk.Revit.DB import *

doc = DocumentManager.Instance.CurrentDBDocument
uiapp = DocumentManager.Instance.CurrentUIApplication
app = uiapp.Application

#The inputs to this node will be stored as a list in the IN variable.
dataEnteringNode = IN

elements = []
for i in IN[0]:
	elements.append(UnwrapElement(i))
offset = float(IN[1])/304.8

#get ViewFamilyType for a 3D View
collector = FilteredElementCollector(doc)
viewTypeColl = collector.OfClass(ViewFamilyType)
for i in viewTypeColl:
	if i.ViewFamily == ViewFamily.ThreeDimensional:
		viewType = i
	else:
		continue
# "Start" the transaction
TransactionManager.Instance.EnsureInTransaction(doc)

#define bounding box enclosing all elements
bboxMin, bboxMax = [], []
for i in elements:
	bboxMin.append(i.get_BoundingBox(doc.ActiveView).Min)
	bboxMax.append(i.get_BoundingBox(doc.ActiveView).Max)
minX, minY, minZ, maxX, maxY, maxZ = [], [], [], [], [], []
for i, j in zip(bboxMin, bboxMax):
	minX.append(i.X)
	minY.append(i.Y)
	minZ.append(i.Z)
	maxX.append(j.X)
	maxY.append(j.Y)
	maxZ.append(j.Z)
bboxMinX = min(minX)
bboxMinY = min(minY)
bboxMinZ = min(minZ)
bboxMaxX = max(maxX)
bboxMaxY = max(maxY)
bboxMaxZ = max(maxZ)
#create a bounding box
bbox = BoundingBoxXYZ()
bbox.Min = XYZ((bboxMinX - offset), (bboxMinY - offset), (bboxMinZ - offset))
bbox.Max = XYZ((bboxMaxX + offset), (bboxMaxY + offset), (bboxMaxZ + offset))
#get active 3D view
view = doc.ActiveView
view.SetSectionBox(bbox)

# "End" the transaction x
TransactionManager.Instance.TransactionTaskDone()

#Assign your output to the OUT variable
OUT = bbox.Min, bbox.Max
# ----------------------------------------

# group: Isolate in view
isolate_refresh_3 = BoolSelector(true)  # graph input
code_block_80 = CodeBlock { "no"; }
if_23 = If(test=isolate_refresh_3, true=getItemAtIndex_12, false=code_block_80)
activeViewFromCurrentDocument_4 = Custom[Document.ActiveViewFromCurrentDocument](Refresh_true_var=isolate_refresh_3)
isolate_in_view_4 = Custom[Isolate in View](Element=if_23, View=activeViewFromCurrentDocument_4)
