# Dynamo graph _Clean file for Issue 2.5.dyn (Dynamo 2.5.0.7460)
# packages: spring nodes 203.2.0, Clockwork for Dynamo 2.x 2.3.0, Orchid 250.0.1.7458

# group: Delete View Templates
boolean = BoolSelector(true)  # graph input
python_script = Python(IN[0]=boolean)
# ---------- python_script.python (49 lines) ----------
# Copyright(c) 2016, Konrad K Sobon
# @arch_laboratory, http://archi-lab.net

# Import DocumentManager and TransactionManager
import clr
clr.AddReference("RevitServices")
import RevitServices
from RevitServices.Persistence import DocumentManager
from RevitServices.Transactions import TransactionManager
doc = DocumentManager.Instance.CurrentDBDocument

# Import RevitAPI
clr.AddReference("RevitAPI")
import Autodesk
from Autodesk.Revit.DB import *

import sys
pyt_path = r'C:\Program Files (x86)\IronPython 2.7\Lib'
sys.path.append(pyt_path)

#The inputs to this node will be stored as a list in the IN variable.
dataEnteringNode = IN

if IN[0]:
	try:
		errorReport = None
		TransactionManager.Instance.EnsureInTransaction(doc)
		
		allViewTemp = FilteredElementCollector(doc).OfClass(View).ToElements()
		toDelete = []
		for i in allViewTemp:
			if i.IsTemplate:
				try:
					doc.Delete(i.Id)
				except:
					pass

		TransactionManager.Instance.TransactionTaskDone()
	except:
		# if error accurs anywhere in the process catch it
		import traceback
		errorReport = traceback.format_exc()
else:
	errorReport = "Set input to True"
#Assign your output to the OUT variable
if errorReport == None:
	OUT = 0
else:
	OUT = errorReport
# ----------------------------------------
watch = Watch(python_script)

current = Orchid.RevitProject.Common.Document.Current()
all = Orchid.RevitProject.Views.View.All(document=current)

# group: Don't purge views with these words in title
code_block = CodeBlock { ["Coordination","Splash"]; }  # frozen

# group: Delete views (apart from Splash and Setout etc.)
# note: Custom Node: Orchid
#    v. 202.4.2.7024
name = Element.Name(element=all)
code_block_2 = CodeBlock(x=code_block) { x; }
boolean_2 = BoolSelector(true)  # graph input
contains = String.Contains(str=name, searchFor=code_block_2@L2, ignoreCase=boolean_2, lacing=CrossProduct)
# note: Custom Node: Clockwork v.1.31.2
anyTrue = Custom[List.AnyTrue](seq=contains@L2)  # package Clockwork for Dynamo 2.x; Returns true if any item in a list of booleans is true.
filterByBoolMask = List.FilterByBoolMask(list=all, mask=anyTrue)
flatten = List.Flatten(list=filterByBoolMask.in)
watch_2 = Watch(flatten)
flatten_2 = List.Flatten(list=filterByBoolMask.out)
watch_3 = Watch(flatten_2)

# group: Catch Nulls
isNull = Object.IsNull(obj=watch_3)
code_block_3 = CodeBlock { "is Null"; }
if_ = If(test=isNull, true=code_block_3, false=watch_3)

# group: Don't delete splash screen title block
code_block_4 = CodeBlock { "HTA-Splash screen"; }

# group: Delete Title Blocks
code_block_5 = CodeBlock { "Title Blocks"; }
byName = Category.ByName(name=code_block_5)
boolean_3 = BoolSelector(true)  # graph input
code_block_6 = CodeBlock { null; }
# note: Custom Node: Clockwork v.1.31.2
all_families_of_category = Custom[All Families Of Category](category=byName, toggle=boolean_3, docOrRevitLinkInstance=code_block_6)  # package Clockwork for Dynamo 2.x; Gets all famiies of a given category in the model (does *not *work for system families)
# note: Keep Splash screen title block
byName_2 = FamilyType.ByName(name=code_block_4)
family = FamilyType.Family(familyType=byName_2)
setDifference = List.SetDifference(list1=all_families_of_category, list2=family)

# group: Catch Nulls
isNull_2 = Object.IsNull(obj=setDifference)
code_block_7 = CodeBlock { "is Null"; }
if_2 = If(test=isNull_2, true=code_block_7, false=setDifference)

# group: Delete Sheets
code_block_8 = CodeBlock { "DrawingSheet"; }
getByType = archilab.Revit.Views.Views.GetByType(viewType=code_block_8)
sheetNumber = Sheet.SheetNumber(sheet=getByType)
# note: Keep Splash screen sheet
code_block_9 = CodeBlock { "0000"; }
boolean_4 = BoolSelector(false)  # graph input
boolean_5 = BoolSelector(true)  # graph input
# note: Custom Node: spring nodes v.132.2.7
sheets = Custom[Springs.Collector.Sheets](searchFor=code_block_9, NameOrNumber=boolean_4, refresh=boolean_5)  # package spring nodes; Search for sheets by either their name or their number. Use a false boolean switch to search by number.
code_block_10 = CodeBlock(x=sheets.exact_match) { x[0]; }
eq = sheetNumber == code_block_10
filterByBoolMask_2 = List.FilterByBoolMask(list=sheetNumber, mask=eq)

# group: Catch nulls
isNull_3 = Object.IsNull(obj=filterByBoolMask_2.out)
code_block_11 = CodeBlock { "is Null"; }
if_3 = If(test=isNull_3, true=code_block_11, false=filterByBoolMask_2.out)

# group: Don't purge HTA Revit Links
string = StringInput("HTA")  # graph input

# group: Remove Revit Links
code_block_12 = CodeBlock { "RevitLinkType"; }
byName_3 = Custom[ElementType.ByName](name=code_block_12)  # package Clockwork for Dynamo 2.x; Retrieves an element type by its name - to be used with the OOTB node "All Elements of Type".
all_elements_of_type = ElementsOfType(element_type=byName_3)
code_block_13 = CodeBlock { "RevitLinkInstance"; }
byName_4 = Custom[ElementType.ByName](name=code_block_13)
all_elements_of_type_2 = ElementsOfType(element_type=byName_4)
create = List.Create(item0=all_elements_of_type, item1=all_elements_of_type_2)
code_block_14 = CodeBlock(e=create) { e.Name; }
contains_2 = String.Contains(str=code_block_14, searchFor=string)
filterByBoolMask_3 = List.FilterByBoolMask(list=create, mask=contains_2)

# group: Catch nulls
isNull_4 = Object.IsNull(obj=filterByBoolMask_3.out)
code_block_15 = CodeBlock { "is Null"; }
if_4 = If(test=isNull_4, true=code_block_15, false=filterByBoolMask_3.out)

# group: Don't purge dwgs with this name
# note: It won't work if the path is wrong
string_2 = StringInput("Topographic Survey")  # graph input

# group: Remove Dwg Links
code_block_16 = CodeBlock { "ImportInstance"; }
byName_5 = Custom[ElementType.ByName](name=code_block_16)
all_elements_of_type_3 = ElementsOfType(element_type=byName_5)
string_3 = StringInput("Name")  # graph input
getParameterValueByName = Element.GetParameterValueByName(element=all_elements_of_type_3, parameterName=string_3)
contains_3 = String.Contains(str=getParameterValueByName, searchFor=string_2)
filterByBoolMask_4 = List.FilterByBoolMask(list=all_elements_of_type_3, mask=contains_3)

# group: Catch nulls
isNull_5 = Object.IsNull(obj=filterByBoolMask_4.out)
code_block_17 = CodeBlock { "is Null"; }
if_5 = If(test=isNull_5, true=code_block_17, false=filterByBoolMask_4.out)

# group: Delete
join = List.Join(list0=if_, list1=if_2, list2=if_3, list3=if_4, list4=if_5)
# note: Custom Node: archilab v.2019.2.11
delete = archilab.Revit.Elements.Elements.Delete(element=join)

# group: Don't purge until elements deleted
# note: Custom Node: Orchid
#    v. 202.4.2.7024
current_2 = Orchid.RevitProject.Common.Document.Current()
# note: Custom Node: Clockwork v.1.31.2
passthrough = Custom[Passthrough](passThrough=current_2, waitFor=delete)  # package Clockwork for Dynamo 2.x; Forces a sequential order of execution. The node wired into the output of the Passthrough node will be executed *after* the node wired into the waitFor input (e.g. important for some Revit operations). The value of the passThrough input will be passed on to the node wired into the output port of the Passthrough node.

# group: Purge File
code_block_18 = CodeBlock { true; }
# note: Custom Node: Orchid
#    v. 202.4.2.7024
purge = Orchid.RevitProject.Common.Document.Purge(document=passthrough, completely=code_block_18)
