# Dynamo graph revision tracking-MKA.dyn (Dynamo 1.3.4.6666)

projectParameters = Custom[Document.ProjectParameters]()  # Retrieves all project parameters and the categories they have been assigned to
code_block = CodeBlock { x; }  # unwired: x
watch = Watch(code_block)
code_block_2 = CodeBlock { "Sheet Parameter"; }
code_block_3 = CodeBlock { "SHEET_NUMBER"; "SHEET_NAME"; }
categories = Categories("Sheets")
all_elements_of_category = ElementsOfCategory(categories)
code_block_4 = CodeBlock { "SHEET_SCHEDULED"; }
get_built_in_parameter = Custom[Get Built In Parameter](ParameterNames=code_block_4, Elements=all_elements_of_category)  # This node will take an input of a built in parameter name and element to return that parameters value.
code_block_5 = CodeBlock(x=get_built_in_parameter) { x == 1 ? true : false; }
filterByBoolMask = List.FilterByBoolMask(list=all_elements_of_category, mask=code_block_5)
get_built_in_parameter_2 = Custom[Get Built In Parameter](ParameterNames=code_block_3.out0, Elements=filterByBoolMask.in)
revisions = archilab.Revit.Views.Sheet.Revisions(filterByBoolMask.in)
boolean = BoolSelector(true)
get_all_revisions = Custom[Get All Revisions](RunIt=boolean)  # This node will return all Revisions currently defined in the mode.
watch_2 = Watch(get_all_revisions)
name = Custom[Element.Name+](element=watch_2)  # Gets an element's name (Dynamo's built-in Name nodes don't work for all element types, e.g. worksets...)
code_block_6 = CodeBlock { "Map Revisions to Sheet Parameter"; }
file_path = Filename("\\si.net\BIM\Revit\Common\Logos\Southland Engineering\SouthlandInd_EngVrtR_7453_pos_FIN.jpg")
fromPath = FileObject(file_path)  # "File.FromPath"
readFromFile = Image.ReadFromFile(fromPath)
code_block_7 = CodeBlock { "Revision"; }
boolean_2 = BoolSelector(false)
get_all_revisions_2 = Custom[Get All Revisions](RunIt=boolean_2)
watch_3 = Watch(get_all_revisions_2)
name_2 = Custom[Element.Name+](element=watch_3)
flatten = Flatten(name_2)
watch_4 = Watch(flatten)
ui_dropdown_data = Custom[UI.DropDown Data](InputName=code_block_7, Keys=watch_4, Values=watch_4)  # Create data for DropDown input in UI.MultiInputForm ++ . Check out www.data-shapes.net for more infos.; unwired: Sorted_optional
filterByBoolMask_2 = List.FilterByBoolMask(list=code_block)  # unwired: mask
watch_5 = Watch(filterByBoolMask_2.in)
ui_dropdown_data_2 = Custom[UI.DropDown Data](Keys=watch_5, Values=watch_5)  # unwired: Sorted_optional
create = List.Create(ui_dropdown_data, ui_dropdown_data_2)
number = DoubleInput(5)
cycle = List.Cycle(list=create, amount=number)
boolean_3 = BoolSelector(true)
code_block_8 = CodeBlock { "Cancel"; }
number_2 = DoubleInput(500)
ui_multipleinputform = Custom[UI.MultipleInputForm ++](Description_optional=code_block_6, Logo_optional=readFromFile, Inputs=cycle, Toggle=boolean_3, CancelButtonText_optional=code_block_8, Width_optional=number_2)  # Create a form with multiple inputs. see www.data-shapes.net for tutorials and infos!
code_block_9 = CodeBlock { "--N/A--"; }
replaceNull = Custom[List.ReplaceNull](seq=ui_multipleinputform.User_Inputs, replacement=code_block_9)  # Replaces all null values within a given list with a substitute
number_3 = DoubleInput(0)
getItemAtIndex = List.GetItemAtIndex(list=replaceNull, index=number_3)
watch_6 = Watch(getItemAtIndex)
contains = String.Contains(str=name, searchFor=watch_6)
filterByBoolMask_3 = List.FilterByBoolMask(list=watch_2, mask=contains)
containsItem = List.ContainsItem(list=revisions@L2, item=filterByBoolMask_3.in, lacing=Longest)
filterByBoolMask_4 = List.FilterByBoolMask(list=get_built_in_parameter_2, mask=containsItem)
boolean_4 = BoolSelector(false)
code_block_10 = CodeBlock(DoesContain=boolean_4) { DoesContain; }
get_sheet_by_name_py = Python(IN[0]=filterByBoolMask_4.in, IN[1]=code_block_10)
# ---------- get_sheet_by_name_py.python (54 lines) ----------
#For more information refer to RBG Wiki or email me (ctrl + click link): daniel.woodcock@robertbird.com

import clr
clr.AddReference("RevitNodes")
import Revit
clr.ImportExtensions(Revit.Elements)

# Import DocumentManager and TransactionManager
clr.AddReference("RevitServices")
import RevitServices
from RevitServices.Persistence import DocumentManager
from RevitServices.Transactions import TransactionManager
doc = DocumentManager.Instance.CurrentDBDocument
uidoc = DocumentManager.Instance.CurrentUIDocument

# Import RevitAPI
clr.AddReference("RevitAPI")
import Autodesk
from Autodesk.Revit.DB import *

import System
from System.Collections.Generic import *

import sys
pyt_path = r'C:\Program Files (x86)\IronPython 2.7\Lib'
sys.path.append(pyt_path)

def tolist(obj1):
	if hasattr(obj1,"__iter__"): return obj1
	else: return [obj1]

names = tolist(IN[0])
cont = tolist(IN[1])
cont = cont[0]

fec = FilteredElementCollector(doc)
fec = fec.OfClass(ViewSheet)

outList = []

for vSheet in fec:
	v = UnwrapElement(vSheet)
	if not v.IsTemplate:
		for name in names:
			if cont:
				if name in v.SheetNumber:
					outList.append(v)
					break
			else:
				if v.SheetNumber == name:
					outList.append(v)
					break
	
OUT = outList
# ----------------------------------------
code_block_11 = CodeBlock(OUT=get_sheet_by_name_py) { OUT; }
watch_7 = Watch(code_block_11)
number_4 = DoubleInput(1)
getItemAtIndex_2 = List.GetItemAtIndex(list=replaceNull, index=number_4)
watch_8 = Watch(getItemAtIndex_2)
code_block_12 = CodeBlock { "X"; }
setParameterByName = Element.SetParameterByName(element=watch_7, parameterName=watch_8, value=code_block_12)
code_block_13 = CodeBlock { "SHEET_NUMBER"; "SHEET_NAME"; }
categories_2 = Categories("Sheets")
all_elements_of_category_2 = ElementsOfCategory(categories_2)
code_block_14 = CodeBlock { "SHEET_SCHEDULED"; }
get_built_in_parameter_3 = Custom[Get Built In Parameter](ParameterNames=code_block_14, Elements=all_elements_of_category_2)
code_block_15 = CodeBlock(x=get_built_in_parameter_3) { x == 1 ? true : false; }
filterByBoolMask_5 = List.FilterByBoolMask(list=all_elements_of_category_2, mask=code_block_15)
get_built_in_parameter_4 = Custom[Get Built In Parameter](ParameterNames=code_block_13.out0, Elements=filterByBoolMask_5.in)
revisions_2 = archilab.Revit.Views.Sheet.Revisions(filterByBoolMask_5.in)
boolean_5 = BoolSelector(true)
get_all_revisions_3 = Custom[Get All Revisions](RunIt=boolean_5)
watch_9 = Watch(get_all_revisions_3)
name_3 = Custom[Element.Name+](element=watch_9)
number_5 = DoubleInput(2)
getItemAtIndex_3 = List.GetItemAtIndex(list=replaceNull, index=number_5)
watch_10 = Watch(getItemAtIndex_3)
contains_2 = String.Contains(str=name_3, searchFor=watch_10)
filterByBoolMask_6 = List.FilterByBoolMask(list=watch_9, mask=contains_2)
containsItem_2 = List.ContainsItem(list=revisions_2@L2, item=filterByBoolMask_6.in, lacing=Longest)
filterByBoolMask_7 = List.FilterByBoolMask(list=get_built_in_parameter_4, mask=containsItem_2)
boolean_6 = BoolSelector(false)
code_block_16 = CodeBlock(DoesContain=boolean_6) { DoesContain; }
get_sheet_by_name_py_2 = Python(IN[0]=filterByBoolMask_7.in, IN[1]=code_block_16)  # same code as get_sheet_by_name_py
code_block_17 = CodeBlock(OUT=get_sheet_by_name_py_2) { OUT; }
watch_11 = Watch(code_block_17)
number_6 = DoubleInput(3)
getItemAtIndex_4 = List.GetItemAtIndex(list=replaceNull, index=number_6)
watch_12 = Watch(getItemAtIndex_4)
code_block_18 = CodeBlock { "X"; }
setParameterByName_2 = Element.SetParameterByName(element=watch_11, parameterName=watch_12, value=code_block_18)
code_block_19 = CodeBlock { "SHEET_NUMBER"; "SHEET_NAME"; }
categories_3 = Categories("Sheets")
all_elements_of_category_3 = ElementsOfCategory(categories_3)
code_block_20 = CodeBlock { "SHEET_SCHEDULED"; }
get_built_in_parameter_5 = Custom[Get Built In Parameter](ParameterNames=code_block_20, Elements=all_elements_of_category_3)
code_block_21 = CodeBlock(x=get_built_in_parameter_5) { x == 1 ? true : false; }
filterByBoolMask_8 = List.FilterByBoolMask(list=all_elements_of_category_3, mask=code_block_21)
get_built_in_parameter_6 = Custom[Get Built In Parameter](ParameterNames=code_block_19.out0, Elements=filterByBoolMask_8.in)
revisions_3 = archilab.Revit.Views.Sheet.Revisions(filterByBoolMask_8.in)
boolean_7 = BoolSelector(true)
get_all_revisions_4 = Custom[Get All Revisions](RunIt=boolean_7)
watch_13 = Watch(get_all_revisions_4)
name_4 = Custom[Element.Name+](element=watch_13)
number_7 = DoubleInput(4)
getItemAtIndex_5 = List.GetItemAtIndex(list=replaceNull, index=number_7)
watch_14 = Watch(getItemAtIndex_5)
contains_3 = String.Contains(str=name_4, searchFor=watch_14)
filterByBoolMask_9 = List.FilterByBoolMask(list=watch_13, mask=contains_3)
containsItem_3 = List.ContainsItem(list=revisions_3@L2, item=filterByBoolMask_9.in, lacing=Longest)
filterByBoolMask_10 = List.FilterByBoolMask(list=get_built_in_parameter_6, mask=containsItem_3)
boolean_8 = BoolSelector(false)
code_block_22 = CodeBlock(DoesContain=boolean_8) { DoesContain; }
get_sheet_by_name_py_3 = Python(IN[0]=filterByBoolMask_10.in, IN[1]=code_block_22)  # same code as get_sheet_by_name_py
code_block_23 = CodeBlock(OUT=get_sheet_by_name_py_3) { OUT; }
watch_15 = Watch(code_block_23)
number_8 = DoubleInput(5)
getItemAtIndex_6 = List.GetItemAtIndex(list=replaceNull, index=number_8)
watch_16 = Watch(getItemAtIndex_6)
code_block_24 = CodeBlock { "X"; }
setParameterByName_3 = Element.SetParameterByName(element=watch_15, parameterName=watch_16, value=code_block_24)
code_block_25 = CodeBlock { "SHEET_NUMBER"; "SHEET_NAME"; }
categories_4 = Categories("Sheets")
all_elements_of_category_4 = ElementsOfCategory(categories_4)
code_block_26 = CodeBlock { "SHEET_SCHEDULED"; }
get_built_in_parameter_7 = Custom[Get Built In Parameter](ParameterNames=code_block_26, Elements=all_elements_of_category_4)
code_block_27 = CodeBlock(x=get_built_in_parameter_7) { x == 1 ? true : false; }
filterByBoolMask_11 = List.FilterByBoolMask(list=all_elements_of_category_4, mask=code_block_27)
get_built_in_parameter_8 = Custom[Get Built In Parameter](ParameterNames=code_block_25.out0, Elements=filterByBoolMask_11.in)
revisions_4 = archilab.Revit.Views.Sheet.Revisions(filterByBoolMask_11.in)
boolean_9 = BoolSelector(true)
get_all_revisions_5 = Custom[Get All Revisions](RunIt=boolean_9)
watch_17 = Watch(get_all_revisions_5)
name_5 = Custom[Element.Name+](element=watch_17)
number_9 = DoubleInput(6)
getItemAtIndex_7 = List.GetItemAtIndex(list=replaceNull, index=number_9)
watch_18 = Watch(getItemAtIndex_7)
contains_4 = String.Contains(str=name_5, searchFor=watch_18)
filterByBoolMask_12 = List.FilterByBoolMask(list=watch_17, mask=contains_4)
containsItem_4 = List.ContainsItem(list=revisions_4@L2, item=filterByBoolMask_12.in, lacing=Longest)
filterByBoolMask_13 = List.FilterByBoolMask(list=get_built_in_parameter_8, mask=containsItem_4)
boolean_10 = BoolSelector(false)
code_block_28 = CodeBlock(DoesContain=boolean_10) { DoesContain; }
get_sheet_by_name_py_4 = Python(IN[0]=filterByBoolMask_13.in, IN[1]=code_block_28)  # same code as get_sheet_by_name_py
code_block_29 = CodeBlock(OUT=get_sheet_by_name_py_4) { OUT; }
watch_19 = Watch(code_block_29)
number_10 = DoubleInput(7)
getItemAtIndex_8 = List.GetItemAtIndex(list=replaceNull, index=number_10)
watch_20 = Watch(getItemAtIndex_8)
code_block_30 = CodeBlock { "X"; }
setParameterByName_4 = Element.SetParameterByName(element=watch_19, parameterName=watch_20, value=code_block_30)
code_block_31 = CodeBlock { "SHEET_NUMBER"; "SHEET_NAME"; }
categories_5 = Categories("Sheets")
all_elements_of_category_5 = ElementsOfCategory(categories_5)
code_block_32 = CodeBlock { "SHEET_SCHEDULED"; }
get_built_in_parameter_9 = Custom[Get Built In Parameter](ParameterNames=code_block_32, Elements=all_elements_of_category_5)
code_block_33 = CodeBlock(x=get_built_in_parameter_9) { x == 1 ? true : false; }
filterByBoolMask_14 = List.FilterByBoolMask(list=all_elements_of_category_5, mask=code_block_33)
get_built_in_parameter_10 = Custom[Get Built In Parameter](ParameterNames=code_block_31.out0, Elements=filterByBoolMask_14.in)
revisions_5 = archilab.Revit.Views.Sheet.Revisions(filterByBoolMask_14.in)
boolean_11 = BoolSelector(true)
get_all_revisions_6 = Custom[Get All Revisions](RunIt=boolean_11)
watch_21 = Watch(get_all_revisions_6)
name_6 = Custom[Element.Name+](element=watch_21)
number_11 = DoubleInput(8)
getItemAtIndex_9 = List.GetItemAtIndex(list=replaceNull, index=number_11)
watch_22 = Watch(getItemAtIndex_9)
contains_5 = String.Contains(str=name_6, searchFor=watch_22)
filterByBoolMask_15 = List.FilterByBoolMask(list=watch_21, mask=contains_5)
containsItem_5 = List.ContainsItem(list=revisions_5@L2, item=filterByBoolMask_15.in, lacing=Longest)
filterByBoolMask_16 = List.FilterByBoolMask(list=get_built_in_parameter_10, mask=containsItem_5)
boolean_12 = BoolSelector(false)
code_block_34 = CodeBlock(DoesContain=boolean_12) { DoesContain; }
get_sheet_by_name_py_5 = Python(IN[0]=filterByBoolMask_16.in, IN[1]=code_block_34)  # same code as get_sheet_by_name_py
code_block_35 = CodeBlock(OUT=get_sheet_by_name_py_5) { OUT; }
watch_23 = Watch(code_block_35)
number_12 = DoubleInput(9)
getItemAtIndex_10 = List.GetItemAtIndex(list=replaceNull, index=number_12)
watch_24 = Watch(getItemAtIndex_10)
code_block_36 = CodeBlock { "X"; }
setParameterByName_5 = Element.SetParameterByName(element=watch_23, parameterName=watch_24, value=code_block_36)
view_type = ViewTypesUi("DrawingSheet")
getByType = Archilab.Grimshaw.Views.View.GetByType(view_type)
revisions_6 = Archilab.Grimshaw.Views.Sheet.Revisions(getByType)
isEmpty = List.IsEmpty(revisions_6@L2)
filterByBoolMask_17 = List.FilterByBoolMask(list=revisions_6, mask=isEmpty)
code_block_37 = CodeBlock(x=filterByBoolMask_17.out) { x; }
code_block_38 = CodeBlock(x=code_block_37) { x; }
code_block_39 = CodeBlock { "Revision Sequence"; }
getParameterValueByName = Element.GetParameterValueByName(element=code_block_38, parameterName=code_block_39)
string_from_object = FromObject(getParameterValueByName)
code_block_40 = CodeBlock(y=string_from_object) { "ISSUE " + y; }
setParameterByName_6 = Element.SetParameterByName(parameterName=code_block_40)  # unwired: element, value
filterByBoolMask_18 = List.FilterByBoolMask(list=getByType, mask=isEmpty)
revisions_7 = Archilab.Grimshaw.Views.Sheet.Revisions(filterByBoolMask_18.out)
code_block_41 = CodeBlock { "Revision Sequence"; }
getParameterValueByName_2 = Element.GetParameterValueByName(element=revisions_7, parameterName=code_block_41)
string_from_object_2 = FromObject(getParameterValueByName_2)
code_block_42 = CodeBlock(y=string_from_object_2) { "ISSUE " + y; }
parameters = Element.Parameters(getByType)
code_block_43 = CodeBlock { "Revision Number"; }
getParameterValueByName_3 = Element.GetParameterValueByName(parameterName=code_block_43)  # unwired: element
python_script = Python(IN[0]=code_block_38)
# ---------- python_script.python (68 lines) ----------
# Copyright(c) 2015, Konrad K Sobon
# @arch_laboratory, http://archi-lab.net

import clr
# Import Element wrapper extension methods
clr.AddReference("RevitNodes")
import Revit
clr.ImportExtensions(Revit.Elements)

# Import DocumentManager and TransactionManager
clr.AddReference("RevitServices")
import RevitServices
from RevitServices.Persistence import DocumentManager
doc = DocumentManager.Instance.CurrentDBDocument

# Import RevitAPI
clr.AddReference("RevitAPI")
import Autodesk
from Autodesk.Revit.DB import *

import sys
pyt_path = r'C:\Program Files (x86)\IronPython 2.7\Lib'
sys.path.append(pyt_path)

#The inputs to this node will be stored as a list in the IN variable.
dataEnteringNode = IN

def ProcessList(_func, _list):
    return map( lambda x: ProcessList(_func, x) if type(x)==list else _func(x), _list )

def UnwrapNestedList(e):
	return UnwrapElement(e)
def GetSequence(e):
	return e.SequenceNumber
def GetDate(e):
	return e.RevisionDate
def GetIssuedTo(e):
	return e.IssuedTo
def GetIssuedBy(e):
	return e.IssuedBy
def GetIssued(e):
	return e.Issued
def GetDescription(e):
	return e.Description

if isinstance(IN[0], list):
	revs = ProcessList(UnwrapNestedList, IN[0])
else:
	revs = [UnwrapElement(IN[0])]

try:
	errorReport = None
	sequence = ProcessList(GetSequence, revs)
	date = ProcessList(GetDate, revs)
	description = ProcessList(GetDescription, revs)
	issued = ProcessList(GetIssued, revs)
	issuedTo = ProcessList(GetIssuedTo, revs)
	issuedBy = ProcessList(GetIssuedBy, revs)
except:
	# if error accurs anywhere in the process catch it
	import traceback
	errorReport = traceback.format_exc()

#Assign your output to the OUT variable
if errorReport == None:
	OUT = [sequence, date, description, issued, issuedTo, issuedBy]
else:
	OUT = errorReport
# ----------------------------------------
python_script_2 = Python()  # unwired: IN[0]
# ---------- python_script_2.python (29 lines) ----------
# Copyright(c) 2015, Konrad K Sobon
# @arch_laboratory, http://archi-lab.net

import clr
# Import Element wrapper extension methods
clr.AddReference("RevitNodes")
import Revit
clr.ImportExtensions(Revit.Elements)

# Import DocumentManager and TransactionManager
clr.AddReference("RevitServices")
import RevitServices
from RevitServices.Persistence import DocumentManager
doc = DocumentManager.Instance.CurrentDBDocument

# Import RevitAPI
clr.AddReference("RevitAPI")
import Autodesk
from Autodesk.Revit.DB import *

import sys
pyt_path = r'C:\Program Files (x86)\IronPython 2.7\Lib'
sys.path.append(pyt_path)

revs = UnwrapElement(IN[0])

for rev in revs:
    for e in rev:
        OUT = Autodesk.Revit.DB.ViewSheet.Get_RevisionNumberOnSheet(e)
# ----------------------------------------
code_block_44 = CodeBlock(x=code_block_38) { x[0][0]; }
code_block_45 = CodeBlock { x[0]; }  # unwired: x
python_script_3 = Python(IN[0]=code_block_44, IN[1]=code_block_45)
# ---------- python_script_3.python (28 lines) ----------
# Copyright(c) 2015, Konrad K Sobon
# @arch_laboratory, http://archi-lab.net

import clr
# Import Element wrapper extension methods
clr.AddReference("RevitNodes")
import Revit
clr.ImportExtensions(Revit.Elements)

# Import DocumentManager and TransactionManager
clr.AddReference("RevitServices")
import RevitServices
from RevitServices.Persistence import DocumentManager
doc = DocumentManager.Instance.CurrentDBDocument

# Import RevitAPI
clr.AddReference("RevitAPI")
import Autodesk
from Autodesk.Revit.DB import *

import sys
pyt_path = r'C:\Program Files (x86)\IronPython 2.7\Lib'
sys.path.append(pyt_path)

revs = UnwrapElement(IN[0])
sheet = UnwrapElement(IN[1])

OUT = Autodesk.Revit.DB.ViewSheet.GetRevisionNumberOnSheet(sheet, revs.Id)
# ----------------------------------------
filterByBoolMask_19 = List.FilterByBoolMask(list=getByType, mask=isEmpty)
code_block_46 = CodeBlock { 1; }
chop = List.Chop(list=filterByBoolMask_19.out, lengths=code_block_46)
count = Count(code_block_37@L2)
cycle_2 = List.Cycle(list=chop@L2, amount=count@L1)
python_script_4 = Python(IN[0]=code_block_38, IN[1]=cycle_2)
# ---------- python_script_4.python (38 lines) ----------
# Copyright(c) 2015, Konrad K Sobon
# @arch_laboratory, http://archi-lab.net

import clr
# Import Element wrapper extension methods
clr.AddReference("RevitNodes")
import Revit
clr.ImportExtensions(Revit.Elements)

# Import DocumentManager and TransactionManager
clr.AddReference("RevitServices")
import RevitServices
from RevitServices.Persistence import DocumentManager
doc = DocumentManager.Instance.CurrentDBDocument

# Import RevitAPI
clr.AddReference("RevitAPI")
import Autodesk
from Autodesk.Revit.DB import *

import sys
pyt_path = r'C:\Program Files (x86)\IronPython 2.7\Lib'
sys.path.append(pyt_path)

revisions = UnwrapElement(IN[0])
sheets = UnwrapElement(IN[1])

revs = []
r = []
Output = []

for sheet, revision in zip(sheets, revisions):
    for sht, rev in zip(sheet, revision):
        r = Autodesk.Revit.DB.ViewSheet.GetRevisionNumberOnSheet(sht, rev.Id)        
        Output.append(r)
        

OUT = Output
# ----------------------------------------
